# Grasshopper definition generateshapes.gh (Grasshopper 1.0.7)
# plug-ins: Human, Ironbug.LBHB_Legacy, LunchBox, Colibri, GH_CPython, TT Toolbox

number_slider = Slider(1, range=0..3)
iterate = FalseStartToggle(False)
read_csv = FalseStartToggle(False)
from_csv = BooleanToggle(False)
data = Data(number_slider)

# ---- group: Read CSV
panel = Panel("D:\phd\grasshopper\ml generation csv")
data_2 = Data("C:\Users\Mateusz\Documents\Jupyter\ML\data")
concat = Concatenate(FragmentA=data_2, FragmentB="\")
concat_2 = Concatenate(FragmentA=concat, FragmentB="ml-full1500.csv")
readxl = ReadExcelSheet(Run=read_csv, FilePath=concat_2, Worksheet="1", Listen=False)  # -> UserMessages, Columns, Rows
cluster = Cluster_6(columns=readxl.Columns, rows=readxl.Rows)
item = ListItem(List=readxl.Columns, Index=0, Wrap=True)  # -> flatten(Item)
values = Data(cluster)
headers = Data(item)
flip = FlipMatrix(Data=values)
panel_2 = Panel(headers)
bang = ExplodeTree(Data=flip)  # -> Branch0, Branch1, Branch2, Branch3, Branch4, Branch5, Branch6, Branch7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
data_3 = Data(data)
item_2 = ListItem(List=bang.Branch2, Index=data_3, Wrap=True)
item_3 = ListItem(List=bang.Branch1, Index=data_3, Wrap=True)
item_4 = ListItem(List=bang.Branch3, Index=data_3, Wrap=True)
item_5 = ListItem(List=bang.Branch4, Index=data_3, Wrap=True)
item_6 = ListItem(List=bang.Branch5, Index=data_3, Wrap=True)
item_7 = ListItem(List=bang.Branch6, Index=data_3, Wrap=True)
item_8 = ListItem(List=bang.Branch7, Index=data_3, Wrap=True)
item_9 = ListItem(List=bang.Branch8, Index=data_3, Wrap=True)
item_10 = ListItem(List=bang.Branch9, Index=data_3, Wrap=True)
item_11 = ListItem(List=bang.Branch10, Index=data_3, Wrap=True)
item_12 = ListItem(List=bang.Branch11, Index=data_3, Wrap=True)
levels = Data(flatten(item_2))
width = Data(flatten(item_3))
shading = Data(flatten(item_12))
window_option = Data(flatten(item_11))
wnd_density_east = Data(flatten(item_10))
wall_ins_thickness = Data(flatten(item_4))
wnd_density_west = Data(flatten(item_9))
roof_ins_thickness = Data(flatten(item_5))
wnd_density_north = Data(flatten(item_8))
wnd_density_south = Data(flatten(item_7))
ground_ins_thickness = Data(flatten(item_6))

# ----
fly = Ladybug_fly(inputSliders=number_slider, fly=iterate)  # -> Vviiiiiiiiiizzz; plug-in component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
roof_insulation_thickness = Slider(0.25, range=0.18..0.88)
window_density_east = Slider(0.15, range=0.13..0.6)
window_option_2 = Slider(1, range=1..3)
shading_2 = Slider(2, range=0..2)
levels_2 = Slider(3, range=2..3)
width_2 = Slider(20, range=12..24)
wall_insulation_thickness = Slider(0.17, range=0.13..0.83)
ground_insulation_thickness = Slider(0.1, range=0.1..0.8)
window_density_north = Slider(0.15, range=0.13..0.6)
window_density_west = Slider(0.15, range=0.13..0.6)
window_density_south = Slider(0.35, range=0.13..0.8)
c_script = CSharpScript()  # inputs File: String, Lines: list of String
# ---------- c_script: C# ----------
    System.IO.File.WriteAllLines(File, Lines, System.Text.Encoding.UTF8);
# ---------- end c_script ----------
levels_3 = Data(flatten(item_2))
width_3 = Data(flatten(item_3))
headers_2 = Data(item)
wall_ins_thickness_2 = Data(flatten(item_4))
roof_ins_thickness_2 = Data(flatten(item_5))
ground_ins_thickness_2 = Data(flatten(item_6))

toggle = FalseStartToggle(False)
ladybug = Ladybug_Ladybug()  # -> Vviiiiiiiiiizzz; plug-in component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
honeybee = Honeybee_Honeybee()  # -> Vviiiiiiiiiizzz; plug-in component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
updateghfile = Ladybug_UpdateFile(update=toggle)  # -> readMe; plug-in component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

# ---- group: Generate area bounds
toggle_2 = FalseStartToggle(False)
number_slider_2 = Slider(500, range=0..1000)
multiplication = Multiplication(A=number_slider_2, B=Slider(0.6, range=0..1))
division = Division(A=number_slider_2, B=2)
multiplication_2 = Multiplication(A=division, B=-1)
division_2 = Division(A=multiplication, B=2)
multiplication_3 = Multiplication(A=division_2, B=-1)
dom = ConstructDomain(DomainStart=division, DomainEnd=multiplication_2)
dom_2 = ConstructDomain(DomainStart=division_2, DomainEnd=multiplication_3)
swatch = ColourSwatch(SwatchColor=RGB(255, 255, 255))
rectangle = Rectangle(Plane=PlaneXY(0, 0, 0), XSize=dom, YSize=dom, Radius=0)  # -> Rectangle, Length
rectangle_2 = Rectangle(Plane=PlaneXY(0, 0, 0), XSize=dom_2, YSize=dom_2, Radius=0)  # -> Rectangle, Length
srf = Surface(rectangle.Rectangle)
bake = ObjectBake(
    BakeToggle=toggle_2,
    GeometryObjects=srf,
    Layer="Ground",
    ObjectName="GH_Obj",
    ObjectColor=RGB(255, 255, 255),
    LayerColor=RGB(255, 255, 255))
data_4 = Data(rectangle_2.Rectangle)

# ----
from_sliders_or_from_csv = FromSlidersOrFromCSV(
    bool=from_csv,
    _0_3=levels_2,
    _1_3=levels,
    _0_6=width_2,
    _1_6=width,
    _0_11=wall_insulation_thickness,
    _1_11=wall_ins_thickness,
    _0_2=roof_insulation_thickness,
    _1_2=roof_ins_thickness,
    _0_7=ground_insulation_thickness,
    _1_7=ground_ins_thickness,
    _0_10=window_density_north,
    _1_10=wnd_density_north,
    _0=window_density_west,
    _1=wnd_density_west,
    _0_5=window_density_south,
    _1_5=wnd_density_south,
    _0_9=window_density_east,
    _1_9=wnd_density_east,
    _0_4=window_option_2,
    _1_4=window_option,
    _0_8=shading_2,
    _1_8=shading)  # -> R_3, R_6, R_11, R_2, R_7, R_10, R, R_5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
panel_3 = Panel(honeybee)
B = Slider(0, range=0..1000)
B_2 = Slider(1, range=0..2)
iterate_2 = FalseStartToggle(False)
panel_4 = Panel("""0 - Warszawa
1 - Szczecin
2 - Zakopane""")
fly_2 = Ladybug_fly(inputSliders=B_2, fly=iterate_2)  # -> Vviiiiiiiiiizzz; inputs inputSliders: list, fly: Boolean; plug-in component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
startnumber = Data(Slider(15671, range=0..100000))

floor_height = Slider(3, range=0..10)
number_of_zones = Slider(2, range=0..10)

number_slider_3 = Slider(2500, range=1850..2500)
number_slider_4 = Slider(999, range=999..2000)
number_slider_5 = Slider(2500, range=2499..3500)

# ----
# Run Energy
# Model
start_hb = FalseStartToggle(False)
glazing = FalseStartToggle(False)
toggle_3 = FalseStartToggle(False)
run_zbuffer_capture = FalseStartToggle(False)
run_colibri = FalseStartToggle(False)

id = Slider(560, range=560..1000)
number_of_index = Number(number_slider_3)

series = Series(Start=Slider(0, range=0..100), Step=1, Count=Slider(4, range=0..10))
series_2 = Series(Start=Slider(0, range=0..100), Step=1, Count=Slider(3, range=0..10))
panel_5 = Panel(series)
panel_6 = Panel(series_2)
cross_reference = CrossReference(ListListA=series_2, ListListB=series, CrossMode=1)  # -> ListListA, ListListB
number_of_index_2 = Number(number_of_index)
list_item = ListItem(List=cross_reference.ListListA, Index=number_of_index_2, Wrap=True)
list_item_2 = ListItem(List=cross_reference.ListListB, Index=number_of_index_2, Wrap=True)
panel_7 = Panel(list_item)
panel_8 = Panel(list_item_2)

random = Number(panel_7)
random_2 = Number(panel_8)

number_slider_6 = Slider(3, range=0..3)
random_3 = Number(random_2)
panel_9 = Panel("""0-brick+columns
1-prefab-concrete
2-wooden-skeleton
3-clt""")
construction_preset = Data(random_3)
panel_10 = Panel(construction_preset)

random_4 = Number(random)

number_slider_7 = Slider(0, range=0..2)
climate_location = Data(random_4)

panel_11 = Panel(climate_location)

data_5 = Data()
shading_3 = Data(Slider(0, range=0..100))

# ---- group: Height Maximum for ZMAP
geo = Geometry(<curve referenced from the Rhino model>)
number_slider_8 = Slider(2, range=0..10)  # disabled
offset = OffsetCurve(Curve=geo, Distance=Slider(12, range=0..100), Plane=PlaneXY(0, 0, 0), Corners=1)
number_slider_9 = Slider(2, range=0..10)
offset_2 = OffsetCurve(Curve=offset, Distance=number_slider_8, Plane=PlaneXY(0, 0, 0), Corners=1)  # disabled
eval = EvaluateLength(Curve=offset, Length=Slider(0, range=0..100), Normalized=True)  # -> Point, Tangent, Parameter
number_slider_10 = Slider(40, range=0..100)  # disabled
boundary = BoundarySurfaces(Edges=offset)  # disabled
boundary_2 = BoundarySurfaces(Edges=offset_2)  # disabled
rectangle_3 = Rectangle(Plane=eval.Point, XSize=number_slider_9, YSize=number_slider_9, Radius=0)  # -> Rectangle, Length
Z = UnitZ(Factor=number_slider_10)  # disabled
srf_2 = Surface(rectangle_3.Rectangle)
extr = Extrude(Base=boundary, Direction=Z)  # disabled
Z_2 = UnitZ(Factor=Slider(35, range=0..100))
extr_2 = Extrude(Base=boundary_2, Direction=Z)  # disabled
sdiff = SolidDifference(BrepsA=extr_2, BrepsB=extr)  # disabled
extr_3 = Extrude(Base=srf_2, Direction=Z_2)

# ----
round = Round()  # -> Nearest, Floor, Ceiling
multiplication_4 = Multiplication(A=round.Nearest, B=100)
data_6 = Data(["Material CO2", "Operation CO2", "Total CO2"])
multiplication_5 = Multiplication(B=100)
multiplication_6 = Multiplication(A=shading_3, B=100)
number_slider_11 = Slider(3, range=0..10)

toggle_4 = FalseStartToggle(False)
concat_3 = Concatenate(FragmentA="E:\Nauka\PhD\MLCF-07\img", FragmentB="\")
view_capture_jpeg = DotNETVBScriptLEGACY(
    FileName=concat_3,
    blnSave=toggle_4,
    Resolution_width=Slider(600, range=100..1600),
    Resolution_height=Slider(600, range=100..2000),
    DisplayMode=Slider(5, range=0..10),
    ViewName="Top",
    CustomView=Toggle(True))  # -> out, A
# ---------- view_capture_jpeg: VB ----------
    '////// Marc Hoppermann ///////////tweaked by Damien Almor ///////rewritten for curves by to]///////adapted by u]...www.utos.blogspot.com
    '///readapted to Batch ViewCapture by Victor Leung @ www.dreamationworks.com

    ' Note1: The script is actually calling Rhino commands.
    ' Note2: Remember you have to draw something and is selectable for the script to function. The script uses _SelAll then _Zoom _Selected
    ' Note3: After you toggle blnSave to True, a new viewport will popup, be patient while Rhino work, and wait for that viewport to disappear befor clicking on anything.
    ' Note4: The component is not stable if you try to mouse click on anywhere while the saving process is running. Some stupid move may crash your programme, save RH and GH files before using this component.

    ' FileName :  String Input    = Supply with the path and file name without ".jpg" extension : e.g.: "C:\Temp\001" (Without the quotes)
    ' blnSave :   Boolean Input   = Saves when toggles to True (Remember to toggle back to False after use, otherwise the script will re-run itself during next update)
    ' Resolution_width :    Integer Input = Resolution for the captured image
    ' Resolution_height :   Integer Input = well...
    ' TopYea :    Boolean Input =   Toggles if the Top View is captured (Default is False if not connected)
    ' FrontYea :  Boolean Input =   Toggles if the Front View is captured (Default is False if not connected)
    ' ...Yea :    Boolean Input =   Toggles if the corresponding View is captured (Default is False if not connected)
    ' DisplayMode : Integer Input(0-4) = Sets the display Mode 0:Shaded 1:Wireframe 2:Rendered 3:Ghosted 4:XRay Default:Shaded

    If blnSave Then

      'For i As Int32 = 0 To arrcrv.Count - 1
      app.RunScript("_NewFloatingViewport Projection=Top")
      app.RunScript("-ViewportProperties _Size " & Resolution_width * 500 / Resolution_height & " " & 500 & " _Display _Shaded _Enter")

      Select Case DisplayMode  '(If you know what you are doing and have other Custom Display Mode, you are welcomed to add it down here)
        Case 0
          app.RunScript(" _-SetDisplayMode _Mode _Shaded")
        Case 1
          app.RunScript(" _-SetDisplayMode _Mode _Wireframe")
        Case 2
          app.RunScript(" _-SetDisplayMode _Mode _Rendered")
        Case 3
          app.RunScript(" _-SetDisplayMode _Mode _Ghosted")
        Case 4
          app.RunScript(" _-SetDisplayMode _Mode _XRay")
        Case 5
          app.RunScript(" _-SetDisplayMode _Mode _Shaded")
          app.RunScript(" _-ShowZBuffer _Enter _Enter")

        Case Else
          app.RunScript(" _-SetDisplayMode _Mode _Shaded")
      End Select
      'app.RunScript(Resolution_width & "_Enter")
      'app.RunScript(Resolution_height & "_Enter")
      'app.RunScript("_Enter")

      doc.UnselectAll





      If CustomView Then
        MRhinoView.EnableDrawing(False)
        'app.RunScript("'_SelAll")
        app.RunScript("'_SetView " & ViewName & " _Enter")
        app.RunScript("'_SelNone _Enter")
        app.RunScript("'_-SelLayer Area _Enter")

        app.RunScript("'_Zoom _Selected")
        app.RunScript("'_SelNone _Enter")
        'app.RunScript(Chr(34) & "Exporting Custom View ...")
        MRhinoView.EnableDrawing(True)
        app.RunScript("_-viewcapturetofile " & FileName & ViewName & " _DrawGrid=No Width=" & Resolution_width & " Height=" & Resolution_height & "NumberOfPasses=1000" & "_Enter")

      End If

      app.RunScript("_CloseViewport")
      print("Done! Jpgs exported to " & FileName & ViewName)
      A = FileName & ViewName & ".png"
    Else print("inactive")

    End If
# ---------- end view_capture_jpeg ----------
concat_4 = Concatenate(FragmentA=concat_3, FragmentB="Top", FragmentC=".jpg")
gate = StreamGate(Stream=concat_4, Gate=toggle_4)  # -> Target0, Target1
write_file_status = Panel(view_capture_jpeg.out)

imgpath = Data()
panel_13 = Panel(imgpath)
pt = ConstructPoint(XCoordinate=0, YCoordinate=0, ZCoordinate=0)

toggle_5 = FalseStartToggle(False)
read_areas = ReadAreas(run=toggle_5)  # -> levels, walls_2, roof_2, groundfloor_2, window_north_2, window_south_2, window_west_2, window_east_2, volume_2
merge = Merge(
    Data1=read_areas.levels,
    Data2=read_areas.window_north_2,
    Data3=read_areas.window_south_2,
    Data4=read_areas.window_west_2,
    Data5=read_areas.window_east_2,
    Data6=read_areas.walls_2,
    Data7=read_areas.roof_2,
    Data8=read_areas.groundfloor_2)  # -> simplify(flatten(Result))
total_carbon = GH_CPython(parameters=merge, urban="E://Nauka//PhD//MLCF//img//Top.jpg")  # -> result; inputs parameters: list
#   port result: indicate your output description here. refers to a new line.
# ---------- total_carbon: Python ----------
# Import libraries
import os
import sys

env_p = sys.prefix  # path to the env
print("Env. path: {}".format(env_p))

new_p = ''
for extra_p in (r"Library\mingw-w64\bin",
    r"Library\usr\bin",
    r"Library\bin",
    r"Scripts",
    r"bin"):
    new_p +=  os.path.join(env_p, extra_p) + ';'

os.environ["PATH"] = new_p + os.environ["PATH"]  # set it for Python






import numpy as np
import cv2
import sys
if sys.version_info[0] < 3:
    raise Exception("Must be using Python 3")

from keras.models import load_model


model = load_model(r"C:\Users\Mateusz\Documents\Jupyter\basicreg-lca\data\model.h5")

testAttrX = parameters
testImageX = cv2.imread(urban)
testImageX = cv2.resize(testImageX, (64, 64))


testImageX = testImageX.reshape(1,64,64,3)
# ['Levels', 'Win north area','Win south area','Win west area','Win east area','Wall area','Roof area','Ground area']
pred = model.predict([[testAttrX], testImageX])
result = pred
# ---------- end total_carbon ----------
total_co2eq_emissions_kg = Panel(total_carbon)

total_co2eq_emissions_kg_2 = Panel(total_co2eq_emissions_kg)
bake_2 = ObjectBake(BakeToggle=False, Layer="GH_Bake", ObjectName="GH_Obj", ObjectColor=RGB(255, 255, 255), LayerColor=RGB(255, 255, 255))
contextrhino = Brep([<brep referenced from the Rhino model> x6])

bldgprograms = Honeybee_bldgPrograms({"Office": 0, "Retail": 1, "MidriseApartment": 2, "PrimarySchool": 3, "SecondarySchool": 4, "SmallHotel": 5, "LargeHotel": 6, "Hospital": 7, "Outpatient": 8, "Warehouse": 9, "SuperMarket": 10, "FullServiceRestaurant": 11, "QuickServiceRestaurant": 12}, selected="SmallHotel")
listzoneprograms = Honeybee_ListZonePrograms(bldgProgram=bldgprograms)  # -> SmallHotelZonePrograms; plug-in component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
list = ItemSelector(
    listzoneprograms,
    {"SmallHotel::Storage", "SmallHotel::GuestLounge", "SmallHotel::Mechanical", "SmallHotel::StaffLounge", "SmallHotel::PublicRestroom", "SmallHotel::GuestRoom", "SmallHotel::Exercise", "SmallHotel::Laundry", "SmallHotel::Meeting", "SmallHotel::Office", "SmallHotel::Stair", "SmallHotel::Corridor"}, selected="SmallHotel::Corridor")
zone_program = Data(list)

bldgprograms_2 = Honeybee_bldgPrograms({"Office": 0, "Retail": 1, "MidriseApartment": 2, "PrimarySchool": 3, "SecondarySchool": 4, "SmallHotel": 5, "LargeHotel": 6, "Hospital": 7, "Outpatient": 8, "Warehouse": 9, "SuperMarket": 10, "FullServiceRestaurant": 11, "QuickServiceRestaurant": 12}, selected="MidriseApartment")
listzoneprograms_2 = Honeybee_ListZonePrograms(bldgProgram=bldgprograms_2)  # -> MidriseApartmentZonePrograms; plug-in component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
list_2 = ItemSelector(
    listzoneprograms_2,
    {"MidriseApartment::Apartment", "MidriseApartment::Office", "MidriseApartment::Corridor"}, selected="MidriseApartment::Apartment")
zone_program_2 = Data(list_2)

bldgprograms_3 = Honeybee_bldgPrograms({"Office": 0, "Retail": 1, "MidriseApartment": 2, "PrimarySchool": 3, "SecondarySchool": 4, "SmallHotel": 5, "LargeHotel": 6, "Hospital": 7, "Outpatient": 8, "Warehouse": 9, "SuperMarket": 10, "FullServiceRestaurant": 11, "QuickServiceRestaurant": 12}, selected="MidriseApartment")
listzoneprograms_3 = Honeybee_ListZonePrograms(bldgProgram=bldgprograms_3)  # -> MidriseApartmentZonePrograms; plug-in component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
list_3 = ItemSelector(
    listzoneprograms_3,
    {"MidriseApartment::Apartment", "MidriseApartment::Office", "MidriseApartment::Corridor"}, selected="MidriseApartment::Apartment")
zone_program_3 = Data(list_3)

false_start_toggle = FalseStartToggle(False)

number_slider_12 = Slider(1600, range=0..10000)
m2_person = Panel("30")
division_3 = Division(A=1, B=m2_person)
multiplication_7 = Multiplication(A=division_3, B=number_slider_12)
multiplication_8 = Multiplication(A=multiplication_7, B=Slider(30, range=0..100))
division_4 = Division(A=multiplication_8, B=number_slider_12)
division_5 = Division(A=division_4, B=3600)

num = Number(Slider(0.1, range=0..0.1))
number_slider_13 = Slider(0.25, range=0..1)
addition = Addition(A=num)
swatch_2 = ColourSwatch(SwatchColor=RGB(115, 93, 61))
Z_3 = UnitZ(Factor=1)
geo_2 = Geometry()
Z_4 = UnitZ(Factor=number_slider_13)
pt_2 = ConstructPoint(XCoordinate=0, YCoordinate=0, ZCoordinate=0)  # disabled
panel_14 = Panel("E:\Nauka\PhD\grasshopper\ml generation csv")

panel_15 = Panel("C:\Users\Mateusz\Desktop\PHD\gh")
panel_16 = Panel("C:\Users\Administrator\Desktop\PHD\paramlca")
# D:\phd\grasshopper\parametryczna optymalizacja sladu listopad 2018
panel_17 = Panel("C:\Users\Natalia\Desktop\mateusz\phd\gh")
data_7 = Data("E:\Nauka\PhD\grasshopper\ml generation csv")
concat_5 = Concatenate(FragmentA=data_7, FragmentB="\")
concat_6 = Concatenate(FragmentA=concat_5, FragmentB="POL_Warszawa.Okecie.123750_IMGW.epw")
concat_7 = Concatenate(FragmentA=concat_5, FragmentB="lca_database.xlsx")

panel_18 = Panel("lca_database.xls")
number_slider_14 = Slider(1.1, range=0..10)
lca_tool = LCATool(lca_database=concat_7)  # -> materials_2, energy_sources_2, end_of_life_2, database_2
tree_branch = TreeBranch(Tree=lca_tool.database_2, Path=Slider(0, range=0..10), MaintainPaths=True)
panel_19 = Panel(tree_branch)
tree_branch_2 = TreeBranch(Tree=lca_tool.database_2, Path=Slider(4, range=0..10), MaintainPaths=True)
panel_20 = Panel(tree_branch_2)
database = Data(lca_tool.database_2)

pick_n_choose = PickNChoose(
    Pattern=Slider(0, range=0..2),
    Stream0="POL_Warszawa.Okecie.123750_IMGW.epw",
    Stream1="POL_Szczecin.122050_IMGW.epw",
    Stream2="POL_Zakopane.126250_IMGW.epw")
concatenate = Concatenate(FragmentA="E:\Nauka\Doktorat\DanePogodowe\", FragmentB=pick_n_choose)
open_weather_file = Ladybug_OpenEPWWeatherFile(open=concatenate)  # -> epwFile; plug-in component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
panel_21 = Panel(open_weather_file)
epw_stat = Ladybug_OpenEPWAndSTATWeatherFiles()  # -> epwFile, statFile; plug-in component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

materials = Data(lca_tool.materials_2)
panel_22 = Panel(materials)
panel_23 = Panel("https://energyplus.net/weather-download/europe_wmo_region_6/POL//POL_Zakopane.126250_IMGW/all")
panel_24 = Panel("https://energyplus.net/weather-download/europe_wmo_region_6/POL//POL_Szczecin.122050_IMGW/all")
panel_25 = Panel("https://www.energyplus.net/weather-download/europe_wmo_region_6/POL//POL_Warszawa.Okecie.123750_IMGW/all")
epw_stat_2 = Ladybug_OpenEPWAndSTATWeatherFiles(weatherFileURL=panel_25)  # -> epwFile, statFile; plug-in component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
epw_stat_3 = Ladybug_OpenEPWAndSTATWeatherFiles(weatherFileURL=panel_24)  # -> epwFile, statFile; plug-in component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
epw_stat_4 = Ladybug_OpenEPWAndSTATWeatherFiles(weatherFileURL=panel_23)  # -> epwFile, statFile; plug-in component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
climate_location_2 = Data(climate_location)
construction_preset_2 = Data(construction_preset)
construction_preset_3 = Data(construction_preset)
pick_n_choose_2 = PickNChoose(Pattern=climate_location_2, Stream0=epw_stat_2.epwFile, Stream1=epw_stat_3.epwFile, Stream2=epw_stat_4.epwFile)
construction_preset_4 = Data(construction_preset)
panel_27 = Panel(construction_preset_2)
construction_preset_5 = Data(construction_preset)
panel_28 = Panel(construction_preset_3)
panel_29 = Panel(pick_n_choose_2)
panel_30 = Panel(construction_preset_4)
panel_31 = Panel(construction_preset_5)
simcontrol = Honeybee_SimulationControl(maxWarmupDays=Slider(100, range=0..100))  # -> simControls; plug-in component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
toggle_6 = BooleanToggle(True)
panel_32 = Panel("annual")
epoutput = Honeybee_GenerateEPOutput(
    zoneEnergyUse=toggle_6,
    zoneGainsAndLosses=toggle_6,
    zoneComfortMetrics="False",
    surfaceTempAnalysis="False",
    surfaceEnergyAnalysis=toggle_6,
    timestep="monthly")  # -> report, flatten(simulationOutputs); plug-in component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
multiplication_9 = Multiplication(A=Slider(0.027, range=0..0.3), B=2)
energysimpar = Honeybee_EnergySimulationPar(
    timestep=6,
    solarDistribution="1",
    simulationControls=simcontrol,
    heatingSizingFactor=number_slider_14,
    coolingSizingFactor=number_slider_14,
    terrain=Slider(0, range=0..1))  # -> energySimPar; plug-in component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
item_13 = ListItem(List=materials, Index=Slider(26, range=0..100), Wrap=True)
multiplication_10 = Multiplication(A=Slider(0.05, range=0..0.1), B=Slider(0.15, range=0..1))
panel_33 = Panel(item_13)
addition_2 = Addition(A=multiplication_9, B=multiplication_10)
boolean = Boolean(toggle_3)
toggle_7 = FalseStartToggle(False)
importepw = Ladybug_ImportEpw(epwFile=pick_n_choose_2)  # -> readMe, latitude, location, dryBulbTemperature, dewPointTemperature, relativeHumidity, windSpeed, windDirection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; plug-in component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
number_slider_15 = Slider(37, range=0..100)
toggle_8 = FalseStartToggle(False)
cdh_hdh = Ladybug_CDH_HDH(hourlyDryBulbTemperature=importepw.dryBulbTemperature)  # -> readMe, hourly_coolingDegHours, hourly_heatingDegHours, daily_coolingDegHours, daily_heatingDegHours, monthly_coolingDegHours, monthly_heatingDegHours, annual_coolingDegHours, annual_heatingDegHours; plug-in component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
colrange = LadybugPlus_ColorRange(index=Slider(4, range=0..10))  # -> colors; plug-in component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
panel_34 = Panel(cdh_hdh.annual_heatingDegHours)
legendpar = Ladybug_LegendParameters(customColors=flatten(colrange))  # -> legendPar; plug-in component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
toggle_9 = FalseStartToggle(False)
construction_preset_6 = Data(panel_27)
construction_preset_7 = Data(panel_30)
construction_preset_8 = Data(panel_31)
construction_preset_9 = Data(panel_28)
panel_35 = Panel(construction_preset_6)
panel_36 = Panel(construction_preset_7)
panel_37 = Panel(construction_preset_9)
panel_38 = Panel(construction_preset_8)
multiplication_11 = Multiplication(B=0.8)
colrange_2 = LadybugPlus_ColorRange(index=Slider(19, range=0..100))  # -> colors; plug-in component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
legendpar_2 = Ladybug_LegendParameters(customColors=flatten(colrange_2))  # -> legendPar; plug-in component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
toggle_10 = BooleanToggle(False)
number_slider_16 = Slider(0, range=0..3)
toggle_11 = BooleanToggle(True)
toggle_12 = FalseStartToggle(False)
swatch_3 = ColourSwatch(SwatchColor=RGBA(255, 255, 255, 207))
eol = Data(lca_tool.end_of_life_2)
materials_2 = Data(lca_tool.materials_2)
energy_sources = Data(lca_tool.energy_sources_2)
data_8 = Data(lca_tool.database_2)
data_9 = Data(eol)
data_10 = Data(energy_sources)
data_11 = Data(data_8)
item_14 = ListItem(List=data_9, Index=Slider(0, range=0..10), Wrap=True)
item_15 = ListItem(List=data_10, Index=Slider(15, range=0..15), Wrap=True)
item_16 = ListItem(List=data_10, Index=Slider(14, range=0..100), Wrap=True)
panel_39 = Panel(item_14)
panel_40 = Panel(item_15)
panel_41 = Panel(item_16)
panel_42 = Panel(data_10)
area = Panel("1600")
area_2 = Panel("1600")

number_slider_17 = Slider(637, range=0..1000)
addition_3 = Addition(A=Slider(2, range=0..2), B=1)
addition_4 = Addition(A=Slider(3, range=0..3), B=1)
dom_3 = ConstructDomain(DomainStart=Slider(0, range=0..2), DomainEnd=addition_3)
dom_4 = ConstructDomain(DomainStart=Slider(0, range=0..2), DomainEnd=addition_4)
addition_5 = Addition(A=number_slider_17, B=Slider(15, range=0..100))
addition_6 = Addition(A=number_slider_17, B=Slider(79, range=0..100))
number = Number(addition_6)

area_3 = Panel("1600")
shading_4 = Data(from_sliders_or_from_csv.R_8)  # disabled
width_4 = Data(from_sliders_or_from_csv.R_6)  # disabled
window_option_3 = Data(from_sliders_or_from_csv.R_4)
wall_ins_thickness_3 = Data(from_sliders_or_from_csv.R_11)
roof_ins_thickness_3 = Data(from_sliders_or_from_csv.R_2)
ground_ins_thickness_3 = Data(from_sliders_or_from_csv.R_7)

window_option_4 = Data(window_option_3)
wall_ins_thickness_4 = Data(wall_ins_thickness_3)
roof_ins_thickness_4 = Data(roof_ins_thickness_3)
ground_ins_thickness_4 = Data(ground_ins_thickness_3)
multiplication_12 = Multiplication(A=window_option_4, B=1)
multiplication_13 = Multiplication(A=wall_ins_thickness_4, B=100)
multiplication_14 = Multiplication(A=roof_ins_thickness_4, B=100)
multiplication_15 = Multiplication(A=ground_ins_thickness_4, B=100)
round_2 = Round(Number=multiplication_14)  # -> Nearest, Floor, Ceiling
round_3 = Round(Number=multiplication_13)  # -> Nearest, Floor, Ceiling
round_4 = Round(Number=multiplication_15)  # -> Nearest, Floor, Ceiling
data_12 = Data(area_3)
multiplication_16 = Multiplication(A=data_12, B="0.28")
roof_ins_thickness_5 = Data(roof_ins_thickness_3)
wall_ins_thickness_5 = Data(wall_ins_thickness_3)
ground_ins_thickness_5 = Data(ground_ins_thickness_3)
pt_3 = ConstructPoint(XCoordinate=Slider(1, range=0..1), YCoordinate=multiplication_16, ZCoordinate=0)
rec_2pt = Rectangle2Pt(Plane=PlaneXY(0, 0, 0), PointA=Point(0, 0, 0), PointB=pt_3, Radius=0)  # -> Rectangle, Length
geometry = Geometry(rec_2pt.Rectangle)

item_17 = ListItem(List=materials, Index=Slider(14, range=0..100), Wrap=True)
item_18 = ListItem(List=materials, Index=Slider(10, range=0..10), Wrap=True)
item_19 = ListItem(List=materials, Index=Slider(26, range=0..100), Wrap=True)
internalwalls = Panel("InteriorWalls_3_CLT")
panel_43 = Panel(item_17)
panel_44 = Panel(item_18)
panel_45 = Panel(item_19)
cluster_2 = Cluster_4(
    name=internalwalls,
    unique_index="6",
    surfaces=geometry,
    materials=[panel_44, panel_43, panel_45],
    thicknesses=[Slider(0.1, range=0..0.3), Slider(0.05, range=0..0.3), Slider(0.084, range=0..0.3)],
    database=database)  # -> epconstruction, construction_2

number_slider_18 = Slider(0.05, range=0..0.1)
addition_7 = Addition(A="0.6", B=number_slider_18)
item_20 = ListItem(List=materials, Index=Slider(14, range=0..100), Wrap=True)
item_21 = ListItem(List=materials, Index=Slider(10, range=0..10), Wrap=True)
item_22 = ListItem(List=materials, Index=Slider(17, range=0..100), Wrap=True)
division_6 = Division(A=number_slider_18, B=addition_7)
internalwalls_2 = Panel("InteriorWalls_2_LightTimber")
panel_46 = Panel(item_20)
panel_47 = Panel(item_21)
panel_48 = Panel(item_22)
multiplication_17 = Multiplication(A=Slider(0.09, range=0..0.3), B=division_6)
cluster_3 = Cluster_4(
    name=internalwalls_2,
    unique_index="6",
    surfaces=geometry,
    materials=[panel_47, panel_46, panel_48],
    thicknesses=[Slider(0.08, range=0..0.3), Slider(0.05, range=0..0.3), multiplication_17],
    database=database)  # -> epconstruction, construction_2

item_23 = ListItem(List=materials, Index=Slider(14, range=0..100), Wrap=True)
item_24 = ListItem(List=materials, Index=Slider(4, range=0..10), Wrap=True)
item_25 = ListItem(List=materials, Index=Slider(10, range=0..10), Wrap=True)
internalwalls_3 = Panel("InteriorWalls_0_LightSteel")
panel_49 = Panel(item_23)
panel_50 = Panel(item_25)
panel_51 = Panel(item_24)
multiplication_18 = Multiplication(A=Slider(0.01, range=0..0.3), B=0.1)
cluster_4 = Cluster_4(
    name=internalwalls_3,
    unique_index="6",
    surfaces=geometry,
    materials=[panel_49, panel_50, panel_51],
    thicknesses=[Slider(0.09, range=0..0.3), Slider(0.05, range=0..0.3), multiplication_18],
    database=database)  # -> epconstruction, construction_2

number_slider_19 = Slider(0.09, range=0..0.3)
item_26 = ListItem(List=materials, Index=Slider(10, range=0..10), Wrap=True)
item_27 = ListItem(List=materials, Index=Slider(25, range=0..100), Wrap=True)
internalwalls_4 = Panel("InteriorWalls_1_Prefab")
panel_52 = Panel(item_26)
panel_53 = Panel(item_27)
cluster_5 = Cluster_4(
    name=internalwalls_4,
    unique_index="6",
    surfaces=geometry,
    materials=[panel_52, panel_53],
    thicknesses=[Slider(0.05, range=0..0.3), item_27],
    database=database)  # -> epconstruction, construction_2

panel_54 = Panel(cluster_2.construction_2)
stream_filter = StreamFilter(
    Gate=panel_37,
    Stream0=cluster_4.epconstruction,
    Stream1=cluster_5.epconstruction,
    Stream2=cluster_3.epconstruction,
    Stream3=cluster_2.epconstruction)
stream_filter_2 = StreamFilter(
    Gate=panel_37,
    Stream0=cluster_4.construction_2,
    Stream1=cluster_5.construction_2,
    Stream2=cluster_3.construction_2,
    Stream3=cluster_2.construction_2)
interiorwallep = Data(stream_filter)
interiorwallep_2 = Data(interiorwallep)
interiorwallep_3 = Data(interiorwallep_2)

panel_55 = Panel(wall_ins_thickness_3)
panel_56 = Panel(roof_ins_thickness_3)
panel_57 = Panel(ground_ins_thickness_3)
panel_58 = Panel(shading_4)
panel_59 = Panel(width_4)
panel_60 = Panel(window_option_3)

# ---- group: proportion of rec B
dom_5 = ConstructDomain(DomainStart=Slider(1, range=0..1), DomainEnd=Slider(2.3, range=0..10))

# ---- group: proportion of rec A
dom_6 = ConstructDomain(DomainStart=Slider(1, range=0..1), DomainEnd=Slider(2.3, range=0..10))

# ----
dom_7 = ConstructDomain(DomainStart=Slider(15, range=0..15), DomainEnd=Slider(30, range=0..50))
area_4 = Panel("3000")
number_slider_20 = Slider(1, range=0..1)
subtraction = Subtraction(A=Slider(0, range=0..100), B=Slider(4.6, range=0..10))
number_slider_21 = Slider(3, range=0..10)
vec = VectorXYZ(XComponent=0, YComponent=0, ZComponent=number_slider_21)  # -> Vector, Length

# ---- group: levels
dom_8 = ConstructDomain(DomainStart=Slider(2, range=0..10), DomainEnd=Slider(5, range=0..10))

# ---- group: proportion of shapes
dom_9 = ConstructDomain(DomainStart=Slider(1, range=0..1), DomainEnd=Slider(3, range=0..10))

# ----
data_13 = Data(area_3)

startnumber_2 = Data(startnumber)
concat_8 = Concatenate(FragmentA="E:\Nauka\PhD\MLCF-2021\img", FragmentB="\")

# ---- group: proportion of rec B
dom_10 = ConstructDomain(DomainStart=Slider(0.15, range=0..1), DomainEnd=Slider(0.5, range=0..1))

dom_11 = ConstructDomain(DomainStart=Slider(0.15, range=0..1), DomainEnd=Slider(0.35, range=0..1))

dom_12 = ConstructDomain(DomainStart=Slider(0.15, range=0..1), DomainEnd=Slider(0.35, range=0..1))

dom_13 = ConstructDomain(DomainStart=Slider(0.15, range=0..1), DomainEnd=Slider(0.3, range=0..1))

# ---- group: Generate randomized urban environment
dom_14 = ConstructDomain(DomainStart=Slider(3, range=0..10), DomainEnd=Slider(26, range=0..100))
dom_15 = ConstructDomain(DomainStart=Slider(13, range=0..100), DomainEnd=Slider(100, range=0..100))
dom_16 = ConstructDomain(DomainStart=Slider(5, range=0..100), DomainEnd=Slider(30, range=0..100))

# ----
run_colibri2 = FalseStartToggle(False)
id_test_0_3 = Slider(3, range=0..3)
id_2 = Slider(1000, range=0..1000)
panel_61 = Panel("C:\phd\gh\12032021-ML-c3c4-changerandom2500")
iterator = ColibriIterator(Number_Slider=number_slider_3, RemoteFly=False, ignoreAllWarningMsg=False)  # -> NumberSlider, Value_N, IterationGenome

iterationnumberfromcolibriiterator = Data(iterator.NumberSlider)
iterationnumber = Data(iterationnumberfromcolibriiterator)
addition_8 = Addition(A=startnumber, B=iterationnumber)
seed = Data(addition_8)
iterationgenome = Data(iterator.IterationGenome)
bool = Boolean(run_colibri2)

seed_2 = Data(addition_8)
seed_3 = Data(seed_2)
division_7 = Division(A=seed_2, B=5)
division_8 = Division(A=seed_2, B=2)
division_9 = Division(A=seed_2, B=3)
addition_9 = Addition(A=division_7, B=177)
addition_10 = Addition(A=division_8, B=15)
addition_11 = Addition(A=division_9, B=47)
subtraction_2 = Subtraction(A=seed_2, B=125)
multiplication_19 = Multiplication(A=subtraction_2, B=1.5)
random_5 = Random(Range=dom_7, Number=1, Seed=multiplication_19)
int = Integer(random_5)
multiplication_20 = Multiplication(A=Slider(100, range=0..100), B=int)
sqrt = SquareRoot(Value=addition_8)
addition_12 = Addition(A=addition_8, B=sqrt)

addition_13 = Addition(A=division_7, B=number)
square_root = SquareRoot(Value=addition_13)
random_6 = Random(Range=dom_4, Number=1, Seed=addition_13)
addition_14 = Addition(A=addition_6, B=square_root)
number_2 = Number(addition_14)
addition_15 = Addition(A=division_7, B=number_2)
random_7 = Random(Range=dom_3, Number=1, Seed=addition_15)
round_5 = Round(Number=random_7)  # -> Nearest, Floor, Ceiling
round_6 = Round(Number=random_6)  # -> Nearest, Floor, Ceiling
panel_62 = Panel(random_6)
panel_63 = Panel(random_7)
random_8 = Number(round_5.Floor)
random_9 = Number(round_6.Floor)

# ---- group: proportion of rec B (continued)
random_10 = Random(Range=dom_5, Number=1, Seed=addition_9)

# ---- group: proportion of rec A (continued)
random_11 = Random(Range=dom_6, Number=1, Seed=seed_2)

# ---- group: levels (continued)
random_12 = Random(Range=dom_8, Number=1, Seed=seed_2)

# ---- group: proportion of shapes (continued)
random_13 = Random(Range=dom_9, Number=1, Seed=addition_10)

# ----
value = Panel(random_10)
value_2 = Panel(random_11)
value_3 = Panel(random_13)
num_2 = Number(random_13)
num_3 = Number(random_11)
num_4 = Number(random_10)
int_2 = Integer(random_12)
value_4 = Panel(int_2)
division_10 = Division(A=multiplication_20, B=int_2)
division_11 = Division(A=division_10, B=num_2)
subtraction_3 = Subtraction(A=division_10, B=division_11)
shape_a = Panel(division_11)
shape_b = Panel(subtraction_3)
sqrt_2 = SquareRoot(Value=shape_a)
sqrt_3 = SquareRoot(Value=shape_b)
multiplication_21 = Multiplication(A=sqrt_2, B=num_3)
multiplication_22 = Multiplication(A=sqrt_3, B=num_4)
division_12 = Division(A=sqrt_2, B=num_3)
division_13 = Division(A=sqrt_3, B=num_4)
x_a = Panel(multiplication_21)
y_a = Panel(division_12)
y_b = Panel(division_13)
y_a_2 = Panel(multiplication_22)
rectangle_4 = Rectangle(Plane=PlaneXY(0, 0, 0), XSize=x_a, YSize=y_a, Radius=0)  # -> Rectangle, Length
area_5 = Area(Geometry=rectangle_4.Rectangle)  # -> Area, Centroid
rectangle_5 = Rectangle(Plane=PlaneXY(0, 0, 0), XSize=y_a_2, YSize=y_b, Radius=0)  # -> Rectangle, Length
area_6 = Area(Geometry=rectangle_5.Rectangle)  # -> Area, Centroid
larger = LargerThan(FirstNumber=area_5.Area, SecondNumber=area_6.Area)  # -> LargerThan, OrEqualTo
subtraction_4 = Subtraction(A=larger.LargerThan, B=1)
dispatch = Dispatch(List=[rectangle_4.Rectangle, rectangle_5.Rectangle], DispatchPattern=[larger.LargerThan, subtraction_4])  # -> ListA, ListB
data_14 = Data(dispatch.ListA)
data_15 = Data(dispatch.ListB)
pop2d = Populate2D(Region=data_14, Count=number_slider_20, Seed=addition_12)
pop2d_2 = Populate2D(Region=data_15, Count=number_slider_20, Seed=addition_8)
area_7 = Area(Geometry=data_15)  # -> Area, Centroid
vec2pt = Vector2Pt(PointA=area_7.Centroid, PointB=pop2d, Unitize=False)  # -> Vector, Length
move = Move(Geometry=data_15, Motion=vec2pt.Vector)  # -> Geometry, Transform
data_16 = Data(division_10)
data_17 = Data(data_14)
data_18 = Data(move.Geometry)
runion = RegionUnion(Curves=flatten([data_17, data_18]))
area_8 = Area(Geometry=runion)  # -> Area, Centroid
division_14 = Division(A=data_16, B=area_8.Area)
rdiff = RegionDifference(CurvesA=data_18, CurvesB=data_17)
scale = Scale(Geometry=runion, Center=Point(0, 0, 0), Factor=division_14)  # -> Geometry, Transform
explode = Explode(Curve=scale.Geometry, Recursive=True)  # -> Segments, Vertices
offset_3 = OffsetCurve(Curve=scale.Geometry, Distance=subtraction, Plane=PlaneXY(0, 0, 0), Corners=1)
explode_2 = Explode(Curve=offset_3, Recursive=True)  # -> Segments, Vertices
delist_last = DelistLast(data=explode.Vertices)  # disabled
delist_last_2 = DelistLast(data=explode_2.Vertices)  # disabled
data_19 = Data(delist_last)  # disabled
subtraction_5 = Subtraction(A=int_2, B=1)
shift = ShiftList(List=data_19, Shift=1, Wrap=True)  # disabled
shift_2 = ShiftList(List=delist_last_2, Shift=1, Wrap=True)  # disabled
series_3 = Series(Start=number_slider_21, Step=number_slider_21, Count=subtraction_5)
brep = Brep(simplify(scale.Geometry))
srf4pt = _4PointSurface(CornerA=data_19, CornerB=shift, CornerC=shift_2, CornerD=delist_last_2)  # disabled
srf_3 = Surface(offset_3)  # disabled
vec_2 = VectorXYZ(XComponent=0, YComponent=0, ZComponent=series_3)  # -> simplify(graft(Vector)), Length
move_2 = Move(Geometry=brep, Motion=vec_2.Vector)  # -> Geometry, Transform
flip_2 = FlipMatrix(Data=move_2.Geometry)
data_20 = Data(simplify(flatten(brep)))
data_21 = Data(simplify(flatten(flip_2)))
merge_2 = Merge(Data1=flatten(srf_3), Data2=flatten(srf4pt))  # disabled
flip_3 = FlipMatrix(Data=[data_20, data_21])
extr_4 = Extrude(Base=simplify(flatten(flip_3)), Direction=vec.Vector)
building_brep = Brep(extr_4)

division_15 = Division(A=seed_2, B=2.1)
division_16 = Division(A=seed_2, B=3.3)
division_17 = Division(A=seed_2, B=2.7)
division_18 = Division(A=seed_2, B=2.5)
addition_16 = Addition(A=division_15, B=13)
addition_17 = Addition(A=division_16, B=115)
addition_18 = Addition(A=division_17, B=5)
addition_19 = Addition(A=division_18, B=55)

# ---- group: proportion of rec B (continued)
random_14 = Random(Range=dom_10, Number=1, Seed=addition_16)

# ----
value_5 = Panel(random_14)

# ---- group: proportion of rec B (continued)
random_15 = Random(Range=dom_11, Number=1, Seed=addition_17)

# ----
value_6 = Panel(random_15)

# ---- group: proportion of rec B (continued)
random_16 = Random(Range=dom_12, Number=1, Seed=addition_18)

# ----
value_7 = Panel(random_16)

# ---- group: proportion of rec B (continued)
random_17 = Random(Range=dom_13, Number=1, Seed=addition_19)

# ----
value_8 = Panel(random_17)
wnd_density_north_2 = Data(random_17)
wnd_density_north_3 = Data(wnd_density_north_2)
wnd_density_west_2 = Data(random_16)
wnd_density_west_3 = Data(wnd_density_west_2)
wnd_density_east_2 = Data(random_15)
wnd_density_east_3 = Data(wnd_density_east_2)
wnd_density_south_2 = Data(random_14)
wnd_density_south_3 = Data(wnd_density_south_2)
area_9 = Area(Geometry=flip_3)  # -> Area, Centroid
panel_64 = Panel(area_9.Area)
mass_addition = MassAddition(Input=flatten(panel_64))  # -> Result, PartialResults
area_10 = Area(Geometry=scale.Geometry)  # -> Area, Centroid
data_22 = Data(building_brep)
panel_65 = Panel(flip_3)
vec2pt_2 = Vector2Pt(PointA=area_10.Centroid, PointB=pt, Unitize=False)  # -> Vector, Length
move_3 = Move(Geometry=data_22, Motion=vec2pt_2.Vector)  # -> Geometry, Transform
sunion = SolidUnion(Breps=move_3.Geometry)
data_23 = Data(move_3.Geometry)
bbox = BoundingBox(Content=sunion, Plane=PlaneXY(0, 0, 0))  # -> Box, Box_2

# ---- group: Scale Building Bounds
brep_2 = Brep(bbox.Box)
scale_2 = Scale(Geometry=brep_2, Center=Point(0, 0, 0), Factor=Slider(1.1, range=0..10))  # -> Geometry, Transform
brep_3 = Brep(scale_2.Geometry)

# ----
data_24 = Data(data_23)
debrep = DeconstructBrep(Brep=bbox.Box)  # -> Faces, Edges, Vertices
item_28 = ListItem(List=debrep.Faces, Index=0, Wrap=True)  # -> Item, Item1, Item2, Item3, Item4
geo_3 = Geometry(item_28.Item4)
intersectmass = Honeybee_IntersectMasses(bldgMassesBefore=flatten(data_24))  # -> bldgMassesAfter; plug-in component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
data_25 = Data(data_23)

levels_4 = Data(int_2)
wnd_density_east_4 = Data(wnd_density_east_3)
wnd_density_north_4 = Data(wnd_density_north_3)
wnd_density_west_4 = Data(wnd_density_west_3)
wnd_density_south_4 = Data(wnd_density_south_3)

levels_5 = Data(levels_4)
wnd_density_east_5 = Data(wnd_density_east_4)
wnd_density_west_5 = Data(wnd_density_west_4)
wnd_density_north_5 = Data(wnd_density_north_4)
wnd_density_south_5 = Data(wnd_density_south_4)
multiplication_23 = Multiplication(A=data_5, B=levels_5)
multiplication_24 = Multiplication(A=levels_5, B=1)
multiplication_25 = Multiplication(A=wnd_density_north_5, B=100)
multiplication_26 = Multiplication(A=wnd_density_west_5, B=100)
multiplication_27 = Multiplication(A=wnd_density_south_5, B=100)
multiplication_28 = Multiplication(A=wnd_density_east_5, B=100)
concat_9 = Concatenate(
    FragmentA=levels_5,
    FragmentP="p",
    FragmentB=multiplication_24,
    FragmentC=multiplication_5,
    FragmentH=multiplication_28,
    FragmentI="-",
    FragmentJ=multiplication_12,
    FragmentL=round_3.Nearest,
    FragmentM=round_2.Nearest,
    FragmentN=round_4.Nearest)

addition_20 = Addition(A=number_of_zones, B=1)
division_19 = Division(A=area_3, B=levels_4)
division_20 = Division(A=division_19, B=addition_20)
division_21 = Division(A=division_20, B=width_4)
pt_4 = ConstructPoint(XCoordinate=0, YCoordinate=0, ZCoordinate=0)
pt_5 = ConstructPoint(XCoordinate=division_21, YCoordinate=width_4, ZCoordinate=floor_height)
series_4 = Series(Start=division_21, Step=division_21, Count=number_of_zones)
series_5 = Series(Start=0, Step=floor_height, Count=levels_4)
box = Box2Pt(PointA=pt_4, PointB=pt_5, Plane=PlaneXY(0, 0, 0))
X = UnitX(Factor=series_4)
Z_5 = UnitZ(Factor=series_5)
move_4 = Move(Geometry=box, Motion=X)  # -> Geometry, Transform
brep_4 = Brep(box)
brep_5 = Brep([box, move_4.Geometry])
move_5 = Move(Geometry=flatten(brep_5), Motion=graft(Z_5))  # -> Geometry, Transform
brep_6 = Brep(flatten(move_5.Geometry))

division_22 = Division(A=division_19, B=width_4)

length = Data(division_22)  # disabled

panel_66 = Panel(length)
panel_67 = Panel(levels_4)
panel_68 = Panel(wnd_density_north_4)
panel_69 = Panel(wnd_density_west_4)
panel_70 = Panel(wnd_density_south_4)
panel_71 = Panel(wnd_density_east_4)

glzparamlist = Honeybee_GlazingParametersList(
    northGlzParam=wnd_density_north_4,
    westGlzParam=wnd_density_west_4,
    southGlzParam=wnd_density_south_4,
    eastGlzParam=wnd_density_east_4)  # -> glzParamList; plug-in component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
mass2zone = Honeybee_Masses2Zones(zoneMasses=flatten(data_25), zonePrograms=zone_program_3, maxRoofAngle=30, createHBZones=start_hb)  # -> readMe, HBZones; plug-in component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
glzratio = Data(glzparamlist)
# Windows
solveadjc = Honeybee_SolveAdjacencies(HBZones=flatten(mass2zone.HBZones), removeCurrentAdjc=False, findAdjc=start_hb)  # -> readMe, HBZonesWADJ; plug-in component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
glazingcreator = Honeybee_GlazingBasedOnRatio(
    HBObjects=solveadjc.HBZonesWADJ,
    glzRatio=glzratio,
    breakUpWindow=[Toggle(True), Toggle(True), Toggle(True), Toggle(True)],
    breakUpDist=Slider(2, range=0..10),
    windowHeight=Slider(2, range=0..10),
    sillHeight=Slider(0.8, range=0..1),
    runIt=glazing)  # -> readMe, HBObjWGLZ; plug-in component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

brep_7 = Brep(solveadjc.HBZonesWADJ)
preview = CustomPreview(
    Geometry=brep_7,
    Material={diffuse=RGB(221, 160, 221), emission=RGB(66, 48, 66), shine=0.5, specular=RGB(255, 255, 255), transparency=0})
geo_4 = Geometry(glazingcreator.HBObjWGLZ)
debrep_2 = DeconstructBrep(Brep=geo_4)  # -> Faces, Edges, Vertices
preview_2 = CustomPreview(Geometry=debrep_2.Edges, Material=ColourSwatch(SwatchColor=RGB(74, 89, 45)))
preview_3 = CustomPreview(Geometry=geo_4, Material=ColourSwatch(SwatchColor=RGBA(255, 255, 255, 169)))

decomposebytype = Honeybee_DecomposeBasedOnType(HBZone=glazingcreator.HBObjWGLZ)  # -> walls, interiorWalls, airWalls, windows, interiorWindows, skylights, roofs, ceilings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; plug-in component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
area_11 = Area(Geometry=[decomposebytype.floors, decomposebytype.groundFloors])  # -> Area, Centroid
ma = MassAddition(Input=flatten(area_11.Area))  # -> Result, PartialResults
walls = Data(decomposebytype.walls)
roofs = Data(decomposebytype.roofs)
floors = Data(decomposebytype.floors)
windows = Data(decomposebytype.windows)
interior_walls = Data(decomposebytype.interiorWalls)
ground_floors = Data(decomposebytype.groundFloors)
roof_ins_thickness_6 = Data(roof_ins_thickness_3)
wall_ins_thickness_6 = Data(wall_ins_thickness_3)
ground_ins_thickness_6 = Data(ground_ins_thickness_3)
roofs_2 = Data(roofs)
walls_2 = Data(walls)
floors_2 = Data(floors)
windows_2 = Data(windows)
interior_walls_2 = Data(interior_walls)
ground_floors_2 = Data(ground_floors)
data_26 = Data(simplify(flatten(decomposebytype.groundFloors)))
data_27 = Data(simplify(flatten(decomposebytype.roofs)))
data_28 = Data(simplify(flatten(decomposebytype.walls)))
make_wall_thickness = MakeWallThickness(B_2=data_28, num=wall_ins_thickness_6, B=number_slider_13)
make_wall_thickness_2 = MakeWallThickness(B_2=data_26, num=ground_ins_thickness_6, B=number_slider_13)
make_wall_thickness_3 = MakeWallThickness(B_2=data_27, num=roof_ins_thickness_6, B=number_slider_13)
geo_5 = Geometry(make_wall_thickness_3)
geo_6 = Geometry(make_wall_thickness_2)
geo_7 = Geometry(make_wall_thickness)
swatch_4 = ColourSwatch(SwatchColor=RGB(237, 237, 237))
swatch_5 = ColourSwatch(SwatchColor=RGBA(149, 232, 146, 240))
swatch_6 = ColourSwatch(SwatchColor=RGB(148, 153, 161))
swatch_7 = ColourSwatch(SwatchColor=RGB(42, 30, 43))
swatch_8 = ColourSwatch(SwatchColor=RGBA(146, 161, 232, 174))
preview_4 = CustomPreview(Geometry=geo_7, Material=swatch_4)
preview_5 = CustomPreview(Geometry=decomposebytype.interiorWalls, Material=ColourSwatch(SwatchColor=RGBA(232, 215, 146, 174)))
preview_6 = CustomPreview(Geometry=decomposebytype.windows, Material=swatch_8)
preview_7 = CustomPreview(Geometry=geo_6, Material=swatch_7)
preview_8 = CustomPreview(Geometry=decomposebytype.floors, Material=swatch_5)
preview_9 = CustomPreview(Geometry=geo_5, Material=swatch_6)

mass2zone_2 = Honeybee_Masses2Zones(zoneMasses=flatten(intersectmass), zonePrograms=zone_program_3, maxRoofAngle=30, createHBZones=start_hb)  # -> readMe, HBZones; plug-in component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
solveadjc_2 = Honeybee_SolveAdjacencies(HBZones=flatten(mass2zone_2.HBZones), removeCurrentAdjc=False, findAdjc=start_hb)  # -> readMe, HBZonesWADJ; plug-in component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
hb_windows = Geometry(decomposebytype.windows)
addhbglz = Honeybee_addHBGlz(HBObj=solveadjc_2.HBZonesWADJ, childSurfaces=flatten(hb_windows))  # -> HBObjWGLZ; plug-in component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

perimetercore = Honeybee_PerimeterCoreZoning(HBZones=flatten(solveadjc_2.HBZonesWADJ))  # -> perimeters, interiors; plug-in component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
data_29 = Data(addhbglz)

data_30 = Data(wall_ins_thickness_6)
data_31 = Data(decomposebytype.ceilings)
data_32 = Data(decomposebytype.roofs)
data_33 = Data(flatten([data_31, data_32]))
addition_21 = Addition(A=shading_4, B=data_30)
Z_6 = UnitZ(Factor=1)
sunion_2 = SolidUnion(Breps=data_33)
debrep_3 = DeconstructBrep(Brep=sunion_2)  # -> Faces, Edges, Vertices
runion_2 = RegionUnion(Curves=debrep_3.Faces)
explode_3 = Explode(Curve=runion_2, Recursive=True)  # -> Segments, Vertices
eval_2 = EvaluateLength(Curve=explode_3.Segments, Length=Slider(0.5, range=0..1), Normalized=True)  # -> Point, Tangent, Parameter
multiplication_29 = Multiplication(A=data_30, B="-1")
offset_4 = OffsetCurve(Curve=sunion_2, Distance=data_30, Plane=PlaneXY(0, 0, 0), Corners=1)
multiplication_30 = Multiplication(A=shading_4, B="-1")
extr_5 = Extrude(Base=explode_3.Segments, Direction=Z_6)
pdecon = Deconstruct(Point=eval_2.Point)  # -> XComponent, YComponent, ZComponent
offset_5 = OffsetCurve(Curve=sunion_2, Distance=addition_21, Plane=PlaneXY(0, 0, 0), Corners=1)
Y = UnitY(Factor=multiplication_29)
Y_2 = UnitY(Factor=multiplication_30)
sort = SortList(Keys=pdecon.YComponent, ValuesA=explode_3.Segments)  # -> Keys, ValuesA
series_6 = Series(Start=0, Step=1, Count=3)
item_29 = ListItem(List=sort.ValuesA, Index=series_6, Wrap=True)
move_6 = Move(Geometry=item_29, Motion=Y)  # -> Geometry, Transform
extr_6 = Extrude(Base=move_6.Geometry, Direction=Y_2)
data_34 = Data(extr_6)
geo_8 = Geometry(data_34)
multiplication_31 = Multiplication(A=Slider(0.1, range=0..1), B="-1")
Z_7 = UnitZ(Factor=multiplication_31)
move_7 = Move(Geometry=geo_8, Motion=Z_7)  # -> Geometry, Transform
geo_9 = Geometry(move_7.Geometry)  # disabled

sunion_3 = SolidUnion(Breps=decomposebytype.windows)
fmerge = MergeFaces(Brep=sunion_3)  # -> Breps, Before, After
debrep_4 = DeconstructBrep(Brep=fmerge.Breps)  # -> Faces, Edges, Vertices
runion_3 = RegionUnion(Curves=debrep_4.Faces)
area_12 = Area(Geometry=walls_2)  # -> Area, Centroid
area_13 = Area(Geometry=roofs_2)  # -> Area, Centroid
area_14 = Area(Geometry=ground_floors_2)  # -> Area, Centroid
offset_6 = OffsetCurve(Curve=debrep_4.Faces, Distance=1, Plane=PlaneXY(0, 0, 0), Corners=1)
facen = FaceNormals(Mesh=simplify(debrep_4.Faces))  # -> Centers, Normals
item_30 = ListItem(List=facen.Normals, Index=0, Wrap=True)
edges = BrepEdges(Brep=debrep_4.Faces)  # -> Naked, Interior, NonManifold
amp = Amplitude(Vector=item_30, Amplitude=num)
amp_2 = Amplitude(Vector=item_30, Amplitude=addition)
geo_10 = Geometry(edges.Naked)
geo_11 = Geometry(decomposebytype.windows)
flatten = FlattenTree(Tree=geo_11, Path="{0}")
extr_7 = Extrude(Base=simplify(geo_10), Direction=amp_2)
explode_4 = Explode(Curve=simplify(geo_11), Recursive=True)  # -> Segments, Vertices

extrudewindows = Honeybee_ExtrudeWindows(glazings=flatten(decomposebytype.windows), thickness=data_30)  # -> readMe, windowExtrusions; plug-in component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
preview_10 = CustomPreview(Geometry=extrudewindows.windowExtrusions, Material=ColourSwatch(SwatchColor=RGB(255, 255, 255)))  # disabled

sunion_4 = SolidUnion(Breps=extr_7)
eval_3 = EvaluateLength(Curve=explode_4.Segments, Length=Slider(0.5, range=0..1), Normalized=True)  # -> Point, Tangent, Parameter
cap = CapHoles(Brep=sunion_4)
pdecon_2 = Deconstruct(Point=eval_3.Point)  # -> XComponent, YComponent, ZComponent
sort_2 = SortList(Keys=pdecon_2.ZComponent, ValuesA=explode_4.Segments)  # -> Keys, ValuesA
rev = ReverseList(List=sort_2.ValuesA)
item_31 = ListItem(List=rev, Index=0, Wrap=True)
geo_12 = Geometry(cap)
vec_3 = Vector(item_31)
vrot = Rotate(Vector=vec_3, Axis=Z_3, Angle=degrees(Slider(90, range=0..100)))
addition_22 = Addition(A=shading_4, B=data_30)
geo_13 = Geometry(geo_7)
geo_14 = Geometry(make_wall_thickness_2)
geo_15 = Geometry(geo_5)
geo_16 = Geometry(move_7.Geometry)
extr_8 = Extrude(Base=geo_16, Direction=Z_4)
sunion_5 = SolidUnion(Breps=extr_8)
preview_11 = CustomPreview(Geometry=geo_7, Material=swatch_4)
preview_12 = CustomPreview(Geometry=geo_9, Material=ColourSwatch(SwatchColor=RGB(115, 93, 61)))
preview_13 = CustomPreview(Geometry=decomposebytype.windows, Material=swatch_8)
preview_14 = CustomPreview(Geometry=geo_6, Material=swatch_7)
preview_15 = CustomPreview(Geometry=decomposebytype.floors, Material=swatch_5)
preview_16 = CustomPreview(Geometry=geo_5, Material=swatch_6)
geo_17 = Geometry(sunion_5)
geo_18 = Geometry(geo_17)
merge_3 = Merge(Data1=geo_13, Data2=geo_15, Data3=geo_14, Data4=geo_2, Data5=geo_18)
geo_19 = Geometry(flatten(merge_3))
mesh = Mesh(geo_19)  # disabled
mjoin = MeshJoin(Meshes=mesh)
geo_20 = Geometry(make_wall_thickness_2)
bbox_2 = BoundingBox(Content=geo_19, Plane=PlaneXY(0, 0, 0), UnionBox=True)  # -> Box, Box_2; disabled
box_corners = BoxCorners(Box=bbox_2.Box)  # -> CornerA, CornerB, CornerC, CornerD, CornerE, CornerF, CornerG, CornerH; disabled
pt_6 = Point(box_corners.CornerA)  # disabled
pdecon_3 = Deconstruct(Point=pt_6)  # -> XComponent, YComponent, ZComponent; disabled
pt_7 = ConstructPoint(XCoordinate=pdecon_3.XComponent, YCoordinate=pdecon_3.YComponent, ZCoordinate=0)  # disabled
vec2pt_3 = Vector2Pt(PointA=pt_7, PointB=pt_2, Unitize=False)  # -> Vector, Length; disabled
move_8 = Move(Geometry=geo_19, Motion=vec2pt_3.Vector)  # -> Geometry, Transform; disabled
unit = UnitVector(Vector=vrot)
multiplication_32 = Multiplication(A=unit, B=addition_22)
extr_9 = Extrude(Base=item_31, Direction=multiplication_32)
geo_21 = Geometry(extr_9)

# ----
# Energy Simulation Geometry
perimetercore_2 = Honeybee_PerimeterCoreZoning(HBZones=flatten(solveadjc_2.HBZonesWADJ))  # -> perimeters, interiors; plug-in component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
mass2zone_3 = Honeybee_Masses2Zones(zoneMasses=flatten(perimetercore_2.interiors), zonePrograms=zone_program_3, maxRoofAngle=30, createHBZones=start_hb)  # -> readMe, HBZones; plug-in component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
mass2zone_4 = Honeybee_Masses2Zones(zoneMasses=flatten(perimetercore_2.perimeters), zonePrograms=zone_program_3, maxRoofAngle=30, createHBZones=start_hb)  # -> readMe, HBZones; plug-in component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
data_35 = Data([mass2zone_4.HBZones, mass2zone_3.HBZones])
geo_22 = Geometry([extrudewindows.windowExtrusions, geo_21])
geo_23 = Geometry(geo_7)
geo_24 = Geometry(geo_5)
geo_25 = Geometry(geo_6)
debrep_5 = DeconstructBrep(Brep=[addhbglz, geo_22, geo_23, geo_25, geo_24])  # -> Faces, Edges, Vertices
swatch_9 = ColourSwatch(SwatchColor=RGBA(115, 222, 133, 70))
geo_26 = Geometry(debrep_5.Edges)
preview_17 = CustomPreview(Geometry=addhbglz, Material=swatch_9)
getepschedules = Honeybee_GetEnergyPlusSchedules(zoneProgram=zone_program_3)  # -> occupancySchedule, occupancyActivitySch, heatingSetPtSchedule, coolingSetPtSchedule, lightingSchedule, equipmentSchedule, infiltrationSchedule; plug-in component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

preview_18 = CustomPreview(Geometry=addhbglz, Material=swatch_9)
geo_27 = Geometry([extrudewindows.windowExtrusions, geo_21])  # disabled
sunion_6 = SolidUnion(Breps=simplify(flatten(geo_27)))  # disabled
join = BrepJoin(Breps=simplify(flatten(sunion_6)))  # -> Breps, Closed; disabled
debrep_6 = DeconstructBrep(Brep=sunion_6)  # -> Faces, Edges, Vertices; disabled

# ---- group: Assumption of staircases
division_23 = Division(A=area_3, B=levels_4)
number_slider_22 = Slider(3.3, range=0..10)
division_24 = Division(A=division_23, B="200")
data_36 = Data(levels_4)
round_7 = Round(Number=division_24)  # -> Nearest, Floor, Ceiling
pt_8 = ConstructPoint(XCoordinate=Slider(2.5, range=0..10), YCoordinate=Slider(5.5, range=0..10), ZCoordinate=number_slider_22)
pt_9 = ConstructPoint(XCoordinate=0, YCoordinate=0, ZCoordinate=0)
addition_23 = Addition(A=number_slider_22, B=0.1)
multiplication_33 = Multiplication(A=round_7.Nearest, B=data_36)
box_2 = Box2Pt(PointA=pt_9, PointB=pt_8, Plane=PlaneXY(0, 0, 0))
series_7 = Series(Start=0, Step=addition_23, Count=multiplication_33)
Z_8 = UnitZ(Factor=series_7)

# ----
decomposebytype_2 = Honeybee_DecomposeBasedOnType(HBZone=addhbglz)  # -> walls, interiorWalls, airWalls, windows, interiorWindows, skylights, roofs, ceilings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; plug-in component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
walls_3 = Data(decomposebytype_2.walls)
roofs_3 = Data(decomposebytype_2.roofs)
floors_3 = Data(decomposebytype_2.floors)
windows_3 = Data(decomposebytype_2.windows)
ground_floors_3 = Data(decomposebytype_2.groundFloors)
area_15 = Area(Geometry=[walls_3, windows_3, roofs_3, ground_floors_3])  # -> Area, Centroid
ma_2 = MassAddition(Input=flatten(area_15.Area))  # -> Result, PartialResults

debrep_7 = DeconstructBrep(Brep=box_2)  # -> Faces, Edges, Vertices
split = SplitList(List=debrep_7.Faces, Index=Slider(5, range=0..100))  # -> ListA, ListB
geo_28 = Geometry(split.ListA)
move_9 = Move(Geometry=graft(geo_28), Motion=Z_8)  # -> Geometry, Transform

separatezonesbyorientation = Honeybee_SeparateZonesByOrientation(HBZones=flatten(glazingcreator.HBObjWGLZ))  # -> orientations, HBZones; plug-in component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
interior_walls_3 = Data(interior_walls)
item_32 = ListItem(List=separatezonesbyorientation.HBZones, Index=0, Wrap=True)  # -> Item, Item1, Item2, Item3; disabled
branch = TreeBranch(Tree=separatezonesbyorientation.HBZones, Path="{1}", MaintainPaths=True)
branch_2 = TreeBranch(Tree=separatezonesbyorientation.HBZones, Path="{3}", MaintainPaths=True)
branch_3 = TreeBranch(Tree=separatezonesbyorientation.HBZones, Path="{4}", MaintainPaths=True)
branch_4 = TreeBranch(Tree=separatezonesbyorientation.HBZones, Path="{2}", MaintainPaths=True)
roofs_4 = Data(roofs)
walls_4 = Data(walls)
ground_floors_4 = Data(ground_floors)
decomposebytype_3 = Honeybee_DecomposeBasedOnType(HBZone=item_32.Item)  # -> windows; plug-in component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
decomposebytype_4 = Honeybee_DecomposeBasedOnType(HBZone=branch_4)  # -> windows; plug-in component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
decomposebytype_5 = Honeybee_DecomposeBasedOnType(HBZone=branch_2)  # -> windows; plug-in component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
area_16 = Area(Geometry=walls_4)  # -> Area, Centroid
area_17 = Area(Geometry=roofs_4)  # -> Area, Centroid
decomposebytype_6 = Honeybee_DecomposeBasedOnType(HBZone=branch_3)  # -> windows; plug-in component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
area_18 = Area(Geometry=ground_floors_4)  # -> Area, Centroid
ma_3 = MassAddition(Input=flatten(area_16.Area))  # -> Result, PartialResults
ma_4 = MassAddition(Input=flatten(area_17.Area))  # -> Result, PartialResults
ma_5 = MassAddition(Input=flatten(area_18.Area))  # -> Result, PartialResults
area_19 = Area(Geometry=decomposebytype_3)  # -> Area, Centroid
area_20 = Area(Geometry=decomposebytype_4)  # -> Area, Centroid
area_21 = Area(Geometry=decomposebytype_5)  # -> Area, Centroid
area_22 = Area(Geometry=decomposebytype_6)  # -> Area, Centroid
ma_6 = MassAddition(Input=flatten(area_19.Area))  # -> Result, PartialResults
ma_7 = MassAddition(Input=flatten(area_20.Area))  # -> Result, PartialResults
ma_8 = MassAddition(Input=flatten(area_21.Area))  # -> Result, PartialResults
ma_9 = MassAddition(Input=flatten(area_22.Area))  # -> Result, PartialResults
win_north_area = Data(ma_6.Result)
roof_area = Data(ma_4.Result)
roof_area_2 = Data(roof_area)
wall_area = Data(ma_3.Result)
wall_area_2 = Data(wall_area)
win_south_area = Data(ma_7.Result)
win_east_area = Data(ma_9.Result)
win_west_area = Data(ma_8.Result)
ground_area = Data(ma_5.Result)
ground_area_2 = Data(ground_area)
wall_area_3 = Data(wall_area)
roof_area_3 = Data(roof_area)
ground_area_3 = Data(ground_area)
win_east_area_2 = Data(win_east_area)
win_west_area_2 = Data(win_west_area)
win_north_area_2 = Data(win_north_area)
win_south_area_2 = Data(win_south_area)
geo_29 = Geometry(move_9.Geometry)
debrep_8 = DeconstructBrep(Brep=geo_29)  # -> Faces, Edges, Vertices

item_33 = ListItem(List=materials, Index=Slider(25, range=0..100), Wrap=True)
panel_72 = Panel(item_33)
staircase = Panel("Staircase")
cluster_6 = Cluster_4(
    name=staircase,
    unique_index="7",
    surfaces=debrep_8.Faces,
    materials=panel_72,
    thicknesses=Slider(0.1, range=0..0.46),
    database=database)  # -> epconstruction, construction_2

number_slider_23 = Slider(0.05, range=0..0.1)
addition_24 = Addition(A="0.6", B=number_slider_23)
item_34 = ListItem(List=materials, Index=Slider(9, range=0..10), Wrap=True)
item_35 = ListItem(List=materials, Index=Slider(20, range=0..20), Wrap=True)
item_36 = ListItem(List=materials, Index=Slider(14, range=0..100), Wrap=True)
item_37 = ListItem(List=materials, Index=Slider(10, range=0..10), Wrap=True)
item_38 = ListItem(List=materials, Index=Slider(17, range=0..100), Wrap=True)
division_25 = Division(A=number_slider_23, B=addition_24)
panel_73 = Panel(item_34)
panel_74 = Panel(item_35)
panel_75 = Panel(item_36)
panel_76 = Panel(item_37)
panel_77 = Panel(item_38)
multiplication_34 = Multiplication(A=Slider(0.1, range=0..0.3), B=division_25)
cluster_7 = Cluster_4(
    name="InternalFloors_2_LightTimber",
    unique_index="2",
    surfaces=floors_3,
    materials=[panel_73, panel_74, panel_75, panel_77, panel_76],
    thicknesses=[Slider(0.02, range=0..0.3), Slider(0.04, range=0..0.3), Slider(0.05, range=0..0.3), multiplication_34, Slider(0.02, range=0..0.3)],
    database=database)  # -> epconstruction, construction_2

number_slider_24 = Slider(0.05, range=0..0.1)
addition_25 = Addition(A="0.6", B=number_slider_24)
item_39 = ListItem(List=materials, Index=Slider(20, range=0..20), Wrap=True)
item_40 = ListItem(List=materials, Index=Slider(14, range=0..20), Wrap=True)
item_41 = ListItem(List=materials, Index=Slider(10, range=0..10), Wrap=True)
roof_insulation_thickness_2 = Data(roof_ins_thickness_5)
item_42 = ListItem(List=materials, Index=Slider(17, range=0..100), Wrap=True)
division_26 = Division(A=number_slider_24, B=addition_25)
panel_78 = Panel(item_39)
panel_79 = Panel(item_40)
panel_80 = Panel(item_41)
panel_81 = Panel(item_42)
multiplication_35 = Multiplication(A=Slider(0.1, range=0..0.3), B=division_26)
cluster_8 = Cluster_4(
    name="Roof_2_lightwood",
    unique_index="4",
    surfaces=roofs_3,
    materials=[panel_78, panel_79, panel_81, panel_80],
    thicknesses=[Slider(0.02, range=0..0.3), roof_insulation_thickness_2, multiplication_35, Slider(0.02, range=0..0.3)],
    database=database)  # -> epconstruction, construction_2

wall_insulation_thickness_2 = Data(wall_ins_thickness_5)
item_43 = ListItem(List=materials, Index=Slider(1, range=0..10), Wrap=True)
item_44 = ListItem(List=materials, Index=Slider(2, range=0..10), Wrap=True)
item_45 = ListItem(List=materials, Index=Slider(14, range=0..100), Wrap=True)
item_46 = ListItem(List=materials, Index=Slider(1, range=0..10), Wrap=True)
item_47 = ListItem(List=materials, Index=Slider(25, range=0..100), Wrap=True)
panel_82 = Panel(item_44)
panel_83 = Panel(item_43)
panel_84 = Panel(item_46)
panel_85 = Panel(item_45)
panel_86 = Panel(item_47)
decomposeepconstruction = Honeybee_DecomposeEPConstruction(cnstrName="Walls_0_brick")  # -> materials, comments, UValue_SI, UValue_IP, RValue_SI, RValue_IP; plug-in component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
cluster_9 = Cluster_4(
    name="Walls_0_brick",
    unique_index="1",
    surfaces=walls_3,
    materials=[panel_82, panel_83, panel_85, panel_84, item_47],
    thicknesses=[Slider(0.01, range=0..0.46), Slider(0.18, range=0..0.46), wall_insulation_thickness_2, Slider(0.02, range=0..0.3), Slider(0.02, range=0..0.3)],
    database=database)  # -> epconstruction, construction_2
panel_87 = Panel(decomposeepconstruction.UValue_SI)

number_slider_25 = Slider(0.01, range=0..0.46)
wall_insulation_thickness_3 = Data(wall_ins_thickness_5)
item_48 = ListItem(List=materials, Index=Slider(2, range=0..10), Wrap=True)
item_49 = ListItem(List=materials, Index=Slider(14, range=0..100), Wrap=True)
item_50 = ListItem(List=materials, Index=Slider(25, range=0..100), Wrap=True)
panel_88 = Panel(item_50)
panel_89 = Panel(item_48)
panel_90 = Panel(item_49)
merge_4 = Merge(Data1=panel_89, Data2=panel_90, Data3=panel_88, Data4=panel_89)
merge_5 = Merge(Data1=number_slider_25, Data2=wall_insulation_thickness_3, Data3=Slider(0.12, range=0..0.3), Data4=number_slider_25)
decomposeepconstruction_2 = Honeybee_DecomposeEPConstruction(cnstrName="Walls_1_concrete")  # -> materials, comments, UValue_SI, UValue_IP, RValue_SI, RValue_IP; plug-in component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
cluster_10 = Cluster_4(name="Walls_1_concrete", unique_index="1", surfaces=walls_3, materials=merge_4, thicknesses=merge_5, database=database)  # -> epconstruction, construction_2
panel_91 = Panel(decomposeepconstruction_2.UValue_SI)

number_slider_26 = Slider(0.05, range=0..0.1)
number_slider_27 = Slider(0.01, range=0..0.46)
wall_insulation_thickness_4 = Data(wall_ins_thickness_5)
addition_26 = Addition(A="0.6", B=number_slider_26)
item_51 = ListItem(List=materials, Index=Slider(2, range=0..10), Wrap=True)
item_52 = ListItem(List=materials, Index=Slider(14, range=0..100), Wrap=True)
item_53 = ListItem(List=materials, Index=Slider(17, range=0..100), Wrap=True)
division_27 = Division(A=number_slider_26, B=addition_26)
panel_92 = Panel(item_51)
panel_93 = Panel(item_52)
panel_94 = Panel(item_53)
multiplication_36 = Multiplication(A=Slider(0.1, range=0..0.3), B=division_27)
merge_6 = Merge(Data1=panel_92, Data2=panel_93, Data3=panel_94, Data4=panel_92)
merge_7 = Merge(Data1=number_slider_27, Data2=wall_insulation_thickness_4, Data3=multiplication_36, Data4=number_slider_27)
decomposeepconstruction_3 = Honeybee_DecomposeEPConstruction(cnstrName="Walls_2_LightWood")  # -> materials, comments, UValue_SI, UValue_IP, RValue_SI, RValue_IP; plug-in component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
cluster_11 = Cluster_4(name="Walls_2_LightWood", unique_index="1", surfaces=walls_3, materials=merge_6, thicknesses=merge_7, database=database)  # -> epconstruction, construction_2
panel_95 = Panel(decomposeepconstruction_3.UValue_SI)

item_54 = ListItem(List=materials, Index=Slider(9, range=0..10), Wrap=True)
item_55 = ListItem(List=materials, Index=Slider(20, range=0..20), Wrap=True)
item_56 = ListItem(List=materials, Index=Slider(3, range=0..20), Wrap=True)
panel_96 = Panel(item_56)
panel_97 = Panel(item_54)
panel_98 = Panel(item_55)
cluster_12 = Cluster_4(
    name="InternalFloors_1_Prefab",
    unique_index="2",
    surfaces=floors_3,
    materials=[panel_97, panel_98, panel_96],
    thicknesses=[Slider(0.02, range=0..0.3), Slider(0.02, range=0..0.3), Slider(0.14, range=0..0.3)],
    database=database)  # -> epconstruction, construction_2

item_57 = ListItem(List=materials, Index=Slider(9, range=0..10), Wrap=True)
item_58 = ListItem(List=materials, Index=Slider(20, range=0..20), Wrap=True)
item_59 = ListItem(List=materials, Index=Slider(10, range=0..10), Wrap=True)
item_60 = ListItem(List=materials, Index=Slider(14, range=0..100), Wrap=True)
panel_99 = Panel(item_57)
panel_100 = Panel(item_58)
panel_101 = Panel(item_60)
panel_102 = Panel(item_59)
cluster_13 = Cluster_4(
    name="InternalFloors_3_CLT",
    unique_index="2",
    surfaces=floors_3,
    materials=[panel_99, panel_100, panel_101, panel_33, panel_102],
    thicknesses=[Slider(0.02, range=0..0.3), Slider(0.04, range=0..0.3), Slider(0.1, range=0..0.3), addition_2, Slider(0.02, range=0..0.3)],
    database=database)  # -> epconstruction, construction_2

item_61 = ListItem(List=materials, Index=Slider(9, range=0..10), Wrap=True)
item_62 = ListItem(List=materials, Index=Slider(20, range=0..20), Wrap=True)
item_63 = ListItem(List=materials, Index=Slider(3, range=0..20), Wrap=True)
panel_103 = Panel(item_61)
panel_104 = Panel(item_62)
panel_105 = Panel(item_63)
cluster_14 = Cluster_4(
    name="InternalFloors_0_traditionalCONCRETE",
    unique_index="2",
    surfaces=floors_3,
    materials=[panel_103, panel_104, panel_105],
    thicknesses=[Slider(0.02, range=0..0.3), Slider(0.02, range=0..0.3), Slider(0.15, range=0..0.3)],
    database=database)  # -> epconstruction, construction_2

item_64 = ListItem(List=materials, Index=Slider(20, range=0..20), Wrap=True)
item_65 = ListItem(List=materials, Index=Slider(14, range=0..20), Wrap=True)
item_66 = ListItem(List=materials, Index=Slider(3, range=0..20), Wrap=True)
roof_insulation_thickness_3 = Data(roof_ins_thickness_5)
panel_106 = Panel(item_64)
panel_107 = Panel(item_65)
panel_108 = Panel(item_66)
cluster_15 = Cluster_4(
    name="Roof_1_prefab",
    unique_index="4",
    surfaces=roofs_3,
    materials=[panel_106, panel_107, panel_108],
    thicknesses=[Slider(0.02, range=0..0.3), roof_insulation_thickness_3, Slider(0.14, range=0..0.3)],
    database=database)  # -> epconstruction, construction_2

item_67 = ListItem(List=materials, Index=Slider(20, range=0..20), Wrap=True)
item_68 = ListItem(List=materials, Index=Slider(14, range=0..20), Wrap=True)
multiplication_37 = Multiplication(A=Slider(0.027, range=0..0.3), B=2)
roof_insulation_thickness_4 = Data(roof_ins_thickness_5)
item_69 = ListItem(List=materials, Index=Slider(10, range=0..10), Wrap=True)
item_70 = ListItem(List=materials, Index=Slider(26, range=0..100), Wrap=True)
multiplication_38 = Multiplication(A=Slider(0.05, range=0..0.1), B=Slider(0.15, range=0..1))
panel_109 = Panel(item_67)
panel_110 = Panel(item_68)
panel_111 = Panel(item_69)
panel_112 = Panel(item_70)
addition_27 = Addition(A=multiplication_37, B=multiplication_38)
cluster_16 = Cluster_4(
    name="Roof_3_CLT",
    unique_index="4",
    surfaces=roofs_3,
    materials=[panel_109, panel_110, panel_112, panel_111],
    thicknesses=[Slider(0.02, range=0..0.3), roof_insulation_thickness_4, addition_27, Slider(0.02, range=0..0.3)],
    database=database)  # -> epconstruction, construction_2

item_71 = ListItem(List=materials, Index=Slider(20, range=0..20), Wrap=True)
item_72 = ListItem(List=materials, Index=Slider(14, range=0..20), Wrap=True)
item_73 = ListItem(List=materials, Index=Slider(3, range=0..20), Wrap=True)
roof_insulation_thickness_5 = Data(roof_ins_thickness_5)
panel_113 = Panel(item_71)
panel_114 = Panel(item_72)
panel_115 = Panel(item_73)
cluster_17 = Cluster_4(
    name="Roof_0_tradit",
    unique_index="4",
    surfaces=roofs_3,
    materials=[panel_113, panel_114, panel_115],
    thicknesses=[Slider(0.02, range=0..0.3), roof_insulation_thickness_5, Slider(0.15, range=0..0.3)],
    database=database)  # -> epconstruction, construction_2

number_slider_28 = Slider(0.01, range=0..0.46)
wall_insulation_thickness_5 = Data(wall_ins_thickness_5)
item_74 = ListItem(List=materials, Index=Slider(2, range=0..10), Wrap=True)
item_75 = ListItem(List=materials, Index=Slider(14, range=0..100), Wrap=True)
item_76 = ListItem(List=materials, Index=Slider(26, range=0..100), Wrap=True)
panel_116 = Panel(item_74)
panel_117 = Panel(item_75)
panel_118 = Panel(item_76)
merge_8 = Merge(Data1=panel_116, Data2=panel_117, Data3=panel_118, Data4=panel_116)
merge_9 = Merge(Data1=number_slider_28, Data2=wall_insulation_thickness_5, Data3=Slider(0.084, range=0..0.3), Data4=number_slider_28)
cluster_18 = Cluster_4(name="Walls_3_CLT", unique_index="1", surfaces=walls_3, materials=merge_8, thicknesses=merge_9, database=database)  # -> epconstruction, construction_2
decomposeepconstruction_4 = Honeybee_DecomposeEPConstruction(cnstrName="Walls_3_CLT")  # -> materials, comments, UValue_SI, UValue_IP, RValue_SI, RValue_IP; plug-in component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
panel_119 = Panel(decomposeepconstruction_4.UValue_SI)

number_slider_29 = Slider(3, range=0..20)
floor_insulation_thickness = Data(ground_ins_thickness_5)
item_77 = ListItem(List=materials, Index=Slider(9, range=0..10), Wrap=True)
item_78 = ListItem(List=materials, Index=Slider(20, range=0..20), Wrap=True)
item_79 = ListItem(List=materials, Index=Slider(14, range=0..20), Wrap=True)
item_80 = ListItem(List=materials, Index=Slider(25, range=0..100), Wrap=True)
panel_120 = Panel(item_77)
panel_121 = Panel(item_78)
panel_122 = Panel(item_79)
panel_123 = Panel(item_80)
cluster_19 = Cluster_4(
    name="GroundFloor",
    unique_index="3",
    surfaces=ground_floors_3,
    materials=[panel_120, panel_121, panel_122, panel_123],
    thicknesses=[Slider(0.02, range=0..0.3), Slider(0.02, range=0..0.3), floor_insulation_thickness, Slider(0.15, range=0..0.3)],
    database=database)  # -> epconstruction, construction_2

shading_wooden_element = Geometry(geo_9)

item_81 = ListItem(List=materials, Index=Slider(16, range=0..20), Wrap=True)
item_82 = ListItem(List=materials, Index=Slider(4, range=0..10), Wrap=True)
panel_124 = Panel(item_82)
panel_125 = Panel(item_81)
staircase_2 = Panel("Shading")
cluster_20 = Cluster_4(
    name=staircase_2,
    unique_index="9",
    surfaces=shading_wooden_element,
    materials=[panel_125, panel_124],
    thicknesses=[Slider(0.03, range=0..0.46), Slider(0.004, range=0..0.46)],
    database=database)  # -> epconstruction, construction_2

decomposeepconstruction_5 = Honeybee_DecomposeEPConstruction(cnstrName="Roof_0_tradit")  # -> materials, comments, UValue_SI, UValue_IP, RValue_SI, RValue_IP; plug-in component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
panel_126 = Panel(decomposeepconstruction_5.UValue_SI)

# ---- group: 3
wallep = Data(cluster_18.epconstruction)
wallep_2 = Data(cluster_18.construction_2)

# ---- group: 2
wallep_3 = Data(cluster_11.epconstruction)
wallep_4 = Data(cluster_11.construction_2)

# ---- group: 1
wallep_5 = Data(cluster_10.epconstruction)
wallep_6 = Data(cluster_10.construction_2)

# ---- group: 0
wallep_7 = Data(cluster_9.epconstruction)
wallep_8 = Data(cluster_9.construction_2)

# ----
stream_filter_3 = StreamFilter(Gate=panel_35, Stream0=wallep_7, Stream1=wallep_5, Stream2=wallep_3, Stream3=wallep)
stream_filter_4 = StreamFilter(Gate=panel_35, Stream0=wallep_8, Stream1=wallep_6, Stream2=wallep_4, Stream3=wallep_2)
stream_filter_5 = StreamFilter(
    Gate=panel_36,
    Stream0=cluster_14.epconstruction,
    Stream1=cluster_12.epconstruction,
    Stream2=cluster_7.epconstruction,
    Stream3=cluster_13.epconstruction)
stream_filter_6 = StreamFilter(
    Gate=panel_36,
    Stream0=cluster_14.construction_2,
    Stream1=cluster_12.construction_2,
    Stream2=cluster_7.construction_2,
    Stream3=cluster_13.construction_2)
stream_filter_7 = StreamFilter(
    Gate=panel_38,
    Stream0=cluster_17.epconstruction,
    Stream1=cluster_15.epconstruction,
    Stream2=cluster_8.epconstruction,
    Stream3=cluster_16.epconstruction)
stream_filter_8 = StreamFilter(
    Gate=panel_38,
    Stream0=cluster_17.construction_2,
    Stream1=cluster_15.construction_2,
    Stream2=cluster_8.construction_2,
    Stream3=cluster_16.construction_2)
wallep_9 = Data(stream_filter_3)
wallep_10 = Data(stream_filter_4)

# ---- group: Window1
cluster_21 = Cluster_2(
    name="Windows1",
    unique_index="5",
    surface=windows_3,
    u_value="0.7",
    g_value="0.63",
    light_transmittance="0.8",
    database=database)  # -> window_2, epconstruction_2

cluster_22 = Cluster_2(
    name="Windows",
    unique_index="5",
    surface=windows_3,
    u_value="1.4",
    g_value="0.63",
    light_transmittance="0.8",
    database=database)  # -> window_2, epconstruction_2

cluster_23 = Cluster_2(
    name="Windows2",
    unique_index="5",
    surface=windows_3,
    u_value="0.62",
    g_value="0.5",
    light_transmittance="0.7",
    database=database)  # -> window_2, epconstruction_2

cluster_24 = Cluster_2(
    name="Windows3",
    unique_index="5",
    surface=windows_3,
    u_value="1.1",
    g_value="0.63",
    light_transmittance="0.8",
    database=database)  # -> window_2, epconstruction_2

# ----
internalfloorep = Data(stream_filter_5)
p_n_c = PickNChoose(
    Pattern=window_option_3,
    Stream0=cluster_21.epconstruction_2,
    Stream1=cluster_23.epconstruction_2,
    Stream2=cluster_22.epconstruction_2,
    Stream3=cluster_24.epconstruction_2)
windowep = Data(p_n_c)

wallep_11 = Data(wallep_9)
windowep_2 = Data(windowep)
roofep = Data(stream_filter_7)
floorep = Data(internalfloorep)
expfloorep = Data(cluster_19.epconstruction)

roofep_2 = Data(stream_filter_8)
wallep_12 = Data(wallep_10)
floorep_2 = Data(stream_filter_6)
windowep_3 = Data(cluster_22.window_2)
shadingep = Data(cluster_20.construction_2)
staircaseep = Data(cluster_6.construction_2)
intwallep = Data(stream_filter_2)
expfloorep_2 = Data(cluster_19.construction_2)

roofep_3 = Data(roofep)
expfloorep_3 = Data(expfloorep)
wallep_13 = Data(wallep_11)
windowep_4 = Data(windowep_2)
floorep_3 = Data(floorep)

pick_n_choose_3 = PickNChoose(Pattern=number_slider_16, Stream0=floorep_2)
pick_n_choose_4 = PickNChoose(Pattern=number_slider_16, Stream0=wallep_12)
pick_n_choose_5 = PickNChoose(Pattern=number_slider_16, Stream0=intwallep)
pick_n_choose_6 = PickNChoose(Pattern=number_slider_16, Stream0=shadingep)
pick_n_choose_7 = PickNChoose(Pattern=number_slider_16, Stream0=staircaseep)
pick_n_choose_8 = PickNChoose(Pattern=number_slider_16, Stream0=expfloorep_2)
pick_n_choose_9 = PickNChoose(Pattern=number_slider_16, Stream0=roofep_2)
pick_n_choose_10 = PickNChoose(Pattern=number_slider_16, Stream0=windowep_3)

wallep_14 = Data(wallep_12)
floorep_4 = Data(floorep_2)
intwallep_2 = Data(intwallep)
roofep_4 = Data(roofep_2)
expfloorep_4 = Data(expfloorep_2)
shadingep_2 = Data(shadingep)
windowep_5 = Data(windowep_3)
staircaseep_2 = Data(staircaseep)

roofep_5 = Data(roofep_3)
wallep_15 = Data(wallep_13)
windowep_6 = Data(windowep_4)
floorep_5 = Data(floorep_3)
expfloorep_5 = Data(expfloorep_3)

# ----
# SCALED for 15kwh/m2
# IAL
# DOAS
decomposeepsch = Honeybee_DecomposeEnergyPlusSchedule(schName=getepschedules.infiltrationSchedule)  # -> name, schedule, comments; plug-in component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
data_37 = Data(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)
data_38 = Data(glazingcreator.HBObjWGLZ)
data_39 = Data(data_38)
panel_127 = Panel(decomposeepsch.comments)
area_23 = Area(Geometry=data_37)  # -> Area, Centroid
wallep_16 = Data(wallep_15)
windowep_7 = Data(windowep_6)
roofep_6 = Data(roofep_5)
floorep_6 = Data(floorep_5)
expfloorep_6 = Data(expfloorep_5)
panel_128 = Panel("0.75")
hb_zones_for_simulation = Data(data_39)
coolingdetails = Honeybee_HVACCoolingDetails()  # -> coolingDetails; plug-in component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
heatingdetails = Honeybee_HVACHeatingDetails(heatingEffOrCOP=Slider(0.9, range=0..1), centralPlant=Toggle(True))  # -> heatingDetails; plug-in component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
airdetails = Honeybee_HVACAirDetails(airsideEconomizer=Slider(1, range=0..100), sensibleHeatRecovery="0.7")  # -> airDetails; plug-in component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
hvacsystemslist = Honeybee_HVACSystemsList({"-1. Thermostat Only": -1, "0. Ideal Air Loads": 0, "1. PTAC | Residential": 1, "2. PTHP | Residential": 2, "3. Packaged Single Zone - AC": 3, "4. Packaged Single Zone - HP": 4, "5. Packaged VAV w/ Reheat": 5, "6. Packaged VAV w/ PFP Boxes": 6, "7. VAV w/ Reheat": 7, "8. VAV w/ PFP Boxes": 8, "9. Warm Air Furnace - Gas Fired": 9, "10.Warm Air Furnace - Electric": 10, "11.Fan Coil Units + DOAS": 11, "12.Active Chilled Beams + DOAS": 12, "13.Radiant Floors + DOAS": 13, "14.Custom Rad Surfaces + DOAS": 14, "15.Heated Surfaces + VAV Cooling": 15, "16.VRF + DOAS": 16, "17.WSHP + DOAS": 17}, selected="0. Ideal Air Loads")
setepzonecnstr = Honeybee_SetEPZoneConstruction(
    HBZones=flatten(hb_zones_for_simulation),
    wallEPConstruction=wallep_16,
    windowEPConstruction=windowep_7,
    roofEPConstruction=roofep_6,
    floorEPConstruction=floorep_6,
    expFloorEPConstruction=expfloorep_6)  # -> simplify(modifiedHBZones); plug-in component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
hvacsystem = Honeybee_AssignHVACSystem(HBZones=flatten(setepzonecnstr), HVACSystems=hvacsystemslist, airDetails=airdetails, heatingDetails=heatingdetails)  # -> readMe, HBZones; plug-in component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
ach = Panel("1.5")
setloadsandschedules = Honeybee_SetLoadsAndSchedules(HBZones=flatten(hvacsystem.HBZones), zonePrograms=zone_program_3)  # -> currentSchedules, currentLoads, HBZones; plug-in component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
number_slider_30 = Slider(0.0001, range=0..0.001)
ach2m3_s_m2_calculator = Honeybee_infORventPerAreaCalculator(HBZones=flatten(hvacsystem.HBZones), airFlowRate="0.0001", ACHorM3sM2=Toggle(False), blowerPressure=50)  # -> readMe, infORventPerArea, allFloors, allExposed; plug-in component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
m2_person_2 = Panel("40")
equip_w_m2 = Panel("2")
light_w_m2 = Panel("3")
number_slider_31 = Slider(0.001, range=0..0.001)
ventperarea = Data(Slider(0.0005, range=0..0.001))
division_28 = Division(A=1, B=m2_person_2)
panel_129 = Panel("0.0001")
setepzoneloads = Honeybee_SetEnergyPlusZoneLoads(
    HBZones=setloadsandschedules.HBZones,
    equipmentLoadPerArea=equip_w_m2,
    infiltrationRatePerArea=ach2m3_s_m2_calculator.infORventPerArea,
    lightingDensityPerArea=light_w_m2,
    numOfPeoplePerArea=division_28,
    ventilationPerArea=Slider(0.0003, range=0..0.001))  # -> loads, HBZones; plug-in component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
lightingcontrol = Honeybee_LightingControlRecipe(controlType=1, lightingPower=250, lightingSetpoint=300, ballastLossFactor=20, standbyPower=3, delayTime=5)  # -> lightingControlGroup; plug-in component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
panel_130 = Panel(setepzoneloads.loads)
setepzonethresholds = Honeybee_SetEnergyPlusZoneThresholds(
    HBZones=setepzoneloads.HBZones,
    coolingSetPt=Slider(26, range=0..100),
    coolingSetback=Slider(30, range=0..100),
    heatingSetPt=Slider(20, range=0..100),
    heatingSetback=Slider(18, range=0..100),
    outdoorAirReq=Slider(0, range=0..1),
    daylightIllumSetPt=Slider(200, range=0..1000),
    daylightCntrlFract=Slider(1, range=0..1))  # -> readMe, HBZones; plug-in component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
genes = GenePool(
    Decimals=1,
    Maximum=1,
    Minimum=0,
    Value=[0, 0, 0, 0, 0, 0, 0.1, 0.3, 0.5, 0.3, 0.1, 0, 0, 0, 0, 0, 0.2, 0.2, 0.5, 0.5, 0.5, 0.2, 0.2, 0.1])
constantschedule = Honeybee_ConstantSchedule(value=genes, scheduleName="Custom lighting corridor sched")  # -> readMe, schedule, weekSched, schedIDFText; plug-in component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
toggle_13 = BooleanToggle(True)
addtoeplibrary = Honeybee_AddToEnergyPlusLibrary(EPObject=constantschedule.schedIDFText, addToProjectLib=toggle_13, overwrite=toggle_13)  # -> readMe; plug-in component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
genes_2 = GenePool(
    Decimals=0,
    Maximum=1,
    Minimum=0,
    Value=[1, 1, 1, 1, 1, 1, 0.5, 0.5, 0.5, 0.5, 0.5, 0.5, 0.5, 0.5, 0.5, 0.5, 0.5, 0.5, 0.5, 0.5, 0.5, 1, 1, 1])
constantschedule_2 = Honeybee_ConstantSchedule(value=genes_2, scheduleName="Custom night ventilation sched")  # -> readMe, schedule, weekSched, schedIDFText; plug-in component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
toggle_14 = BooleanToggle(True)
number_slider_32 = Slider(25, range=0..100)
number_slider_33 = Slider(20, range=0..100)
number_slider_34 = Slider(28, range=0..100)
addtoeplibrary_2 = Honeybee_AddToEnergyPlusLibrary(EPObject=constantschedule_2.schedIDFText, addToProjectLib=toggle_14, overwrite=toggle_14)  # -> readMe; plug-in component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
zones = Data(setepzonethresholds.HBZones)
labelzones = Honeybee_LabelZones(HBZones=flatten(zones), attribute="zoneProgram")  # -> zoneTxtLabels, labelBasePts, brepTxtLabels, zoneWireFrames; plug-in component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
setepnatvent = Honeybee_SetEPAirFlow(
    HBZones=flatten(zones),
    naturalVentilationType=Slider(1, range=0..10),
    minIndoorTempForNatVent=Slider(22, range=0..100),
    maxOutdoorTempForNatVent=Slider(22, range=0..100),
    deltaTempForNatVent="-0.5",
    windDrivenCrossVent=Toggle(False),
    stackDischargeCoeff=Slider(0.25, range=0..1))  # -> readMe, simplify(HBZones); plug-in component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
zones_2 = Data(setepnatvent.HBZones)

zones_3 = Data(zones_2)
zones_4 = Data(zones_3)
addtoeplibrary_3 = Honeybee_AddToEnergyPlusLibrary(
    EPObject=[wallep_15, windowep_6, roofep_5, floorep_5, expfloorep_5, interiorwallep_3],
    addToProjectLib=toggle_11,
    overwrite=toggle_11)  # -> readMe; plug-in component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
panel_131 = Panel(intwallep_2)
panel_132 = Panel(wallep_14)
panel_133 = Panel(addtoeplibrary_3)
data_40 = Data([wallep_14, intwallep_2, roofep_4, floorep_4, expfloorep_4, shadingep_2, staircaseep_2])
panel_134 = Panel(data_40)
construction = Construction(constructions=data_40, windows=windowep_5)  # -> materials_gwp_kg_co2eq_3, constructions_gwp_kg_co2eq_2, c3_end_of_life_gwp_kg_co2eq_2, d_benefits_gwp_kg_co2eq_2
panel_135 = Panel(construction.constructions_gwp_kg_co2eq_2)
end_of_life = EndOfLife(constructions=data_40, windows=windowep_5, end_of_life=panel_39, database=data_11)
ma_10 = MassAddition(Input=flatten(end_of_life))  # -> Result, PartialResults
co2_end_of_life = Data(end_of_life)
co2_end_of_life_2 = Data(co2_end_of_life)
co2_end_of_life_3 = Data(co2_end_of_life)
ma_11 = MassAddition(Input=flatten(construction.c3_end_of_life_gwp_kg_co2eq_2))  # -> Result, PartialResults
ma_12 = MassAddition(Input=flatten(construction.d_benefits_gwp_kg_co2eq_2))  # -> Result, PartialResults
ma_13 = MassAddition(Input=flatten(construction.constructions_gwp_kg_co2eq_2))  # -> Result, PartialResults
panel_136 = Panel(ma_13.Result)
division_29 = Division(A=panel_136, B=area_2)
co2eq_m2 = Panel(division_29)
materialco2 = Number(panel_136)
material_co2eq = Panel(materialco2)
material_a1_a3_co2eq = Panel(materialco2)
material_co2eq_2 = Panel(materialco2)
materialco2_2 = Number(material_co2eq_2)
d_material_co2 = Number(ma_12.Result)
d_material_co2_2 = Number(d_material_co2)
d_benefits_co2eq = Panel(d_material_co2_2)
d_material_co2_3 = Number(d_material_co2)
c3_materialco2 = Number(ma_11.Result)
c3_materialco2_2 = Number(c3_materialco2)
c3_c4_material_co2eq = Panel(c3_materialco2_2)
c3c4_materialco2 = Number(c3_materialco2)
d_material_co2_4 = Number(d_material_co2)
c3_materialco2_3 = Number(c3_materialco2)

data_41 = Data(solveadjc.HBZonesWADJ)
decomposebytype_7 = Honeybee_DecomposeBasedOnType(HBZone=data_41)  # -> walls, interiorWalls, airWalls, windows, interiorWindows, skylights, roofs, ceilings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; plug-in component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
floors_4 = Data(floors)
roofs_5 = Data(roofs)
walls_5 = Data(decomposebytype_7.walls)
windows_4 = Data(windows)
ground_floors_5 = Data(ground_floors)
area_24 = Area(Geometry=flatten(walls_5))  # -> Area, Centroid
area_25 = Area(Geometry=flatten(windows_4))  # -> Area, Centroid
area_26 = Area(Geometry=flatten(roofs_5))  # -> Area, Centroid
area_27 = Area(Geometry=flatten(floors_4))  # -> Area, Centroid
area_28 = Area(Geometry=flatten(ground_floors_5))  # -> Area, Centroid
ma_14 = MassAddition(Input=area_24.Area)  # -> Result, PartialResults
ma_15 = MassAddition(Input=area_25.Area)  # -> Result, PartialResults
ma_16 = MassAddition(Input=area_26.Area)  # -> Result, PartialResults
ma_17 = MassAddition(Input=area_27.Area)  # -> Result, PartialResults
ma_18 = MassAddition(Input=area_28.Area)  # -> Result, PartialResults
ma_19 = MassAddition(Input=[ma_14.Result, ma_16.Result, ma_18.Result])  # -> Result, PartialResults

walls_6 = Data(ma_14.Result)
windows_5 = Data(ma_15.Result)
ground_floors_6 = Data(ma_18.Result)
roofs_6 = Data(ma_16.Result)
exterior_surface = Data(ma_19.Result)

division_30 = Division(A=exterior_surface, B=data_13)

form_factor = Data(division_30)
panel_137 = Panel(form_factor)
panel_138 = Panel(windows_5)
panel_139 = Panel(walls_6)
round_8 = Round(Number=windows_5)  # -> Nearest, Floor, Ceiling

iterationnumber_2 = Data(iterationnumber)
concat_10 = Concatenate(FragmentA="s", FragmentB=startnumber_2, FragmentC="i", FragmentD=iterationnumber_2)
zones_5 = Data(zones_2)
numbering = Data(concat_10)
lng = ListLength(List=zones_5)

# ---- group: Add more rectangles
number_slider_35 = Slider(0, range=0..100)
dom_17 = ConstructDomain(DomainStart=Slider(13, range=0..100), DomainEnd=Slider(60, range=0..100))

# ---- group: Generate randomized urban environment (continued)
seed_4 = Data(seed_2)
random_18 = Random(Range=dom_14, Number=1, Seed=seed_4)
pop2d_3 = Populate2D(Region=srf, Count=random_18, Seed=seed_4)
addition_28 = Addition(A=seed_4, B=15)
random_19 = Random(Range=dom_15, Number=random_18, Seed=addition_28)
random_20 = Random(Range=dom_15, Number=random_18, Seed=seed_4)
rectangle_6 = Rectangle(Plane=pop2d_3, XSize=random_20, YSize=random_19, Radius=0)  # -> Rectangle, Length
addition_29 = Addition(A=seed_4, B=45)

# ---- group: Add more rectangles (continued)
lng_2 = ListLength(List=pop2d_3)
division_31 = Division(A=lng_2, B=3)
addition_30 = Addition(A=seed_4, B=2)
dom_18 = ConstructDomain(DomainStart=number_slider_35, DomainEnd=division_31)
random_21 = Random(Range=dom_18, Number=1, Seed=addition_30)
addition_31 = Addition(A=addition_30, B=2)
dom_19 = ConstructDomain(DomainStart=number_slider_35, DomainEnd=lng_2)
random_22 = Random(Range=dom_19, Number=random_21, Seed=addition_31)
item_83 = ListItem(List=rectangle_6.Rectangle, Index=random_22, Wrap=True)
addition_32 = Addition(A=seed_4, B=15)
pop2d_4 = Populate2D(Region=item_83, Count=Slider(1, range=0..1), Seed=1)  # -> flatten(Population)
random_23 = Random(Range=dom_17, Number=random_21, Seed=seed_4)
random_24 = Random(Range=dom_17, Number=random_21, Seed=addition_32)
rectangle_7 = Rectangle(Plane=pop2d_4, XSize=random_23, YSize=random_24, Radius=0)  # -> Rectangle, Length

# ---- group: Generate randomized urban environment (continued)
srf_4 = Surface(flatten([rectangle_6.Rectangle, rectangle_7.Rectangle]))

# ----
lng_3 = ListLength(List=srf_4)

# ---- group: Generate randomized urban environment (continued)
random_25 = Random(Range=dom_16, Number=lng_3, Seed=addition_29)
Z_9 = UnitZ(Factor=random_25)
extr_10 = Extrude(Base=srf_4, Direction=Z_9)
brep_8 = Brep(extr_10)

# ----
brep_9 = Brep(simplify(flatten(brep_3)))
brep_10 = Brep(flatten(brep_8))
colom = CollisionOneMany(Collider=brep_10, Obstacles=brep_9)  # -> Collision, Index
dispatch_2 = Dispatch(List=brep_10, DispatchPattern=colom.Collision)  # -> ListA, ListB
context = Brep(dispatch_2.ListB)

lng_4 = ListLength(List=zones_2)
lng_5 = ListLength(List=context)
preview_19 = CustomPreview(Geometry=context, Material=ColourSwatch(SwatchColor=RGB(255, 255, 255)))
multiplication_39 = Multiplication(A=lng_5, B=lng_4)

data_42 = Data(multiplication_39)
addition_33 = Addition(A=data_42, B=lng)
data_43 = Data(addition_33)
concat_11 = Concatenate(FragmentA=concat_8, FragmentB=numbering, FragmentC="d", FragmentD=data_43)
concat_12 = Concatenate(FragmentB=numbering, FragmentC="d", FragmentD=data_43, FragmentA=".jpg")
imgname = Data(concat_12)
view_capture_jpeg_2 = DotNETVBScriptLEGACY(
    FileName=concat_11,
    blnSave=run_zbuffer_capture,
    Resolution_width=Slider(600, range=100..1600),
    Resolution_height=Slider(600, range=100..2000),
    DisplayMode=Slider(5, range=0..10),
    ViewName="Top",
    CustomView=Toggle(True))  # -> out, A; same code as view_capture_jpeg
concat_13 = Concatenate(FragmentA=concat_11, FragmentB="Top", FragmentC=".jpg")
gate_2 = StreamGate(Stream=concat_13, Gate=run_zbuffer_capture)  # -> Target0, Target1
gate_3 = StreamGate(Stream=concat_13, Gate=run_zbuffer_capture)  # -> Target0, Target1
write_file_status_2 = Panel(view_capture_jpeg_2.out)

imgname_2 = Data(imgname)
img_setting = ImageSetting(ImageSaveAsName=imgname_2, RhinoViewNames="Parallel", Width=800, Height=600)
imgpath_2 = Data(concat_13)
contextgh = Brep(context)
context_2 = Brep(contextgh)
context_3 = Brep(context_2)
hb_epcontextsrf = HoneybeeEPContextSurfaces(shdSurfaces=flatten(context_3))  # -> HBContext; inputs shdSurfaces: list of Brep, justBoundingBox: Boolean
# ---------- hb_epcontextsrf: Python ----------
"""
prepare shading/context geometries

    Args:
        northVectorOrRotation: A vector that shows North or a number that shows
                               the rotation of the North from the Y axis
        bldgMasses: List of closed Breps as thermal zones.
    Returns:
        report: ...
        thermalZones: Thermal zone's geometries for visualiza
"""

ghenv.Component.Name = 'Honeybee EP context Surfaces'
ghenv.Component.NickName = 'HB_EPContextSrf'
ghenv.Component.Message = 'VER 0.0.63\nJAN_20_2018'
ghenv.Component.IconDisplayMode = ghenv.Component.IconDisplayMode.application
ghenv.Component.Category = "Honeybee"
ghenv.Component.SubCategory = "10 | Energy | Energy"
#compatibleHBVersion = VER 0.0.57\nNOV_04_2016
#compatibleLBVersion = VER 0.0.59\nFEB_01_2015
ghenv.Component.AdditionalHelpFromDocStrings = "2"

import rhinoscriptsyntax as rs
import Rhino as rc
import scriptcontext as sc
import os
import System
import Grasshopper.Kernel as gh
import uuid

tolerance = sc.doc.ModelAbsoluteTolerance
import math


def main(shdSurfaces, EPTransSchedule, meshingSettings, justBoundingBox):
    
    # import the classes
    if sc.sticky.has_key('honeybee_release'):

        try:
            if not sc.sticky['honeybee_release'].isCompatible(ghenv.Component): return -1
            if sc.sticky['honeybee_release'].isInputMissing(ghenv.Component): return -1
        except:
            warning = "You need a newer version of Honeybee to use this compoent." + \
            " Use updateHoneybee component to update userObjects.\n" + \
            "If you have already updated userObjects drag Honeybee_Honeybee component " + \
            "into canvas and try again."
            w = gh.GH_RuntimeMessageLevel.Warning
            ghenv.Component.AddRuntimeMessage(w, warning)
            return -1
        
        # don't customize this part
        hb_EPSrf = sc.sticky["honeybee_EPSurface"]
        hb_EPSHDSurface = sc.sticky["honeybee_EPShdSurface"]
        hb_RADMaterialAUX = sc.sticky["honeybee_RADMaterialAUX"]
        hb_EPObjectsAux = sc.sticky["honeybee_EPObjectsAUX"]()
        HBScheduleList = sc.sticky["honeybee_ScheduleLib"].keys()

        ########################################################################
        #----------------------------------------------------------------------#
        shdBreps = []
        # create bounding box of shading geometries
        if justBoundingBox:
            for brep in shdSurfaces:
                if brep.Faces.Count>1 or not brep.Faces[0].IsPlanar(sc.doc.ModelAbsoluteTolerance):
                    shdBreps.append(brep.GetBoundingBox(True).ToBrep())
                else:
                    shdBreps.append(brep)
        else:
            shdBreps = shdSurfaces
        
        shadingClasses = []
        shadingMeshPreview = []
        
        if meshingSettings == None:
            mp = rc.Geometry.MeshingParameters.Minimal
            mp.SimplePlanes = True
        else:
            mp = meshingSettings
        
        def getRadMaterialName(radMaterial):
            nameStr = radMaterial.split(" ")[2]
            name =  nameStr.split("\n")[0]
            return name
        
        for brepCount, brep in enumerate(shdBreps):
            if brep != None:
                isPlanar = True
                # check planarity
                for face in brep.Faces:
                    if not face.IsPlanar(tolerance):
                        isPlanar = False
                        break
                
                shadingBreps = []
                if not isPlanar:
                    meshArray = rc.Geometry.Mesh.CreateFromBrep(brep, mp)
                    for mesh in meshArray:
                        for meshFace in range(mesh.Faces.Count):
                            vertices = list(mesh.Faces.GetFaceVertices(meshFace))[1:]
                            vertices = vertices + [sc.doc.ModelAbsoluteTolerance]
                            # create the brep from mesh
                            shdBrep = rc.Geometry.Brep.CreateFromCornerPoints(*vertices)
                            shadingBreps.append(shdBrep)
                else:
                    for face in brep.Faces:
                        shadingBreps.append(face.DuplicateFace(False))
                
                for faceCount, shdBrep in enumerate(shadingBreps):
                        thisShading = hb_EPSHDSurface(shdBrep, 1000*brepCount + faceCount, 'shdSrf_' + `brepCount` + '_' + `faceCount` + "_" + str(uuid.uuid4()))
                        
                        # add transmittance schedule if any
                        if EPTransSchedule!=None:
                            schedule= EPTransSchedule.upper()
                            if schedule!=None and not schedule.lower().endswith(".csv") and schedule not in HBScheduleList:
                                msg = "Cannot find " + schedule + " in Honeybee schedule library."
                                print msg
                                ghenv.Component.AddRuntimeMessage(gh.GH_RuntimeMessageLevel.Warning, msg)
                                return -1
                            elif schedule!=None and schedule.lower().endswith(".csv"):
                                # check if csv file is existed
                                if not os.path.isfile(schedule):
                                    msg = "Cannot find the shchedule file: " + schedule
                                    print msg
                                    ghenv.Component.AddRuntimeMessage(gh.GH_RuntimeMessageLevel.Warning, msg)
                                    return -1
                            
                            thisShading.TransmittanceSCH = schedule
                        
                        # add the Rad Material if any
                        if RADMaterial!=None:
                            # if it is just the name of the material make sure it is already defined
                            if len(RADMaterial.split(" ")) == 1:
                                # if the material is not in the library add it to the library
                                if not hb_RADMaterialAUX.isMatrialExistInLibrary(RADMaterial):
                                    warningMsg = "Can't find " + RADMaterial + " in RAD Material Library.\n" + \
                                                "Add the material to the library and try again."
                                    ghenv.Component.AddRuntimeMessage(gh.GH_RuntimeMessageLevel.Warning, warningMsg)
                                    return
                                
                                try:
                                    thisShading.setRADMaterial(RADMaterial)
                                except Exception, e:
                                    print e
                                    warningMsg = "You are using an old version of Honeybee_Honeybee! Update your files and try again."
                                    print warningMsg
                                    ghenv.Component.AddRuntimeMessage(gh.GH_RuntimeMessageLevel.Warning, warningMsg)
                                    return
                                
                                addedToLib = True
                            else:
                                
                                # try to add the material to the library
                                addedToLib, thisShading.RadMaterial = hb_RADMaterialAUX.analyseRadMaterials(RADMaterial, True)
                                
                            if addedToLib==False:
                                warningMsg = "Failed to add " + RADMaterial + " to the Library."
                                ghenv.Component.AddRuntimeMessage(gh.GH_RuntimeMessageLevel.Warning, warningMsg)
                                return
                        
                        # add shading to the list
                        shadingClasses.append(thisShading)
                
        # add to the hive
        hb_hive = sc.sticky["honeybee_Hive"]()
        HBContext  = hb_hive.addToHoneybeeHive(shadingClasses, ghenv.Component)
        return HBContext
        ################################################################################################
    else:
        print "You should first let Honeybee to fly..."
        w = gh.GH_RuntimeMessageLevel.Warning
        ghenv.Component.AddRuntimeMessage(w, "You should first let Honeybee to fly...")
        return -1
        

if _shdSurfaces and _shdSurfaces[0]!=None:
    # add cleaning function
    result= main(_shdSurfaces, EPTransSchedule_, meshingSettings_, justBoundingBox_)
    
    if result != -1: HBContext = result
# ---------- end hb_epcontextsrf ----------
exporttoopenstudio = Honeybee_ExportToOpenStudio(
    epwWeatherFile=pick_n_choose_2,
    energySimPar=energysimpar,
    HBZones=flatten(zones_3),
    HBContext=flatten(hb_epcontextsrf),
    simulationOutputs=flatten(epoutput.simulationOutputs),
    writeOSM=boolean,
    runSimulation=boolean,
    openOpenStudio=toggle_7,
    fileName="TestMultizone1")  # -> readMe, osmFileAddress, idfFileAddress, resultFileAddress, eioFileAddress, rddFileAddress, htmlReport, studyFolder, model; disabled; plug-in component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
exporttoopenstudio_2 = Honeybee_ExportToOpenStudio(
    epwWeatherFile=pick_n_choose_2,
    energySimPar=energysimpar,
    HBZones=flatten(zones_3),
    HBContext=flatten(hb_epcontextsrf),
    simulationOutputs=flatten(epoutput.simulationOutputs),
    writeOSM=boolean,
    runSimulation=boolean,
    openOpenStudio=toggle_7,
    fileName="TestMultizone1")  # -> out, osmFileAddress, idfFileAddress, resultFileAddress, eioFileAddress, rddFileAddress, htmlReport, studyFolder, model; plug-in component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
readepsrfresult = Honeybee_ReadEPSurfaceResult(resultFileAddress=exporttoopenstudio_2.resultFileAddress, normBySrfArea=toggle_8)  # -> surfaceIndoorTemp, surfaceOutdoorTemp, surfaceEnergyFlow, opaqueEnergyFlow, glazEnergyFlow, windowTotalSolarEnergy, windowBeamEnergy, windowDiffEnergy, windowTransmissivity; plug-in component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
readepresult = Honeybee_ReadEPResult(resultFileAddress=exporttoopenstudio_2.resultFileAddress)  # -> totalThermalLoad, thermalLoadBalance, cooling, heating, electricLight, electricEquip, fanElectric, pumpElectric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; plug-in component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
data_44 = Data(readepresult.cooling)
data_45 = Data(readepresult.heating)
flrnorm = Honeybee_NormalizeDataByFloorArea(simData=readepsrfresult.opaqueEnergyFlow, HBZones=flatten(zones_4))  # -> totNormData, zoneNormData; plug-in component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
flrnorm_2 = Honeybee_NormalizeDataByFloorArea(simData=readepsrfresult.glazEnergyFlow, HBZones=flatten(zones_4))  # -> totNormData, zoneNormData; plug-in component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

flrnorm_3 = Honeybee_NormalizeDataByFloorArea(simData=data_45, HBZones=flatten(zones_4))  # -> totNormData, zoneNormData; plug-in component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
flrnorm_4 = Honeybee_NormalizeDataByFloorArea(simData=data_44, HBZones=flatten(zones_4))  # -> totNormData, zoneNormData; plug-in component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
strnum = Ladybug_SeparateData(inputList=flatten(flrnorm_3.totNormData))  # -> numbers, strings; plug-in component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
strnum_2 = Ladybug_SeparateData(inputList=flatten(flrnorm_4.totNormData))  # -> numbers, strings; plug-in component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
ma_20 = MassAddition(Input=flatten(strnum_2.numbers))  # -> Result, PartialResults
ma_21 = MassAddition(Input=flatten(strnum.numbers))  # -> Result, PartialResults
panel_140 = Panel("""Cooling
Heating""")
panel_141 = Panel(ma_21.Result)
panel_142 = Panel(ma_20.Result)

strnum_3 = Ladybug_SeparateData(inputList=flatten(flrnorm.totNormData))  # -> numbers, strings; plug-in component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
strnum_4 = Ladybug_SeparateData(inputList=flatten(flrnorm_2.totNormData))  # -> numbers, strings; plug-in component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
flrnorm_5 = Honeybee_NormalizeDataByFloorArea(simData=readepresult.mechVentilationEnergy, HBZones=flatten(zones_4))  # -> totNormData, zoneNormData; plug-in component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
flrnorm_6 = Honeybee_NormalizeDataByFloorArea(simData=readepresult.peopleGains, HBZones=flatten(zones_4))  # -> totNormData, zoneNormData; plug-in component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
flrnorm_7 = Honeybee_NormalizeDataByFloorArea(simData=readepresult.infiltrationEnergy, HBZones=flatten(zones_4))  # -> totNormData, zoneNormData; plug-in component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
flrnorm_8 = Honeybee_NormalizeDataByFloorArea(simData=readepresult.totalSolarGain, HBZones=flatten(zones_4))  # -> totNormData, zoneNormData; plug-in component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
flrnorm_9 = Honeybee_NormalizeDataByFloorArea(simData=readepresult.fanElectric, HBZones=flatten(zones_4))  # -> totNormData, zoneNormData; plug-in component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
flrnorm_10 = Honeybee_NormalizeDataByFloorArea(simData=readepresult.electricLight, HBZones=flatten(zones_4))  # -> totNormData, zoneNormData; plug-in component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
flrnorm_11 = Honeybee_NormalizeDataByFloorArea(simData=readepresult.electricEquip, HBZones=flatten(zones_4))  # -> totNormData, zoneNormData; plug-in component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
flrnorm_12 = Honeybee_NormalizeDataByFloorArea(simData=readepresult.pumpElectric, HBZones=flatten(zones_4))  # -> totNormData, zoneNormData; plug-in component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
colorsurfaces = Honeybee_ColorSurfacesByEPResult(
    srfData=readepsrfresult.surfaceEnergyFlow,
    HBZones=flatten(zones_4),
    normalizeBySrfArea=toggle_8,
    legendPar=legendpar,
    runIt=toggle_9)  # -> readMe, srfColoredMesh, zoneWireFrame, legend, legendBasePt, analysisTitle, srfBreps, srfColors, srfValues, relevantSrfData; plug-in component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
area_29 = Area(Geometry=colorsurfaces.srfColoredMesh)  # -> Area, Centroid
tag = TextTag(Location=area_29.Centroid, Text=colorsurfaces.srfValues)
item_84 = ListItem(List=colorsurfaces.srfValues, Index=number_slider_15, Wrap=True)
item_85 = ListItem(List=colorsurfaces.srfColoredMesh, Index=number_slider_15, Wrap=True)
panel_143 = Panel(item_84)
strnum_5 = Ladybug_SeparateData(inputList=flatten(readepresult.electricLight))  # -> numbers, strings; plug-in component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
strnum_6 = Ladybug_SeparateData(inputList=flatten(readepresult.cooling))  # -> numbers, strings; plug-in component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
strnum_7 = Ladybug_SeparateData(inputList=flatten(readepresult.electricEquip))  # -> numbers, strings; plug-in component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
strnum_8 = Ladybug_SeparateData(inputList=flatten(readepresult.heating))  # -> numbers, strings; plug-in component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
strnum_9 = Ladybug_SeparateData(inputList=flatten(readepresult.peopleGains))  # -> numbers, strings; plug-in component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
strnum_10 = Ladybug_SeparateData(inputList=flatten(readepresult.heating))  # -> numbers, strings; plug-in component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
ma_22 = MassAddition(Input=flatten(strnum_3.numbers))  # -> Result, PartialResults
ma_23 = MassAddition(Input=flatten(strnum_4.numbers))  # -> Result, PartialResults
ma_24 = MassAddition(Input=flatten(strnum_5.numbers))  # -> Result, PartialResults
ma_25 = MassAddition(Input=flatten(strnum_7.numbers))  # -> Result, PartialResults
ma_26 = MassAddition(Input=flatten(strnum_9.numbers))  # -> Result, PartialResults
ma_27 = MassAddition(Input=flatten(strnum_8.numbers))  # -> Result, PartialResults
ma_28 = MassAddition(Input=flatten(strnum_6.numbers))  # -> Result, PartialResults
panel_144 = Panel(ma_24.Result)
panel_145 = Panel(ma_27.Result)
panel_146 = Panel(ma_25.Result)
panel_147 = Panel(ma_26.Result)
panel_148 = Panel(ma_28.Result)
strnum_11 = Ladybug_SeparateData(inputList=flatten(flrnorm_5.totNormData))  # -> numbers, strings; plug-in component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
strnum_12 = Ladybug_SeparateData(inputList=flatten(flrnorm_6.totNormData))  # -> numbers, strings; plug-in component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
strnum_13 = Ladybug_SeparateData(inputList=flatten(flrnorm_7.totNormData))  # -> numbers, strings; plug-in component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
strnum_14 = Ladybug_SeparateData(inputList=flatten(flrnorm_8.totNormData))  # -> numbers, strings; plug-in component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
strnum_15 = Ladybug_SeparateData(inputList=flatten(flrnorm_9.totNormData))  # -> numbers, strings; plug-in component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
strnum_16 = Ladybug_SeparateData(inputList=flatten(flrnorm_10.totNormData))  # -> numbers, strings; plug-in component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
strnum_17 = Ladybug_SeparateData(inputList=flatten(flrnorm_11.totNormData))  # -> numbers, strings; plug-in component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
strnum_18 = Ladybug_SeparateData(inputList=flatten(flrnorm_12.totNormData))  # -> numbers, strings; plug-in component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
panel_149 = Panel(ma_22.Result)
panel_150 = Panel(ma_23.Result)
ma_29 = MassAddition(Input=flatten(strnum_11.numbers))  # -> Result, PartialResults
ma_30 = MassAddition(Input=flatten(strnum_12.numbers))  # -> Result, PartialResults
ma_31 = MassAddition(Input=flatten(strnum_13.numbers))  # -> Result, PartialResults
ma_32 = MassAddition(Input=flatten(strnum_14.numbers))  # -> Result, PartialResults
ma_33 = MassAddition(Input=flatten(strnum_15.numbers))  # -> Result, PartialResults
ma_34 = MassAddition(Input=flatten(strnum_16.numbers))  # -> Result, PartialResults
ma_35 = MassAddition(Input=flatten(strnum_17.numbers))  # -> Result, PartialResults
ma_36 = MassAddition(Input=flatten(strnum_18.numbers))  # -> Result, PartialResults
multiplication_40 = Multiplication(A=panel_149, B=1500)
multiplication_41 = Multiplication(A=panel_150, B=1500)
panel_151 = Panel(ma_29.Result)
panel_152 = Panel(ma_30.Result)
panel_153 = Panel(ma_31.Result)
panel_154 = Panel(ma_32.Result)
panel_155 = Panel(ma_33.Result)
panel_156 = Panel(ma_34.Result)
panel_157 = Panel(ma_35.Result)
panel_158 = Panel(ma_36.Result)
multiplication_42 = Multiplication(A=panel_157, B=1.5)
energybalance = Honeybee_ConstructEnergyBalance(
    HBZones=flatten(zones_4),
    cooling=readepresult.cooling,
    heating=readepresult.heating,
    electricLight=readepresult.electricLight,
    electricEquip=readepresult.electricEquip,
    fanElectric=readepresult.fanElectric,
    peopleGains=readepresult.peopleGains,
    totalSolarGain=readepresult.totalSolarGain,
    infiltrationEnergy=readepresult.infiltrationEnergy,
    mechVentilationEnergy=readepresult.mechVentilationEnergy,
    surfaceEnergyFlow=readepsrfresult.surfaceEnergyFlow)  # -> readMe, port, flrNormEnergyBal, flrNormBalWStorage, port_2, modelEnergyBalance, energyBalWithStorage; plug-in component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
multiplication_43 = Multiplication(A=panel_156, B=500)
ma_37 = MassAddition(Input=[panel_148, panel_144])  # -> Result, PartialResults
ma_38 = MassAddition(Input=[panel_142, panel_156, panel_157])  # -> Result, PartialResults
ma_39 = MassAddition(Input=[panel_142, panel_141, panel_156, multiplication_42])  # -> Result, PartialResults
heating = Data(panel_145)
cooling = Data(panel_148)
lighting = Data(panel_144)
el = Data(ma_37.Result)
panel_159 = Panel(ma_39.Result)
barchart = Ladybug_MonthlyBarChart(
    inputData=flatten(energybalance.flrNormEnergyBal),
    stackValues=Toggle(True),
    plotFromZero=Toggle(True),
    legendPar=legendpar_2)  # -> readMe, dataMesh, dataCurves, dataCrvColors, graphAxes, graphLabels, title, titleBasePt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; plug-in component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
_3dchart = Ladybug_3DChart(inputData=flatten(energybalance.modelEnergyBalance), xScale="0.25", zScale="0")  # -> readMe, graphMesh, graphCurves, legend, legendBasePts, title, titleBasePts, dataPts, conditionalHOY; disabled; plug-in component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
context_4 = Brep(context)
bake_3 = ObjectBake(
    BakeToggle=toggle_12,
    GeometryObjects=context_4,
    Layer="urban",
    ObjectName="GH_Obj",
    ObjectColor=swatch_3,
    LayerColor=swatch_3)
el_2 = Data(el)
heating_2 = Data(heating)
heating_demand_kwh_yr = Data(heating_2)
electricity_demand_kwh_yr = Data(el_2)
use = Use(
    heating_demand_kwh=heating_demand_kwh_yr,
    heating_source=panel_40,
    electricity_demand_kwh=electricity_demand_kwh_yr,
    electricity_source=panel_41,
    building_lifetime_yrs="30",
    database=data_11)
panel_160 = Panel(use)
item_86 = ListItem(List=panel_160, Index=0, Wrap=True)  # -> flatten(Item)
item_87 = ListItem(List=use, Index=0, Wrap=True)
item_88 = ListItem(List=item_86, Index=1, Wrap=True)  # -> flatten(Item)
item_89 = ListItem(List=item_86, Index=0, Wrap=True)  # -> flatten(Item)
heating_3 = Data(heating)
heating_4 = Data(heating_3)
heating_5 = Data(heating_3)
cooling_2 = Data(cooling)
cooling_3 = Data(cooling_2)
cooling_4 = Data(cooling_2)
lighting_2 = Data(lighting)
lighting_3 = Data(lighting_2)
lighting_4 = Data(lighting_2)
co2_heating = Data(item_89)
co2_heating_2 = Data(co2_heating)
co2_heating_3 = Data(co2_heating)
co2_electricity = Data(item_88)
co2_electricity_2 = Data(co2_electricity)
co2_electricity_3 = Data(co2_electricity)
ma_40 = MassAddition(Input=flatten(use))  # -> Result, PartialResults
panel_161 = Panel(ma_40.Result)
division_32 = Division(A=panel_161, B=area)
co2eq_m2_2 = Panel(division_32)
division_33 = Division(A=co2eq_m2_2, B=30)
operationco2 = Number(panel_161)
operation_co2eq = Panel(operationco2)
mass_addition_2 = MassAddition(Input=[material_a1_a3_co2eq, operation_co2eq, c3_c4_material_co2eq, d_benefits_co2eq])  # -> Result, PartialResults
panel_162 = Panel(mass_addition_2.Result)
operation_co2eq_2 = Panel(operationco2)
operationco2_2 = Number(operation_co2eq_2)
addition_34 = Addition(A=materialco2, B=operationco2)
total_co2 = Number(addition_34)
total_co2eq = Panel(total_co2)

operation_co2eq_3 = Panel(operationco2)

total_co2eq_3 = Panel(total_co2)
total_co2_2 = Number(total_co2eq_3)
parameters = ColibriParameters(
    Material_CO2eq=flatten(material_co2eq_2),
    Operation_CO2eq=flatten(operation_co2eq_2),
    Total_CO2eq=flatten(total_co2eq_3),
    Heating=flatten(heating_4),
    Cooling=flatten(cooling_3),
    Lighting=flatten(lighting_3),
    CO2_Heating=flatten(co2_heating_2),
    CO2_Electricity=flatten(co2_electricity_2),
    CO2_End_of_Life=flatten(co2_end_of_life_2))

data_46 = Data(data_38)  # disabled
zones_6 = Data(data_46)  # disabled
toggle_15 = FalseStartToggle(False)  # disabled
decomposebytype_8 = Honeybee_DecomposeBasedOnType(HBZone=zones_6)  # -> walls, interiorWalls, airWalls, windows, interiorWindows, skylights, roofs, ceilings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; disabled; plug-in component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
flatten_2 = FlattenTree(Tree=decomposebytype_8.groundFloors, Path="{0}")  # disabled
flatten_3 = FlattenTree(Tree=decomposebytype_8.roofs, Path="{0}")  # disabled
panel_163 = Panel("roofs")  # disabled
panel_164 = Panel("groundfloor")  # disabled
panel_165 = Panel("walls")  # disabled
swatch_10 = ColourSwatch(SwatchColor=RGBA(153, 153, 153, 207))  # disabled
swatch_11 = ColourSwatch(SwatchColor=RGBA(168, 143, 143, 207))  # disabled
swatch_12 = ColourSwatch(SwatchColor=RGBA(255, 255, 255, 207))  # disabled
bake_4 = ObjectBake(
    BakeToggle=toggle_15,
    GeometryObjects=flatten_3,
    Layer=panel_163,
    ObjectName="GH_Obj",
    ObjectColor=swatch_10,
    LayerColor=swatch_10)  # disabled
bake_5 = ObjectBake(
    BakeToggle=toggle_15,
    GeometryObjects=decomposebytype_8.walls,
    Layer=panel_165,
    ObjectName="GH_Obj",
    ObjectColor=swatch_12,
    LayerColor=swatch_12)  # disabled
bake_6 = ObjectBake(
    BakeToggle=toggle_15,
    GeometryObjects=flatten_2,
    Layer=panel_164,
    ObjectName="GH_Obj",
    ObjectColor=swatch_11,
    LayerColor=swatch_11)  # disabled
panel_166 = Panel("window_north")  # disabled
panel_167 = Panel("window_south")  # disabled
panel_168 = Panel("window_east")  # disabled
panel_169 = Panel("window_west")  # disabled
swatch_13 = ColourSwatch(SwatchColor=RGBA(137, 217, 217, 144))  # disabled
swatch_14 = ColourSwatch(SwatchColor=RGBA(137, 217, 217, 144))  # disabled
swatch_15 = ColourSwatch(SwatchColor=RGBA(137, 217, 217, 144))  # disabled
swatch_16 = ColourSwatch(SwatchColor=RGBA(137, 217, 217, 144))  # disabled

data_47 = Data(simplify(decomposebytype_8.windows))  # disabled
facen_2 = FaceNormals(Mesh=data_47)  # -> Centers, Normals; disabled
trim = TrimTree(Tree=facen_2.Normals, Depth=1)  # disabled
vdis = VectorDisplay(Anchor=facen_2.Centers, Vector=facen_2.Normals)  # disabled
devec = DeconstructVector(Vector=trim)  # -> XComponent, YComponent, ZComponent; disabled
equals = Equality(FirstNumber=devec.XComponent, SecondNumber=0)  # -> Equality, Inequality; disabled
dispatch_3 = Dispatch(List=data_47, DispatchPattern=equals.Equality)  # -> ListA, ListB; disabled
data_48 = Data(dispatch_3.ListA)  # disabled
data_49 = Data(dispatch_3.ListB)  # disabled
data_50 = Data(data_49)  # disabled
facen_3 = FaceNormals(Mesh=data_50)  # -> Centers, Normals; disabled
facen_4 = FaceNormals(Mesh=data_48)  # -> Centers, Normals; disabled
trim_2 = TrimTree(Tree=facen_3.Normals, Depth=1)  # disabled
trim_3 = TrimTree(Tree=facen_4.Normals, Depth=1)  # disabled
devec_2 = DeconstructVector(Vector=trim_2)  # -> XComponent, YComponent, ZComponent; disabled
devec_3 = DeconstructVector(Vector=trim_3)  # -> XComponent, YComponent, ZComponent; disabled
larger_2 = LargerThan(FirstNumber=devec_2.XComponent, SecondNumber=0)  # -> LargerThan, OrEqualTo; disabled
larger_3 = LargerThan(FirstNumber=devec_3.YComponent, SecondNumber=0)  # -> LargerThan, OrEqualTo; disabled
dispatch_4 = Dispatch(List=data_50, DispatchPattern=larger_2.LargerThan)  # -> ListA, ListB; disabled
dispatch_5 = Dispatch(List=data_48, DispatchPattern=larger_3.LargerThan)  # -> ListA, ListB; disabled
data_51 = Data(dispatch_5.ListA)  # disabled
data_52 = Data(dispatch_4.ListA)  # disabled
data_53 = Data(dispatch_4.ListB)  # disabled
data_54 = Data(dispatch_5.ListB)  # disabled

bake_7 = ObjectBake(
    BakeToggle=toggle_15,
    GeometryObjects=data_51,
    Layer=panel_166,
    ObjectName="GH_Obj",
    ObjectColor=swatch_13,
    LayerColor=swatch_13)  # disabled
bake_8 = ObjectBake(
    BakeToggle=toggle_15,
    GeometryObjects=data_54,
    Layer=panel_167,
    ObjectName="GH_Obj",
    ObjectColor=swatch_14,
    LayerColor=swatch_14)  # disabled
bake_9 = ObjectBake(
    BakeToggle=toggle_15,
    GeometryObjects=data_52,
    Layer=panel_168,
    ObjectName="GH_Obj",
    ObjectColor=swatch_15,
    LayerColor=swatch_15)  # disabled
bake_10 = ObjectBake(
    BakeToggle=toggle_15,
    GeometryObjects=data_53,
    Layer=panel_169,
    ObjectName="GH_Obj",
    ObjectColor=swatch_16,
    LayerColor=swatch_16)  # disabled

data_55 = Data(data_38)
zones_7 = Data(data_55)
bake_main_model = FalseStartToggle(False)
decomposebytype_9 = Honeybee_DecomposeBasedOnType(HBZone=zones_7)  # -> walls, interiorWalls, airWalls, windows, interiorWindows, skylights, roofs, ceilings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; plug-in component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
flatten_4 = FlattenTree(Tree=decomposebytype_9.groundFloors, Path="{0}")
flatten_5 = FlattenTree(Tree=decomposebytype_9.roofs, Path="{0}")
swatch_17 = ColourSwatch(SwatchColor=RGBA(153, 153, 153, 207))
swatch_18 = ColourSwatch(SwatchColor=RGBA(168, 143, 143, 207))
swatch_19 = ColourSwatch(SwatchColor=RGBA(255, 255, 255, 207))
bake_11 = ObjectBake(
    BakeToggle=bake_main_model,
    GeometryObjects=flatten_5,
    Layer="roofs",
    ObjectName="GH_Obj",
    ObjectColor=swatch_17,
    LayerColor=swatch_17)
bake_12 = ObjectBake(
    BakeToggle=bake_main_model,
    GeometryObjects=decomposebytype_9.walls,
    Layer="walls",
    ObjectName="GH_Obj",
    ObjectColor=swatch_19,
    LayerColor=swatch_19)
bake_13 = ObjectBake(
    BakeToggle=bake_main_model,
    GeometryObjects=flatten_4,
    Layer="groundfloor",
    ObjectName="GH_Obj",
    ObjectColor=swatch_18,
    LayerColor=swatch_18)
swatch_20 = ColourSwatch(SwatchColor=RGBA(137, 217, 217, 144))
swatch_21 = ColourSwatch(SwatchColor=RGBA(137, 217, 217, 144))
swatch_22 = ColourSwatch(SwatchColor=RGBA(137, 217, 217, 144))
swatch_23 = ColourSwatch(SwatchColor=RGBA(137, 217, 217, 144))

data_56 = Data(simplify(decomposebytype_9.windows))
facen_5 = FaceNormals(Mesh=data_56)  # -> Centers, Normals
trim_4 = TrimTree(Tree=facen_5.Normals, Depth=1)
vdis_2 = VectorDisplay(Anchor=facen_5.Centers, Vector=facen_5.Normals)
devec_4 = DeconstructVector(Vector=trim_4)  # -> XComponent, YComponent, ZComponent
equals_2 = Equality(FirstNumber=devec_4.XComponent, SecondNumber=0)  # -> Equality, Inequality
dispatch_6 = Dispatch(List=data_56, DispatchPattern=equals_2.Equality)  # -> ListA, ListB
data_57 = Data(dispatch_6.ListA)
data_58 = Data(dispatch_6.ListB)
data_59 = Data(data_58)
facen_6 = FaceNormals(Mesh=data_59)  # -> Centers, Normals
facen_7 = FaceNormals(Mesh=data_57)  # -> Centers, Normals
trim_5 = TrimTree(Tree=facen_6.Normals, Depth=1)
trim_6 = TrimTree(Tree=facen_7.Normals, Depth=1)
devec_5 = DeconstructVector(Vector=trim_5)  # -> XComponent, YComponent, ZComponent
devec_6 = DeconstructVector(Vector=trim_6)  # -> XComponent, YComponent, ZComponent
larger_4 = LargerThan(FirstNumber=devec_5.XComponent, SecondNumber=0)  # -> LargerThan, OrEqualTo
larger_5 = LargerThan(FirstNumber=devec_6.YComponent, SecondNumber=0)  # -> LargerThan, OrEqualTo
dispatch_7 = Dispatch(List=data_59, DispatchPattern=larger_4.LargerThan)  # -> ListA, ListB
dispatch_8 = Dispatch(List=data_57, DispatchPattern=larger_5.LargerThan)  # -> ListA, ListB
data_60 = Data(dispatch_8.ListA)
data_61 = Data(dispatch_7.ListA)
data_62 = Data(dispatch_7.ListB)
data_63 = Data(dispatch_8.ListB)

bake_14 = ObjectBake(
    BakeToggle=bake_main_model,
    GeometryObjects=data_60,
    Layer="window_north",
    ObjectName="GH_Obj",
    ObjectColor=swatch_20,
    LayerColor=swatch_20)
bake_15 = ObjectBake(
    BakeToggle=bake_main_model,
    GeometryObjects=data_63,
    Layer="window_south",
    ObjectName="GH_Obj",
    ObjectColor=swatch_21,
    LayerColor=swatch_21)
bake_16 = ObjectBake(
    BakeToggle=bake_main_model,
    GeometryObjects=data_61,
    Layer="window_east",
    ObjectName="GH_Obj",
    ObjectColor=swatch_22,
    LayerColor=swatch_22)
bake_17 = ObjectBake(
    BakeToggle=bake_main_model,
    GeometryObjects=data_62,
    Layer="window_west",
    ObjectName="GH_Obj",
    ObjectColor=swatch_23,
    LayerColor=swatch_23)

area_30 = Area(Geometry=data_60)  # -> flatten(Area), Centroid
area_31 = Area(Geometry=data_63)  # -> flatten(Area), Centroid
area_32 = Area(Geometry=data_62)  # -> flatten(Area), Centroid
area_33 = Area(Geometry=data_61)  # -> flatten(Area), Centroid
ma_41 = MassAddition(Input=area_30.Area)  # -> Result, PartialResults
ma_42 = MassAddition(Input=area_31.Area)  # -> Result, PartialResults
ma_43 = MassAddition(Input=area_32.Area)  # -> Result, PartialResults
ma_44 = MassAddition(Input=area_33.Area)  # -> Result, PartialResults
win_east_area_3 = Data(ma_44.Result)
win_east_area_4 = Data(win_east_area_3)
win_west_area_3 = Data(ma_43.Result)
win_west_area_4 = Data(win_west_area_3)
win_north_area_3 = Data(ma_41.Result)
win_north_area_4 = Data(win_north_area_3)
win_south_area_3 = Data(ma_42.Result)
win_south_area_4 = Data(win_south_area_3)
parameters_2 = ColibriParameters(
    Seed=flatten(seed),
    Levels=flatten(levels_5),
    Wall_ins_thickness=flatten(wall_ins_thickness_4),
    Roof_ins_thickness=flatten(roof_ins_thickness_4),
    Ground_ins_thickness=flatten(ground_ins_thickness_4),
    Wnd_density_south=flatten(wnd_density_south_5),
    Wnd_density_north=flatten(wnd_density_north_5),
    Wnd_density_west=flatten(wnd_density_west_5),
    Wnd_density_east=flatten(wnd_density_east_5),
    Window_Option=flatten(window_option_4),
    Shading=flatten(shading_3),
    Exterior_Surface=flatten(exterior_surface),
    Form_factor=flatten(form_factor),
    Windows=flatten(windows_5),
    Walls=flatten(walls_6),
    Win_north_area=flatten(win_north_area_4),
    Win_south_area=flatten(win_south_area_4),
    Win_west_area=flatten(win_west_area_4),
    Win_east_area=flatten(win_east_area_4),
    Wall_area=flatten(wall_area_2),
    Roof_area=flatten(roof_area_2),
    Ground_area=flatten(ground_area_2),
    imgName=flatten(imgname_2),
    Total_CO2=flatten(total_co2_2),
    MaterialCO2=flatten(materialco2_2),
    OperationCO2=flatten(operationco2_2),
    CO2_End_of_Life=flatten(co2_end_of_life_3))
parameters_3 = ColibriParameters(
    Seed=flatten(seed),
    Levels=flatten(levels_5),
    Wall_ins_thickness=flatten(wall_ins_thickness_4),
    Roof_ins_thickness=flatten(roof_ins_thickness_4),
    Ground_ins_thickness=flatten(ground_ins_thickness_4),
    Wnd_density_south=flatten(wnd_density_south_5),
    Wnd_density_north=flatten(wnd_density_north_5),
    Wnd_density_west=flatten(wnd_density_west_5),
    Wnd_density_east=flatten(wnd_density_east_5),
    Window_Option=flatten(window_option_4),
    Shading=flatten(shading_3),
    Exterior_Surface=flatten(exterior_surface),
    Form_factor=flatten(form_factor),
    Windows=flatten(windows_5),
    Walls=flatten(walls_6),
    Win_north_area=flatten(win_north_area_4),
    Win_south_area=flatten(win_south_area_4),
    Win_west_area=flatten(win_west_area_4),
    Win_east_area=flatten(win_east_area_4),
    Wall_area=flatten(wall_area_2),
    Roof_area=flatten(roof_area_2),
    Ground_area=flatten(ground_area_2),
    imgName=flatten(imgname_2))
parameters_4 = ColibriParameters(
    Seed=flatten(seed),
    Levels=flatten(levels_5),
    Wall_ins_thickness=flatten(wall_ins_thickness_4),
    Roof_ins_thickness=flatten(roof_ins_thickness_4),
    Ground_ins_thickness=flatten(ground_ins_thickness_4),
    Wnd_density_south=flatten(wnd_density_south_5),
    Wnd_density_north=flatten(wnd_density_north_5),
    Wnd_density_west=flatten(wnd_density_west_5),
    Wnd_density_east=flatten(wnd_density_east_5),
    Window_Option=flatten(window_option_4),
    Shading=flatten(shading_3),
    Exterior_Surface=flatten(exterior_surface),
    Form_factor=flatten(form_factor),
    Windows=flatten(windows_5),
    Walls=flatten(walls_6),
    Win_north_area=flatten(win_north_area_4),
    Win_south_area=flatten(win_south_area_4),
    Win_west_area=flatten(win_west_area_4),
    Win_east_area=flatten(win_east_area_4),
    Wall_area=flatten(wall_area_2),
    Roof_area=flatten(roof_area_2),
    Ground_area=flatten(ground_area_2),
    imgName=flatten(imgname_2),
    Total_CO2=flatten(total_co2_2),
    MaterialCO2=flatten(materialco2_2),
    OperationCO2=flatten(operationco2_2),
    CO2_End_of_Life=flatten(co2_end_of_life_3),
    Climate_location=flatten(climate_location),
    Construction_preset=flatten(construction_preset),
    C3C4_MaterialCO2=flatten(c3c4_materialco2),
    D_Material_CO2=flatten(d_material_co2_3))
aggregator = ColibriAggregator(
    Folder=panel_61,
    IterationGenomeID=parameters_3,
    IterationPhenomeResults=parameters,
    ImgSetting=img_setting,
    Write=run_colibri,
    recordingMode=3)
aggregator_2 = ColibriAggregator(Folder=panel_61, IterationGenomeID=iterationgenome, IterationPhenomeResults=parameters_4, Write=bool, recordingMode=3)
panel_170 = Panel(aggregator)
panel_171 = Panel(aggregator_2)

# ==== cluster Cluster_2
database = ClusterInput()
name = ClusterInput()
unique_index = ClusterInput()
surface = ClusterInput()
u_value = ClusterInput()
g_value = ClusterInput()
light_transmittance = ClusterInput()
database_2 = Data(database)
name_2 = Data(name)
u_value_2 = Data(u_value)
surface_2 = Surface(surface)
g_value_2 = Data(g_value)
light_transmittance_2 = Data(light_transmittance)
branch = TreeBranch(Tree=database_2, Path="6", MaintainPaths=True)
branch_2 = TreeBranch(Tree=database_2, Path="7", MaintainPaths=True)
cluster = Cluster(surface=surface_2)  # -> area_m2_2, edge_length_m_2
epwindowmat = Honeybee_EnergyPlusWindowMaterial(name=name_2, U_Value=u_value_2, SHGC=g_value_2, VT=light_transmittance_2)  # -> EPMaterial; plug-in component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
subset = SubList(List=branch, Domain="0;1", Wrap=True)  # -> List, Index
item = ListItem(List=branch, Index="2", Wrap=True)
subset_2 = SubList(List=branch_2, Domain="0;1", Wrap=True)  # -> List, Index
item_2 = ListItem(List=branch_2, Index="2", Wrap=True)
toggle = BooleanToggle(True)
unique_index_2 = Data(unique_index)
multiplication = Multiplication(A=cluster.area_m2_2, B=item)
multiplication_2 = Multiplication(A=cluster.edge_length_m_2, B=subset.List)  # -> flatten(Result)
addtoeplibrary = Honeybee_AddToEnergyPlusLibrary(EPObject=epwindowmat, addToProjectLib=toggle, overwrite=toggle)  # -> readMe; plug-in component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
epconstruction = Honeybee_EnergyPlusConstruction(name=name_2, layer_1=epwindowmat)  # -> EPConstruction; plug-in component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
ma = MassAddition(Input=multiplication)  # -> Result, PartialResults
ma_2 = MassAddition(Input=multiplication_2)  # -> Result, PartialResults
ma_3 = MassAddition(Input=subset_2.List)  # -> Result, PartialResults
concat = Concatenate(FragmentA=unique_index_2, FragmentB=";5")
concat_2 = Concatenate(FragmentA=unique_index_2, FragmentB=";3")
concat_3 = Concatenate(FragmentA=unique_index_2, FragmentB=";4")
concat_4 = Concatenate(FragmentA=unique_index_2, FragmentB=";6")
concat_5 = Concatenate(FragmentA=unique_index_2, FragmentB=";1")
concat_6 = Concatenate(FragmentA=unique_index_2, FragmentB=";7")
concat_7 = Concatenate(FragmentA=unique_index_2, FragmentB=";0")
concat_8 = Concatenate(FragmentA=unique_index_2, FragmentB=";2")
flatten = FlattenTree(Tree=ma_2.Result, Path=concat)
flatten_2 = FlattenTree(Tree=surface_2, Path=concat_5)
flatten_3 = FlattenTree(Tree=epconstruction, Path=concat_8)
flatten_4 = FlattenTree(Tree=epwindowmat, Path=concat_2)
flatten_5 = FlattenTree(Tree=ma.Result, Path=concat_3)
flatten_6 = FlattenTree(Tree=item_2, Path=concat_4)
flatten_7 = FlattenTree(Tree=name_2, Path=concat_7)
flatten_8 = FlattenTree(Tree=ma_3.Result, Path=concat_6)
window = Data([flatten_7, flatten_2, flatten_3, flatten_4, flatten_5, flatten, flatten_6, flatten_8])
epconstruction_2 = ClusterOutput(epconstruction)
window_2 = ClusterOutput(window)

# ==== cluster Cluster_4
name = ClusterInput()
unique_index = ClusterInput()
surfaces = ClusterInput()
materials = ClusterInput()
thicknesses = ClusterInput()
database = ClusterInput()
name_2 = Data(name)
surfaces_2 = Surface(surfaces)
materials_2 = Data(materials)
thicknesses_2 = Data(thicknesses)
database_2 = Data(database)
panel = Panel(database_2)
material_definitions = MaterialDefinitions(surface_name=name_2, materials=materials_2, thicknesses=thicknesses_2, database=database_2)  # -> epmaterials_2, epmaterial_names_2, densities_2
branch = TreeBranch(Tree=database_2, Path="16", MaintainPaths=True)
branch_2 = TreeBranch(Tree=database_2, Path="0", MaintainPaths=True)
branch_3 = TreeBranch(Tree=database_2, Path="15", MaintainPaths=True)
branch_4 = TreeBranch(Tree=database_2, Path="18", MaintainPaths=True)
branch_5 = TreeBranch(Tree=database_2, Path="14", MaintainPaths=True)
branch_6 = TreeBranch(Tree=database_2, Path="17", MaintainPaths=True)
branch_7 = TreeBranch(Tree=database_2, Path="13", MaintainPaths=True)
branch_8 = TreeBranch(Tree=database_2, Path="4", MaintainPaths=True)
panel_2 = Panel(branch_2)
panel_3 = Panel(branch)
panel_4 = Panel(branch_3)
panel_5 = Panel(branch_4)
panel_6 = Panel(branch_5)
panel_7 = Panel(branch_6)
panel_8 = Panel(branch_7)
panel_9 = Panel(branch_8)
construction_definition = ConstructionDefinition(surface_name=name_2, epmaterial_names=material_definitions.epmaterial_names_2)
panel_10 = Panel(construction_definition)
epconstruction = ClusterOutput(construction_definition)
list_item = ListItem(List=panel_6, Index=0, Wrap=True)
list_item_2 = ListItem(List=panel_3, Index=0, Wrap=True)
list_item_3 = ListItem(List=panel_3, Index=0, Wrap=True)
keysearch = KeyValueSearch(Keys=panel_7, Values=panel_5, Search=materials_2)
keysearch_2 = KeyValueSearch(Keys=panel_4, Values=panel_3, Search=materials_2)
keysearch_3 = KeyValueSearch(Keys=panel_8, Values=panel_6, Search=materials_2)
ma = MassAddition(Input=thicknesses_2)  # -> Result, PartialResults
unique_index_2 = Data(unique_index)
replace_nulls = ReplaceNulls(Items=keysearch_3, Replacements=list_item)  # -> Items, Count
replace_nulls_2 = ReplaceNulls(Items=keysearch, Replacements=list_item_2)  # -> Items, Count
keysearch_4 = KeyValueSearch(Keys=panel_2, Values=panel_9, Search=materials_2)
replace_nulls_3 = ReplaceNulls(Items=keysearch_2, Replacements=list_item_3)  # -> Items, Count
concat = Concatenate(FragmentA=unique_index_2, FragmentB=";11")
concat_2 = Concatenate(FragmentA=unique_index_2, FragmentB=";0")
concat_3 = Concatenate(FragmentA=unique_index_2, FragmentB=";1")
concat_4 = Concatenate(FragmentA=unique_index_2, FragmentB=";2")
concat_5 = Concatenate(FragmentA=unique_index_2, FragmentB=";3")
concat_6 = Concatenate(FragmentA=unique_index_2, FragmentB=";4")
concat_7 = Concatenate(FragmentA=unique_index_2, FragmentB=";5")
concat_8 = Concatenate(FragmentA=unique_index_2, FragmentB=";6")
concat_9 = Concatenate(FragmentA=unique_index_2, FragmentB=";7")
concat_10 = Concatenate(FragmentA=unique_index_2, FragmentB=";9")
concat_11 = Concatenate(FragmentA=unique_index_2, FragmentB=";8")
concat_12 = Concatenate(FragmentA=unique_index_2, FragmentB=";10")
flatten = FlattenTree(Tree=replace_nulls_2.Items, Path=concat)
flatten_2 = FlattenTree(Tree=name_2, Path=concat_2)
flatten_3 = FlattenTree(Tree=surfaces_2, Path=concat_3)
flatten_4 = FlattenTree(Tree=materials_2, Path=concat_4)
flatten_5 = FlattenTree(Tree=construction_definition, Path=concat_5)
flatten_6 = FlattenTree(Tree=material_definitions.densities_2, Path=concat_7)
flatten_7 = FlattenTree(Tree=ma.Result, Path=concat_8)
flatten_8 = FlattenTree(Tree=thicknesses_2, Path=concat_9)
flatten_9 = FlattenTree(Tree=material_definitions.epmaterials_2, Path=concat_6)
flatten_10 = FlattenTree(Tree=keysearch_4, Path=concat_11)
flatten_11 = FlattenTree(Tree=replace_nulls.Items, Path=concat_10)
flatten_12 = FlattenTree(Tree=replace_nulls_3.Items, Path=concat_12)
construction = Data([flatten_2, flatten_3, flatten_4, flatten_5, flatten_9, flatten_6, flatten_7, flatten_8, flatten_10, flatten_11, flatten_12, flatten])
construction_2 = ClusterOutput(construction)
panel_11 = Panel(construction)

# ==== cluster MakeWallThickness
B = ClusterInput()
B_2 = ClusterInput()
num = ClusterInput()
sunion = SolidUnion(Breps=B_2)
num_2 = Number(num)
fmerge = MergeFaces(Brep=sunion)  # -> Breps, Before, After
debrep = DeconstructBrep(Brep=fmerge.Breps)  # -> Faces, Edges, Vertices
runion = RegionUnion(Curves=debrep.Faces)
offset = OffsetCurve(Curve=debrep.Faces, Distance=1, Plane=PlaneXY(0, 0, 0), Corners=1)
addition = Addition(A=num_2, B=B)
facen = FaceNormals(Mesh=simplify(debrep.Faces))  # -> Centers, Normals
item = ListItem(List=facen.Normals, Index=0, Wrap=True)
edges = BrepEdges(Brep=debrep.Faces)  # -> Naked, Interior, NonManifold
amp = Amplitude(Vector=item, Amplitude=addition)
amp_2 = Amplitude(Vector=item, Amplitude=addition)
geo = Geometry(edges.Naked)
extr = Extrude(Base=simplify(debrep.Faces), Direction=flatten(amp))
E = ClusterOutput(extr)

# ==== cluster Use
heating_demand_kwh = ClusterInput()
heating_source = ClusterInput()
electricity_demand_kwh = ClusterInput()
electricity_source = ClusterInput()
building_lifetime_yrs = ClusterInput()
database = ClusterInput()
heating_demand_kwh_2 = Data(heating_demand_kwh)
heating_source_2 = Data(heating_source)
electricity_demand_kwh_2 = Data(electricity_demand_kwh)
electricity_source_2 = Data(electricity_source)
building_lifetime_yrs_2 = Data(building_lifetime_yrs)
database_2 = Data(database)
null = NullItem(Item=heating_demand_kwh_2)  # -> NullFlags, InvalidFlags, Description
null_2 = NullItem(Item=electricity_demand_kwh_2)  # -> NullFlags, InvalidFlags, Description
p_n_c = PickNChoose(Pattern=null.NullFlags, Stream0=heating_demand_kwh_2, Stream1="0")
p_n_c_2 = PickNChoose(Pattern=null_2.NullFlags, Stream0=electricity_demand_kwh_2, Stream1="0")
branch = TreeBranch(Tree=database_2, Path="10", MaintainPaths=True)
branch_2 = TreeBranch(Tree=database_2, Path="8", MaintainPaths=True)
branch_3 = TreeBranch(Tree=database_2, Path="9", MaintainPaths=True)
keysearch = KeyValueSearch(Keys=branch_2, Values=branch_3, Search=[heating_source_2, electricity_source_2])
keysearch_2 = KeyValueSearch(Keys=branch_2, Values=branch, Search=[heating_source_2, electricity_source_2])
multiplication = Multiplication(A=[p_n_c, p_n_c_2], B=building_lifetime_yrs_2)
multiplication_2 = Multiplication(A=keysearch, B=keysearch_2)
data = Data(simplify(graft([heating_source_2, electricity_source_2])))
multiplication_3 = Multiplication(A=multiplication, B=multiplication_2)  # -> simplify(graft(Result))
ma = MassAddition(Input=multiplication_3)  # -> Result, PartialResults
equals = Equality(FirstNumber=ma.Result, SecondNumber="0")  # -> Equality, Inequality
p_n_c_3 = PickNChoose(Pattern=equals.Inequality, Stream1=ma.Result)
merge = Merge(Data1=p_n_c_3, Data2=data)
use_gwp_kg_co2eq = Data(merge)
use_gwp_kg_co2eq_2 = ClusterOutput(use_gwp_kg_co2eq)

# ==== cluster Construction
constructions = ClusterInput()

windows = ClusterInput()
windows_2 = Data(windows)
split = SplitTree(Data=windows_2, Masks=flatten("{*;0}"))  # -> Positive, Negative
split_2 = SplitTree(Data=windows_2, Masks=flatten("{*;1}"))  # -> Positive, Negative
split_3 = SplitTree(Data=windows_2, Masks=flatten("{*;4}"))  # -> Positive, Negative
split_4 = SplitTree(Data=windows_2, Masks=flatten("{*;5}"))  # -> Positive, Negative
split_5 = SplitTree(Data=windows_2, Masks=flatten("{*;6}"))  # -> Positive, Negative
split_6 = SplitTree(Data=windows_2, Masks=flatten("{*;7}"))  # -> Positive, Negative
path_mapper = PathMapper(split.Positive, source="{A;B}", target="{A}")
path_mapper_2 = PathMapper(split_2.Positive, source="{A;B}", target="{A}")
path_mapper_3 = PathMapper(split_3.Positive, source="{A;B}", target="{A}")
path_mapper_4 = PathMapper(split_4.Positive, source="{A;B}", target="{A}")
path_mapper_5 = PathMapper(split_5.Positive, source="{A;B}", target="{A}")
path_mapper_6 = PathMapper(split_6.Positive, source="{A;B}", target="{A}")
panel = Panel(path_mapper_6)
multiplication = Multiplication(A=path_mapper_3, B=path_mapper_5)
multiplication_2 = Multiplication(A=path_mapper_4, B=path_mapper_6)
ma = MassAddition(Input=[multiplication, multiplication_2])  # -> Result, PartialResults

constructions_2 = Data(constructions)
split_7 = SplitTree(Data=constructions_2, Masks=flatten("{*;9}"))  # -> Positive, Negative
split_8 = SplitTree(Data=constructions_2, Masks=flatten("{*;10}"))  # -> Positive, Negative
split_9 = SplitTree(Data=constructions_2, Masks=flatten("{*;11}"))  # -> Positive, Negative
split_10 = SplitTree(Data=constructions_2, Masks=flatten("{*;0}"))  # -> Positive, Negative
split_11 = SplitTree(Data=constructions_2, Masks=flatten("{*;1}"))  # -> Positive, Negative
split_12 = SplitTree(Data=constructions_2, Masks=flatten("{*;2}"))  # -> Positive, Negative
split_13 = SplitTree(Data=constructions_2, Masks=flatten("{*;5}"))  # -> Positive, Negative
split_14 = SplitTree(Data=constructions_2, Masks=flatten("{*;7}"))  # -> Positive, Negative
split_15 = SplitTree(Data=constructions_2, Masks=flatten("{*;8}"))  # -> Positive, Negative

# ---- group: C3 GWP per kg
path_mapper_7 = PathMapper(split_7.Positive, source="{A;B}", target="{A}")

# ----
path_mapper_8 = PathMapper(split_10.Positive, source="{A;B}", target="{A}")
path_mapper_9 = PathMapper(split_11.Positive, source="{A;B}", target="{A}")

# ---- group: Material Names
path_mapper_10 = PathMapper(split_12.Positive, source="{A;B}", target="{A}")

# ---- group: Density
path_mapper_11 = PathMapper(split_13.Positive, source="{A;B}", target="{A}")

# ---- group: Thickness
path_mapper_12 = PathMapper(split_14.Positive, source="{A;B}", target="{A}")

# ---- group: GWP per kg
path_mapper_13 = PathMapper(split_15.Positive, source="{A;B}", target="{A}")

# ---- group: D GWP per kg
path_mapper_14 = PathMapper(split_8.Positive, source="{A;B}", target="{A}")

# ---- group: C4 GWP per kg
path_mapper_15 = PathMapper(split_9.Positive, source="{A;B}", target="{A}")

# ----
panel_2 = Panel(path_mapper_10)
sdiff = SolidDifference(BrepsA=path_mapper_9, BrepsB=path_mapper_2)
multiplication_3 = Multiplication(A=path_mapper_11, B=path_mapper_12)
cluster = Cluster_5(surface=sdiff)
multiplication_4 = Multiplication(A=cluster, B=multiplication_3)
multiplication_5 = Multiplication(A=multiplication_4, B=path_mapper_13)
multiplication_6 = Multiplication(A=multiplication_4, B=path_mapper_7)
multiplication_7 = Multiplication(A=multiplication_4, B=path_mapper_14)
multiplication_8 = Multiplication(A=multiplication_4, B=path_mapper_15)
panel_3 = Panel(multiplication_8)
addition = Addition(A=multiplication_6, B=multiplication_8)
panel_4 = Panel(multiplication_6)
panel_5 = Panel(addition)
null = NullItem(Item=path_mapper_2)  # -> simplify(flatten(NullFlags)), InvalidFlags, Description
ma_2 = MassAddition(Input=multiplication_5)  # -> Result, PartialResults
materials_gwp_kg_co2eq = Data([multiplication_5, ma.Result])
materials_d_gwp_kg_co2eq = Data(multiplication_7)
materials_c_gwp_kg_co2eq = Data(addition)
dcon = DeleteConsecutive(Set=null.NullFlags, Wrap=False)  # -> Set, Count
division = Division(A=ma_2.Result, B=cluster)
long = LongestList(ListA=dcon.Set, ListB=sdiff, PaddingMode=2)  # -> ListA, ListB
gradient = Gradient(
    LowerLimit="0",
    UpperLimit="200",
    Parameter=division,
    stops=[0: RGB(0, 128, 0), 0.5: RGB(255, 255, 0), 1: RGB(255, 0, 0)])
constructions_3 = Data([path_mapper_8, path_mapper])
materials = Data([path_mapper_10, path_mapper])
p_n_c = PickNChoose(Pattern=long.ListA, Stream0=sdiff, Stream1=path_mapper_9)
panel_6 = Panel(materials)
preview = CustomPreview(Geometry=p_n_c, Shader=gradient)
ma_3 = MassAddition(Input=materials_gwp_kg_co2eq)  # -> Result, PartialResults
preview_2 = CustomPreview(Geometry=path_mapper_2, Shader=ColourSwatch(SwatchColor=RGBA(0, 153, 255, 130)))
ma_4 = MassAddition(Input=materials_c_gwp_kg_co2eq)  # -> Result, PartialResults
ma_5 = MassAddition(Input=materials_d_gwp_kg_co2eq)  # -> Result, PartialResults
flatten = FlattenTree(Tree=constructions_3, Path="1")
flatten_2 = FlattenTree(Tree=constructions_3, Path="1")
flatten_3 = FlattenTree(Tree=ma_3.Result, Path="1")
flatten_4 = FlattenTree(Tree="C3C4 Constructions GWP", Path="1")
flatten_5 = FlattenTree(Tree="Constructions GWP", Path="1")
flatten_6 = FlattenTree(Tree=ma_4.Result, Path="1")
flatten_7 = FlattenTree(Tree=constructions_3, Path="1")
flatten_8 = FlattenTree(Tree=ma_5.Result, Path="1")
flatten_9 = FlattenTree(Tree="D Constructions GWP", Path="1")
entwine = Entwine(Branch0X=materials_gwp_kg_co2eq, Branch1X=constructions_3, Branch2X=materials, FlattenInputs=False)
entwine_2 = Entwine(Branch0X=flatten_3, Branch1X=flatten_5, Branch2X=flatten, FlattenInputs=False)
entwine_3 = Entwine(Branch0X=flatten_6, Branch1X=flatten_4, Branch2X=flatten_2, FlattenInputs=False)
entwine_4 = Entwine(Branch0X=flatten_8, Branch1X=flatten_9, Branch2X=flatten_7, FlattenInputs=False)
materials_gwp_kg_co2eq_2 = Data(entwine)
materials_gwp_kg_co2eq_3 = ClusterOutput(materials_gwp_kg_co2eq_2)
constructions_gwp_kg_co2eq = Data(entwine_2)
d_benefits_gwp_kg_co2eq = Data(entwine_4)
c3_end_of_life_gwp_kg_co2eq = Data(entwine_3)
panel_7 = Panel(split_10.Positive)
constructions_gwp_kg_co2eq_2 = ClusterOutput(constructions_gwp_kg_co2eq)
c3_end_of_life_gwp_kg_co2eq_2 = ClusterOutput(c3_end_of_life_gwp_kg_co2eq)
d_benefits_gwp_kg_co2eq_2 = ClusterOutput(d_benefits_gwp_kg_co2eq)
panel_8 = Panel(entwine_2)
panel_9 = Panel(entwine_3)
panel_10 = Panel(entwine_4)

# ==== cluster EndOfLife
end_of_life = ClusterInput()
constructions = ClusterInput()
windows = ClusterInput()
database = ClusterInput()
end_of_life_2 = Data(end_of_life)
constructions_2 = Data(constructions)
windows_2 = Data(windows)
database_2 = Data(database)
split = SplitTree(Data=constructions_2, Masks=flatten("{*;1}"))  # -> Positive, Negative
split_2 = SplitTree(Data=constructions_2, Masks=flatten("{*;5}"))  # -> Positive, Negative
split_3 = SplitTree(Data=windows_2, Masks=flatten("{*;5}"))  # -> Positive, Negative
split_4 = SplitTree(Data=windows_2, Masks=flatten("{*;1}"))  # -> Positive, Negative
split_5 = SplitTree(Data=windows_2, Masks=flatten("{*;4}"))  # -> Positive, Negative
split_6 = SplitTree(Data=constructions_2, Masks=flatten("{*;7}"))  # -> Positive, Negative
path_mapper = PathMapper(split_3.Positive, source="{A;B}", target="{A}")
path_mapper_2 = PathMapper(split_4.Positive, source="{A;B}", target="{A}")
path_mapper_3 = PathMapper(split.Positive, source="{A;B}", target="{A}")
path_mapper_4 = PathMapper(split_2.Positive, source="{A;B}", target="{A}")
path_mapper_5 = PathMapper(split_5.Positive, source="{A;B}", target="{A}")
path_mapper_6 = PathMapper(split_6.Positive, source="{A;B}", target="{A}")
sdiff = SolidDifference(BrepsA=path_mapper_3, BrepsB=path_mapper_2)
cluster = Cluster_5(surface=sdiff)
multiplication = Multiplication(A=path_mapper_4, B=path_mapper_6)
multiplication_2 = Multiplication(A=cluster, B=multiplication)
branch = TreeBranch(Tree=database_2, Path="11", MaintainPaths=True)
branch_2 = TreeBranch(Tree=database_2, Path="12", MaintainPaths=True)
ma = MassAddition(Input=flatten([multiplication_2, path_mapper_5, path_mapper]))  # -> Result, PartialResults
keysearch = KeyValueSearch(Keys=branch, Values=branch_2, Search=end_of_life_2)
multiplication_3 = Multiplication(A=ma.Result, B=keysearch)
end_of_life_gwp_kg_co2eq = Data(multiplication_3)
end_of_life_gwp_kg_co2eq_2 = ClusterOutput(end_of_life_gwp_kg_co2eq)

# ==== cluster FromSlidersOrFromCSV
bool = ClusterInput()
bool_2 = Boolean(bool)
_0 = ClusterInput()
_1 = ClusterInput()
_0_2 = ClusterInput()
_1_2 = ClusterInput()
_0_3 = ClusterInput()
_1_3 = ClusterInput()
_0_4 = ClusterInput()
_1_4 = ClusterInput()
_0_5 = ClusterInput()
_1_5 = ClusterInput()
p_n_c = PickNChoose(Pattern=bool_2, Stream0=_0, Stream1=_1)
_0_6 = ClusterInput()
_1_6 = ClusterInput()
_0_7 = ClusterInput()
_1_7 = ClusterInput()
p_n_c_2 = PickNChoose(Pattern=bool_2, Stream0=_0_2, Stream1=_1_2)
p_n_c_3 = PickNChoose(Pattern=bool_2, Stream0=_0_3, Stream1=_1_3)
_0_8 = ClusterInput()
_1_8 = ClusterInput()
p_n_c_4 = PickNChoose(Pattern=bool_2, Stream0=_0_4, Stream1=_1_4)
_0_9 = ClusterInput()
_1_9 = ClusterInput()
p_n_c_5 = PickNChoose(Pattern=bool_2, Stream0=_0_5, Stream1=_1_5)
_0_10 = ClusterInput()
_1_10 = ClusterInput()
R = ClusterOutput(p_n_c)
_0_11 = ClusterInput()
_1_11 = ClusterInput()
p_n_c_6 = PickNChoose(Pattern=bool_2, Stream0=_0_6, Stream1=_1_6)
p_n_c_7 = PickNChoose(Pattern=bool_2, Stream0=_0_7, Stream1=_1_7)
R_2 = ClusterOutput(p_n_c_2)
R_3 = ClusterOutput(p_n_c_3)
p_n_c_8 = PickNChoose(Pattern=bool_2, Stream0=_0_8, Stream1=_1_8)
R_4 = ClusterOutput(p_n_c_4)
p_n_c_9 = PickNChoose(Pattern=bool_2, Stream0=_0_9, Stream1=_1_9)
p_n_c_10 = PickNChoose(Pattern=bool_2, Stream0=_0_10, Stream1=_1_10)
R_5 = ClusterOutput(p_n_c_5)
p_n_c_11 = PickNChoose(Pattern=bool_2, Stream0=_0_11, Stream1=_1_11)
R_6 = ClusterOutput(p_n_c_6)
R_7 = ClusterOutput(p_n_c_7)
R_8 = ClusterOutput(p_n_c_8)
R_9 = ClusterOutput(p_n_c_9)
R_10 = ClusterOutput(p_n_c_10)
R_11 = ClusterOutput(p_n_c_11)

# ==== cluster Cluster_6
rows = ClusterInput()
columns = ClusterInput()
rows_2 = Data(rows)
columns_2 = Data(columns)
tstat = TreeStatistics(Tree=columns_2)  # -> Paths, Length, Count
item = ListItem(List=tstat.Length, Index=0, Wrap=True)  # -> flatten(Item)
subtraction = Subtraction(A=item, B=Slider(2, range=0..10))
series = Series(Start=Slider(3, range=0..10), Step=1, Count=subtraction)
branch = TreeBranch(Tree=rows_2, Path=series, MaintainPaths=True)
B = ClusterOutput(branch)

# ==== cluster DelistLast
data = ClusterInput()
data_2 = Data(data)
lng = ListLength(List=data_2)
subtraction = Subtraction(A=lng, B=1)
series = Series(Start=0, Step=1, Count=subtraction)
item = ListItem(List=data_2, Index=series, Wrap=True)
i = ClusterOutput(item)

# ==== cluster LCATool
lca_database = ClusterInput()
lca_database_2 = Data(lca_database)

# ---- group: C3
spreadsheet_reader = SpreadsheetReader(Path=lca_database_2, Sheet="5")  # -> Message, Data
panel = Panel(spreadsheet_reader.Data)
item = ListItem(List=panel, Index="0", Wrap=True)  # -> flatten(Item)
item_2 = ListItem(List=panel, Index="1", Wrap=True)  # -> flatten(Item)
panel_2 = Panel(item)
panel_3 = Panel(item_2)

# ---- group: D
spreadsheet_reader_2 = SpreadsheetReader(Path=lca_database_2, Sheet="6")  # -> Message, Data
panel_4 = Panel(spreadsheet_reader_2.Data)
item_3 = ListItem(List=panel_4, Index="0", Wrap=True)  # -> flatten(Item)
item_4 = ListItem(List=panel_4, Index="1", Wrap=True)  # -> flatten(Item)
panel_5 = Panel(item_3)
panel_6 = Panel(item_4)

spreadsheet_reader_3 = SpreadsheetReader(Path=lca_database_2, Sheet="7")  # -> Message, Data
panel_7 = Panel(spreadsheet_reader_3.Data)
item_5 = ListItem(List=panel_7, Index="0", Wrap=True)  # -> flatten(Item)
item_6 = ListItem(List=panel_7, Index="1", Wrap=True)  # -> flatten(Item)
panel_8 = Panel(item_5)
panel_9 = Panel(item_6)

# ----
spreadsheet_reader_4 = SpreadsheetReader(Path=lca_database_2, Sheet="1")  # -> Message, Data
spreadsheet_reader_5 = SpreadsheetReader(Path=lca_database_2, Sheet="4")  # -> Message, Data
spreadsheet_reader_6 = SpreadsheetReader(Path=lca_database_2, Sheet="2")  # -> Message, Data
spreadsheet_reader_7 = SpreadsheetReader(Path=lca_database_2, Sheet="3")  # -> Message, Data
panel_10 = Panel(spreadsheet_reader_4.Data)
panel_11 = Panel(spreadsheet_reader_5.Data)
panel_12 = Panel(spreadsheet_reader_6.Data)
panel_13 = Panel(spreadsheet_reader_7.Data)
item_7 = ListItem(List=panel_12, Index="0", Wrap=True)  # -> flatten(Item)
item_8 = ListItem(List=panel_12, Index="1", Wrap=True)  # -> flatten(Item)
item_9 = ListItem(List=panel_12, Index="3", Wrap=True)  # -> flatten(Item)
item_10 = ListItem(List=panel_12, Index="5", Wrap=True)  # -> flatten(Item)
item_11 = ListItem(List=panel_12, Index="7", Wrap=True)  # -> flatten(Item)
item_12 = ListItem(List=panel_13, Index="0", Wrap=True)  # -> flatten(Item)
item_13 = ListItem(List=panel_13, Index="1", Wrap=True)  # -> flatten(Item)
item_14 = ListItem(List=panel_13, Index="3", Wrap=True)  # -> flatten(Item)
item_15 = ListItem(List=panel_10, Index="0", Wrap=True)  # -> flatten(Item)
item_16 = ListItem(List=panel_10, Index="1", Wrap=True)  # -> flatten(Item)
item_17 = ListItem(List=panel_10, Index="3", Wrap=True)  # -> flatten(Item)
item_18 = ListItem(List=panel_11, Index="0", Wrap=True)  # -> flatten(Item)
item_19 = ListItem(List=panel_11, Index="1", Wrap=True)  # -> flatten(Item)
panel_14 = Panel(item_7)
panel_15 = Panel(item_15)
panel_16 = Panel(item_12)
panel_17 = Panel(item_18)
panel_18 = Panel(item_13)
panel_19 = Panel(item_14)
panel_20 = Panel(item_8)
panel_21 = Panel(item_16)
panel_22 = Panel(item_19)
panel_23 = Panel(item_9)
panel_24 = Panel(item_17)
panel_25 = Panel(item_10)
panel_26 = Panel(item_11)
entwine = Entwine(
    Branch00=item_7,
    Branch01=item_8,
    Branch02=item_9,
    Branch03=item_10,
    Branch04=item_11,
    Branch05=item_12,
    Branch06=item_13,
    Branch07=item_14,
    Branch08=item_15,
    Branch09=item_17,
    Branch010=item_16,
    Branch011=item_18,
    Branch012=item_19,
    Branch013=panel_2,
    Branch014=panel_3,
    Branch015=panel_5,
    Branch016=panel_6,
    Branch017=panel_8,
    Branch018=panel_9,
    FlattenInputs=True)  # -> simplify(Result)
materials = Data(item_7)
energy_sources = Data(item_15)
end_of_life = Data(item_18)
database = Data(entwine)
energy_sources_2 = ClusterOutput(energy_sources)
end_of_life_2 = ClusterOutput(end_of_life)
materials_2 = ClusterOutput(materials)
database_2 = ClusterOutput(database)

# ==== cluster ReadAreas
run = ClusterInput()
run_2 = Boolean(run)
read_building_shape = ReadBuildingShape(run=run_2)  # -> walls_2, roof_2, groundfloor_2, window_north_2, window_south_2, window_west_2, window_east_2
geo = Geometry([read_building_shape.walls_2, read_building_shape.roof_2, read_building_shape.groundfloor_2])
debrep = DeconstructBrep(Brep=geo)  # -> Faces, Edges, Vertices
swatch = ColourSwatch(SwatchColor=RGB(186, 186, 186))
geo_2 = Geometry(debrep.Edges)
previewmat = CustomPreviewMaterials(Geometry=read_building_shape.walls_2, DiffuseColor=ColourSwatch(SwatchColor=RGB(255, 255, 255)))
previewmat_2 = CustomPreviewMaterials(Geometry=read_building_shape.roof_2, DiffuseColor=swatch)
previewmat_3 = CustomPreviewMaterials(
    Geometry=[read_building_shape.window_north_2, read_building_shape.window_south_2, read_building_shape.window_west_2, read_building_shape.window_east_2],
    DiffuseColor=ColourSwatch(SwatchColor=RGBA(169, 212, 219, 118)),
    Transparency=Slider(0.4, range=0..1))
preview = CustomPreview(Geometry=geo_2, Material=swatch)
data = Data(read_building_shape.walls_2)
area = Area(Geometry=data)  # -> Area, Centroid
total_area = TotalArea(geometry=read_building_shape.window_north_2)
total_area_2 = TotalArea(geometry=read_building_shape.window_south_2)
total_area_3 = TotalArea(geometry=read_building_shape.window_west_2)
total_area_4 = TotalArea(geometry=read_building_shape.window_east_2)
total_area_5 = TotalArea(geometry=read_building_shape.walls_2)
total_area_6 = TotalArea(geometry=read_building_shape.roof_2)
total_area_7 = TotalArea(geometry=read_building_shape.groundfloor_2)
brep = Brep([read_building_shape.walls_2, read_building_shape.roof_2, read_building_shape.groundfloor_2, read_building_shape.window_north_2, read_building_shape.window_south_2, read_building_shape.window_west_2, read_building_shape.window_east_2])
pdecon = Deconstruct(Point=area.Centroid)  # -> XComponent, YComponent, ZComponent
brep_2 = Brep(flatten(brep))
round = Round(Number=pdecon.ZComponent)  # -> Nearest, Floor, Ceiling
walls = Data(total_area_5)
roof = Data(total_area_6)
window_east = Data(total_area_4)
groundfloor = Data(total_area_7)
window_west = Data(total_area_3)
window_north = Data(total_area)
window_south = Data(total_area_2)
join = BrepJoin(Breps=brep_2)  # -> Breps, Closed
sort = SortList(Keys=round.Nearest)  # -> Keys, ValuesA
dcon = DeleteConsecutive(Set=sort.Keys, Wrap=False)  # -> Set, Count
volume = Volume(Geometry=join.Breps)  # -> Volume, Centroid
lng = ListLength(List=dcon.Set)
window_north_2 = ClusterOutput(window_north)
window_south_2 = ClusterOutput(window_south)
window_west_2 = ClusterOutput(window_west)
walls_2 = ClusterOutput(walls)
roof_2 = ClusterOutput(roof)
groundfloor_2 = ClusterOutput(groundfloor)
window_east_2 = ClusterOutput(window_east)
volume_2 = ClusterOutput(volume.Volume)
levels = ClusterOutput(lng)

# ==== cluster Cluster
surface = ClusterInput()
surface_2 = Data(surface)
edges = BrepEdges(Brep=surface_2)  # -> simplify(Naked), Interior, NonManifold
area = Area(Geometry=surface_2)  # -> Area, Centroid
len = Length(Curve=edges.Naked)
ma = MassAddition(Input=len)  # -> Result, PartialResults
area_m2 = Data(area.Area)
edge_length_m = Data(ma.Result)
area_m2_2 = ClusterOutput(area_m2)
edge_length_m_2 = ClusterOutput(edge_length_m)

# ==== cluster MaterialDefinitions
materials = ClusterInput()
thicknesses = ClusterInput()
database = ClusterInput()
surface_name = ClusterInput()
thicknesses_2 = Data(thicknesses)
database_2 = Data(database)
materials_2 = Data(materials)
surface_name_2 = Data(surface_name)
branch = TreeBranch(Tree=database_2, Path="0", MaintainPaths=True)
branch_2 = TreeBranch(Tree=database_2, Path="1", MaintainPaths=True)
branch_3 = TreeBranch(Tree=database_2, Path="2", MaintainPaths=True)
branch_4 = TreeBranch(Tree=database_2, Path="3", MaintainPaths=True)
cluster = Cluster_3(surface_name=surface_name_2, materials=materials_2)
keysearch = KeyValueSearch(Keys=branch, Values=[branch_2, branch_3, branch_4], Search=materials_2)
branch_5 = TreeBranch(Tree=keysearch, Path="2", MaintainPaths=True)
branch_6 = TreeBranch(Tree=keysearch, Path="3", MaintainPaths=True)
branch_7 = TreeBranch(Tree=keysearch, Path="1", MaintainPaths=True)
epopaquemat = Honeybee_EnergyPlusOpaqueMaterial(
    name=cluster,
    roughness="Rough",
    thickness=thicknesses_2,
    conductivity=branch_5,
    density=branch_7,
    specificHeat=branch_6,
    thermAbsp=Slider(0.5, range=0..1),
    solAbsp=Slider(0.2, range=0..1))  # -> EPMaterial; plug-in component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
toggle = BooleanToggle(True)
densities = Data(branch_7)
epmaterial_names = Data(cluster)
epmaterials = Data(epopaquemat)
epmaterial_names_2 = ClusterOutput(epmaterial_names)
densities_2 = ClusterOutput(densities)
epmaterials_2 = ClusterOutput(epmaterials)
addtoeplibrary = Honeybee_AddToEnergyPlusLibrary(EPObject=epopaquemat, addToProjectLib=toggle, overwrite=toggle)  # -> simplify(readMe); plug-in component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

# ==== cluster ConstructionDefinition
epmaterial_names = ClusterInput()
surface_name = ClusterInput()
epmaterial_names_2 = Data(epmaterial_names)
panel = Panel(epmaterial_names_2)
surface_name_2 = Data(surface_name)
panel_2 = Panel(surface_name_2)
toggle = BooleanToggle(False)
item = ListItem(List=panel, Index="0", Wrap=toggle)
item_2 = ListItem(List=panel, Index="1", Wrap=toggle)
item_3 = ListItem(List=panel, Index="2", Wrap=toggle)
item_4 = ListItem(List=panel, Index="3", Wrap=toggle)
item_5 = ListItem(List=panel, Index="4", Wrap=toggle)
item_6 = ListItem(List=panel, Index="5", Wrap=toggle)
epconstruction = Honeybee_EnergyPlusConstruction(name=surface_name_2, layer_1=item, layer_2=item_2, layer_3=item_3, layer_4=item_4, layer_5=item_5, layer_6=item_6)  # -> EPConstruction; plug-in component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
panel_3 = Panel(epconstruction)
epconstruction_2 = Data(epconstruction)
epconstruction_3 = ClusterOutput(epconstruction_2)

# ==== cluster Cluster_5
surface = ClusterInput()
surface_2 = Data(surface)
area = Area(Geometry=surface_2)  # -> Area, Centroid
ma = MassAddition(Input=area.Area)  # -> Result, PartialResults
area_m2 = Data(ma.Result)
area_m2_2 = ClusterOutput(area_m2)

# ==== cluster ReadBuildingShape: Reads Building Geometry from Rhino file based on Layer Names
run = ClusterInput()
run_2 = Boolean(run)
python = PythonScript(Ls="Window_North", x=run_2)  # -> out, a; inputs Ls: list
# ---------- python: Python ----------
import rhinoscriptsyntax as rs
import scriptcontext as sc
import Rhino


a = None

if x:
    sc.doc = Rhino.RhinoDoc.ActiveDoc
    
    all_objs = []
    for layer in Ls:
        
        objs = rs.ObjectsByLayer(layer)
        if objs:
            #you need to get the geometry from IDs
            objs = [rs.coercegeometry(x) for x in objs]
            #if you want to use rs, then add to the current doc
            objs = [ghdoc.Objects.Add(x) for x in objs]
            all_objs.extend(objs)
            
    a = all_objs
    
    sc.doc = ghdoc
# ---------- end python ----------
python_2 = PythonScript(Ls="Walls", x=run_2)  # -> out, a; inputs Ls: list; same code as python
python_3 = PythonScript(Ls="GroundFloor", x=run_2)  # -> out, a; inputs Ls: list; same code as python
python_4 = PythonScript(Ls="Roofs", x=run_2)  # -> out, a; inputs Ls: list; same code as python
python_5 = PythonScript(Ls="Window_South", x=run_2)  # -> out, a; inputs Ls: list; same code as python
python_6 = PythonScript(Ls="Window_West", x=run_2)  # -> out, a; inputs Ls: list; same code as python
python_7 = PythonScript(Ls="Window_East", x=run_2)  # -> out, a; inputs Ls: list; same code as python
panel = Panel(python.a)
panel_2 = Panel(python_2.a)
panel_3 = Panel(python_3.a)
panel_4 = Panel(python_4.a)
panel_5 = Panel(python_5.a)
panel_6 = Panel(python_6.a)
panel_7 = Panel(python_7.a)
walls = Data(python_2.a)
roof = Data(python_4.a)
window_north = Data(python.a)
groundfloor = Data(python_3.a)
window_south = Data(python_5.a)
Z = UnitZ(Factor=1)
window_west = Data(python_6.a)
window_east = Data(python_7.a)
walls_2 = ClusterOutput(walls)
roof_2 = ClusterOutput(roof)
groundfloor_2 = ClusterOutput(groundfloor)
window_north_2 = ClusterOutput(window_north)
window_south_2 = ClusterOutput(window_south)
window_west_2 = ClusterOutput(window_west)
window_east_2 = ClusterOutput(window_east)

# ==== cluster TotalArea
geometry = ClusterInput()
geometry_2 = Geometry(geometry)
area = Area(Geometry=flatten(geometry_2))  # -> Area, Centroid
ma = MassAddition(Input=area.Area)  # -> Result, PartialResults
total_area = Data(ma.Result)
total_area_2 = ClusterOutput(total_area)

# ==== cluster Cluster_3
materials = ClusterInput()
surface_name = ClusterInput()
materials_2 = Data(materials)
lng = ListLength(List=materials_2)
surface_name_2 = Data(surface_name)
subtraction = Subtraction(A=lng, B="1")
subtraction_2 = Subtraction(A=lng, B=subtraction)
series = Series(Start=subtraction_2, Step="1", Count=lng)
path_mapper = PathMapper(series, source="{A;B}", target="{A}")
round = Round(Number=path_mapper)  # -> Nearest, Floor, Ceiling
concat = Concatenate(FragmentA=surface_name_2, FragmentE="_layer", FragmentD=round.Nearest, FragmentC="_", FragmentB=materials_2)  # -> simplify(Result)
material_names = Data(concat)
material_names_2 = ClusterOutput(material_names)
