# Grasshopper definition Final-analysis-tool.gh (Grasshopper 1.0.7)
# plug-ins: Human UI, Human, Ironbug.LBHB_Legacy, FalseStartToggle, LunchBox, GH_CPython

climate_location = ValueList({"Central Poland (Warsaw)": 0, "Continental Poland (Zakopane)": 1, "Oceanic Poland (Szczecin)": 2}, selected="Central Poland (Warsaw)")
construction = ValueList({"Prefab Concrete": 0, "Concrete Frame": 1, "Timber Frame": 2, "CLT": 3}, selected="Concrete Frame")

create_separator = CreateSeparator(Thickness=0.5, Horizontal=True, Color=RGB(0, 0, 0))
create_separator_2 = CreateSeparator(Thickness=0.5, Horizontal=True, Color=RGB(0, 0, 0))
create_separator_3 = CreateSeparator(Thickness=0.5, Horizontal=True, Color=RGB(0, 0, 0))
panel = Panel("""Warsaw
Zakopane
Szczecin  """)
panel_2 = Panel("""Brick and Concrete Frame
Prefab Concrete  
Timber Frame    
CLT             """)

label = CreateLabel(LabelText=" ", LabelSize=12, Justification=0)

label_2 = CreateLabel(LabelText=" ", LabelSize=12, Justification=0)

label_3 = CreateLabel(LabelText=" ", LabelSize=12, Justification=0)

label_4 = CreateLabel(LabelText=" ", LabelSize=12, Justification=0)

create_pulldown_menu = CreatePulldownMenu(Label="Climate location", ListItems=panel, showLabel=True)
create_pulldown_menu_2 = CreatePulldownMenu(Label="Construction technology", ListItems=panel_2, showLabel=True)
addition = Addition()

# ----
# Updating a UI Element
# 1. Create a window
toggle = BooleanToggle(True)
launchwin = LaunchWindow(Show=toggle, Name="ML CO2 TOOL", Width=370, Height=400, ChildStatus=0, EnableHorizScroll=False)

label_5 = CreateLabel(LabelText=" ", LabelSize=12, Justification=0)
label_6 = CreateLabel(LabelText=" ", LabelSize=12, Justification=0)
label_7 = CreateLabel(LabelText=" ", LabelSize=12, Justification=0)
label_8 = CreateLabel(LabelText=" ", LabelSize=12, Justification=0)
label_9 = CreateLabel(LabelText=" ", LabelSize=12, Justification=0)
values = ValueListener(Elements=create_pulldown_menu_2, SomeProperty=True)  # -> Values, Indices
values_2 = ValueListener(Elements=create_pulldown_menu, SomeProperty=True)  # -> Values, Indices

calculate = Button()
runml = FalseStartToggle(False)

runml2 = FalseStartToggle(False)
create_toggle = CreateToggle(Default=False)
pan = Panel("Embodied Carbon Footprint [A1-A3; C3-C4] per m2 (kg CO2e / m2)")
font_table = FontTable()
font_table_2 = FontTable()
construction_2 = Integer(values.Indices)
climate = Integer(values_2.Indices)
item_selector = ItemSelector(
    font_table,
    {"a Ahlan Wasahlan", "AcadEref", "Adagio_Slab", "Adagio_Slab Black", "Adagio_Slab Bold", "Adagio_Slab ExtraLight"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}, selected="Adagio_Slab Bold")
create_button = CreateButton(ButtonName="Recalculate", ButtonStyle=0)
item_selector_2 = ItemSelector(
    font_table_2,
    {"a Ahlan Wasahlan", "AcadEref", "Adagio_Slab", "Adagio_Slab Black", "Adagio_Slab Bold", "Adagio_Slab ExtraLight"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}, selected="Adagio_Slab Bold")
construction_3 = Integer(construction_2)
values_3 = ValueListener(Elements=create_toggle, SomeProperty=True)  # -> Values, Indices
boolean = Boolean(values_3.Values)
boolean_2 = Boolean(values_3.Values)
boolean_3 = Boolean(boolean)
boolean_4 = Boolean(boolean_2)
climate_2 = Integer(climate)

rec = DataRecorder(calculate, DataLimit=-10, RecordData=True)
ma = MassAddition(Input=rec)  # -> Result, PartialResults
dom = ConstructDomain(DomainStart=0, DomainEnd=Slider(100000, range=0..100000))
multiplication = Multiplication(A="15", B=ma.Result)
random = Random(Range=dom, Number=1, Seed=multiplication)
addition_2 = Addition(A=random, B=23445)
round = Round(Number=addition_2)  # -> Nearest, Floor, Ceiling

merge = Merge(Data1="Operation Carbon Footprint [B6] per m2 (kg CO2e / m2)", Data2=pan)
merge_2 = Merge(
    Data1="B6 Operational Carbon Footprint [kg CO2e]",
    Data2="A1-A3 Material Carbon Footprint  [kg CO2e]",
    Data3="C3-C4 Disposal Carbon Footprint [kg CO2e]",
    Data4="D Benefits (negative) [kg CO2e]")
panel_3 = Panel(values_3.Values)
concat = Concatenate(FragmentA="E:\Nauka\PhD\MLCF-sun\img3", FragmentB="\", FragmentC=round.Floor)
panel_4 = Panel(round.Floor)
values_4 = ValueListener(Elements=create_button, SomeProperty=True)  # -> Values, Indices

series = Series(Start=0, Step=Slider(0.24, range=0..1), Count=Slider(4, range=0..10))
gradient = Gradient(
    LowerLimit=0,
    UpperLimit=1,
    Parameter=series,
    stops=[0: RGB(243, 57, 0), 0.0506: RGB(236, 27, 60), 0.0951: RGB(210, 0, 118), 0.145: RGB(103, 0, 120), 0.223: RGB(39, 72, 161), 0.5: RGB(1, 192, 229), 0.6: RGB(18, 178, 90), 0.7: RGB(79, 186, 8), 0.8: RGB(220, 237, 32), 0.9: RGB(247, 159, 20), 1: RGB(243, 57, 0)])

series_2 = Series(Start=0, Step=Slider(0.24, range=0..1), Count=Slider(2, range=0..10))
gradient_2 = Gradient(
    LowerLimit=0,
    UpperLimit=1,
    Parameter=series_2,
    stops=[0: RGB(243, 57, 0), 0.0506: RGB(236, 27, 60), 0.0951: RGB(210, 0, 118), 0.145: RGB(103, 0, 120), 0.223: RGB(39, 72, 161), 0.5: RGB(1, 192, 229), 0.6: RGB(18, 178, 90), 0.7: RGB(79, 186, 8), 0.8: RGB(220, 237, 32), 0.9: RGB(247, 159, 20), 1: RGB(243, 57, 0)])

subtraction = Subtraction(A=values_3.Values, B=values_4.Values)
boolean_5 = Boolean(subtraction)
on = Boolean(values_3.Values)

run = FalseStartToggle(False)
on_2 = Boolean(on)
boolean_6 = Boolean(run)

slider = Slider(200, range=100..1600)
slider_2 = Slider(200, range=100..2000)
number_slider = Slider(5, range=0..10)
toggle_2 = BooleanToggle(True)
vb = VBScript(
    FileName=concat,
    blnSave=boolean_6,
    Resolution_width=slider,
    Resolution_height=slider_2,
    DisplayMode=number_slider,
    ViewName="Top",
    CustomView=toggle_2)  # -> out, A; disabled
# ---------- vb: VB usings ----------
Imports app = Rhino.RhinoApp
# ---------- vb: VB ----------
    '////// Marc Hoppermann ///////////tweaked by Damien Almor ///////rewritten for curves by to]///////adapted by u]...www.utos.blogspot.com
    '///readapted to Batch ViewCapture by Victor Leung @ www.dreamationworks.com

    ' Note1: The script is actually calling Rhino commands.
    ' Note2: Remember you have to draw something and is selectable for the script to function. The script uses _SelAll then _Zoom _Selected
    ' Note3: After you toggle blnSave to True, a new viewport will popup, be patient while Rhino work, and wait for that viewport to disappear befor clicking on anything.
    ' Note4: The component is not stable if you try to mouse click on anywhere while the saving process is running. Some stupid move may crash your programme, save RH and GH files before using this component.

    ' FileName :  String Input    = Supply with the path and file name without ".jpg" extension : e.g.: "C:\Temp\001" (Without the quotes)
    ' blnSave :   Boolean Input   = Saves when toggles to True (Remember to toggle back to False after use, otherwise the script will re-run itself during next update)
    ' Resolution_width :    Integer Input = Resolution for the captured image
    ' Resolution_height :   Integer Input = well...
    ' TopYea :    Boolean Input =   Toggles if the Top View is captured (Default is False if not connected)
    ' FrontYea :  Boolean Input =   Toggles if the Front View is captured (Default is False if not connected)
    ' ...Yea :    Boolean Input =   Toggles if the corresponding View is captured (Default is False if not connected)
    ' DisplayMode : Integer Input(0-4) = Sets the display Mode 0:Shaded 1:Wireframe 2:Rendered 3:Ghosted 4:XRay Default:Shaded

    If blnSave Then

      'For i As Int32 = 0 To arrcrv.Count - 1
      app.RunScript("_NewFloatingViewport Projection=Top", False)
      app.RunScript("-ViewportProperties _Size " & Resolution_width * 500 / Resolution_height & " " & 500 & " _Display _Shaded _Enter", False)

      Select Case DisplayMode  '(If you know what you are doing and have other Custom Display Mode, you are welcomed to add it down here)
        Case 0
          app.RunScript(" _-SetDisplayMode _Mode _Shaded", False)
        Case 1
          app.RunScript(" _-SetDisplayMode _Mode _Wireframe", False)
        Case 2
          app.RunScript(" _-SetDisplayMode _Mode _Rendered", False)
        Case 3
          app.RunScript(" _-SetDisplayMode _Mode _Ghosted", False)
        Case 4
          app.RunScript(" _-SetDisplayMode _Mode _XRay", False)
        Case 5
          app.RunScript(" _-SetDisplayMode _Mode _Shaded", False)
          app.RunScript(" _-ShowZBuffer _Enter _Enter", False)

        Case Else
          app.RunScript(" _-SetDisplayMode _Mode _Shaded", False)
      End Select
      'app.RunScript(Resolution_width & "_Enter")
      'app.RunScript(Resolution_height & "_Enter")
      'app.RunScript("_Enter")

      RhinoDoc.ActiveDoc.Objects.UnselectAll





      If CustomView Then
        'MRhinoView.EnableDrawing(False)
        RhinoDoc.ActiveDoc.Views.RedrawEnabled = False
        'app.RunScript("'_SelAll")
        app.RunScript("'_SetView " & ViewName & " _Enter", False)
        app.RunScript("'_SelNone _Enter", False)
        app.RunScript("'_-SelLayer Area _Enter", False)

        app.RunScript("'_Zoom _Selected", False)
        app.RunScript("'_SelNone _Enter", False)
        'app.RunScript(Chr(34) & "Exporting Custom View ...")
        'MRhinoView.EnableDrawing(True)
        RhinoDoc.ActiveDoc.Views.RedrawEnabled = True
        app.RunScript("_-viewcapturetofile " & FileName & ViewName & " _DrawGrid=No Width=" & Resolution_width & " Height=" & Resolution_height & "NumberOfPasses=1000" & "_Enter", False)

      End If

      app.RunScript("_CloseViewport", False)
      print("Done! Jpgs exported to " & FileName & ViewName)
      A = FileName & ViewName & ".jpg"
    Else print("inactive")

    End If
# ---------- end vb ----------

view_capture_jpeg = DotNETVBScriptLEGACY(
    FileName=concat,
    blnSave=run,
    Resolution_width=slider,
    Resolution_height=slider_2,
    DisplayMode=number_slider,
    ViewName="Top",
    CustomView=toggle_2)  # -> out, A
# ---------- view_capture_jpeg: VB ----------
    '////// Marc Hoppermann ///////////tweaked by Damien Almor ///////rewritten for curves by to]///////adapted by u]...www.utos.blogspot.com
    '///readapted to Batch ViewCapture by Victor Leung @ www.dreamationworks.com

    ' Note1: The script is actually calling Rhino commands.
    ' Note2: Remember you have to draw something and is selectable for the script to function. The script uses _SelAll then _Zoom _Selected
    ' Note3: After you toggle blnSave to True, a new viewport will popup, be patient while Rhino work, and wait for that viewport to disappear befor clicking on anything.
    ' Note4: The component is not stable if you try to mouse click on anywhere while the saving process is running. Some stupid move may crash your programme, save RH and GH files before using this component.

    ' FileName :  String Input    = Supply with the path and file name without ".jpg" extension : e.g.: "C:\Temp\001" (Without the quotes)
    ' blnSave :   Boolean Input   = Saves when toggles to True (Remember to toggle back to False after use, otherwise the script will re-run itself during next update)
    ' Resolution_width :    Integer Input = Resolution for the captured image
    ' Resolution_height :   Integer Input = well...
    ' TopYea :    Boolean Input =   Toggles if the Top View is captured (Default is False if not connected)
    ' FrontYea :  Boolean Input =   Toggles if the Front View is captured (Default is False if not connected)
    ' ...Yea :    Boolean Input =   Toggles if the corresponding View is captured (Default is False if not connected)
    ' DisplayMode : Integer Input(0-4) = Sets the display Mode 0:Shaded 1:Wireframe 2:Rendered 3:Ghosted 4:XRay Default:Shaded

    If blnSave Then

      'For i As Int32 = 0 To arrcrv.Count - 1
      app.RunScript("_NewFloatingViewport Projection=Top")
      app.RunScript("-ViewportProperties _Size " & Resolution_width * 500 / Resolution_height & " " & 500 & " _Display _Shaded _Enter")

      Select Case DisplayMode  '(If you know what you are doing and have other Custom Display Mode, you are welcomed to add it down here)
        Case 0
          app.RunScript(" _-SetDisplayMode _Mode _Shaded")
        Case 1
          app.RunScript(" _-SetDisplayMode _Mode _Wireframe")
        Case 2
          app.RunScript(" _-SetDisplayMode _Mode _Rendered")
        Case 3
          app.RunScript(" _-SetDisplayMode _Mode _Ghosted")
        Case 4
          app.RunScript(" _-SetDisplayMode _Mode _XRay")
        Case 5
          app.RunScript(" _-SetDisplayMode _Mode _Shaded")
          app.RunScript(" _-ShowZBuffer _Enter _Enter")

        Case Else
          app.RunScript(" _-SetDisplayMode _Mode _Shaded")
      End Select
      'app.RunScript(Resolution_width & "_Enter")
      'app.RunScript(Resolution_height & "_Enter")
      'app.RunScript("_Enter")

      doc.UnselectAll





      If CustomView Then
        MRhinoView.EnableDrawing(False)
        'app.RunScript("'_SelAll")
        app.RunScript("'_SetView " & ViewName & " _Enter")
        app.RunScript("'_SelNone _Enter")
        app.RunScript("'_-SelLayer Area _Enter")

        app.RunScript("'_Zoom _Selected")
        app.RunScript("'_SelNone _Enter")
        'app.RunScript(Chr(34) & "Exporting Custom View ...")
        MRhinoView.EnableDrawing(True)
        app.RunScript("_-viewcapturetofile " & FileName & ViewName & " _DrawGrid=No Width=" & Resolution_width & " Height=" & Resolution_height & "NumberOfPasses=1000" & "_Enter")

      End If

      app.RunScript("_CloseViewport")
      print("Done! Jpgs exported to " & FileName & ViewName)
      A = FileName & ViewName & ".jpg"
    Else print("inactive")

    End If
# ---------- end view_capture_jpeg ----------
ladybug_imageviewer = Ladybug_ImageViewer(ImagePath_=view_capture_jpeg.A, _scale_=1, DisableClickable=False, SaveImgWithCoords=False, scale=1)  # -> ImagePath, Colors, GIF
recalculate = Boolean(values_4.Values)
number_slider_2 = Slider(256, range=0..1000)
create_image = CreateImage(ImageSource=ladybug_imageviewer.ImagePath, ImageWidth=number_slider_2, ImageHeight=number_slider_2)

imgpath = Data(ladybug_imageviewer.ImagePath)
panel_5 = Panel(imgpath)
fragment = TextFragment(Text=panel_5, Start=Slider(0, range=0..1), Count=Slider(1, range=0..1))
concat_2 = Concatenate(FragmentE="E", FragmentA="://Nauka//PhD//MLCF-sun//img3//", FragmentB=round.Floor, FragmentD="Top", FragmentC=".jpg")
panel_6 = Panel(concat_2)

construction_4 = Integer(construction)
climate_3 = Integer(climate_location)

# ---- group: Binarizer
series_3 = Series(Start=0, Step="0", Count=Slider(3, range=0..10))
series_4 = Series(Start=0, Step="0", Count=Slider(4, range=0..10))
replace_items = ReplaceItems(List=series_4, Item="1", Indices=construction_4, Wrap=False)
replace_items_2 = ReplaceItems(List=series_3, Item="1", Indices=climate_3, Wrap=False)

# ----
dispatch = Dispatch(List=panel_6, DispatchPattern=runml)  # -> ListA, ListB
panel_7 = Panel(dispatch.ListA)

read_areas = ReadAreas(run=runml2)  # -> simplify(flatten(levels)), walls_2, roof_2, groundfloor_2, window_north_2, window_south_2, window_west_2, window_east_2, volume_2
merge_3 = Merge(
    Data1=read_areas.levels,
    Data2=read_areas.window_north_2,
    Data3=read_areas.window_south_2,
    Data4=read_areas.window_west_2,
    Data5=read_areas.window_east_2,
    Data6=read_areas.walls_2,
    Data7=read_areas.roof_2,
    Data8=read_areas.groundfloor_2,
    Data9=replace_items_2,
    Data10=replace_items)  # -> simplify(flatten(Result))

north = Panel(read_areas.window_north_2)
south = Panel(read_areas.window_south_2)
east = Panel(read_areas.window_west_2)

text_split = TextSplit(Text="10,500,500,500,500,2000,1000,1000,1,1", Separators=",")  # -> simplify(flatten(Result))
division = Division(A=merge_3, B=text_split)  # -> flatten(Result)

mlco2model = GH_CPython(parameters=division, urban=dispatch.ListA)  # -> result1, result2, result3, result4; inputs parameters: list
#   port result1: indicate your output description here. refers to a new line.
# ---------- mlco2model: Python ----------
# Import libraries
import os
import sys

env_p = sys.prefix  # path to the env
print("Env. path: {}".format(env_p))

new_p = ''
for extra_p in (r"Library\mingw-w64\bin",
    r"Library\usr\bin",
    r"Library\bin",
    r"Scripts",
    r"bin"):
    new_p +=  os.path.join(env_p, extra_p) + ';'

os.environ["PATH"] = new_p + os.environ["PATH"]  # set it for Python






import numpy as np
import cv2
import sys
if sys.version_info[0] < 3:
    raise Exception("Must be using Python 3")

from keras.models import load_model


model = load_model(r"C:\Users\Mateusz\Documents\Jupyter\quadoutput\data130321\model-doublecnn-300D.h5")

testAttrX = parameters

 
testImageX = cv2.imread(urban)
testImageX = cv2.resize(testImageX, (64, 64))
testImageX = testImageX/255.0


# ['Levels', 'Win north area','Win south area','Win west area','Win east area','Wall area','Roof area','Ground area','Climate-location','Construction-preset']
testImageX = testImageX.reshape(1,64,64,3)
# ['Levels', 'Win north area','Win south area','Win west area','Win east area','Wall area','Roof area','Ground area']
pred = model.predict([testImageX, np.array([testAttrX])])

preds = np.concatenate( pred, axis=0 )
preds = preds.flatten()
result1 = preds[0]
result2 = preds[1]
result3 = preds[2]
result4 = preds[3]
# ---------- end mlco2model ----------

multiplication_2 = Multiplication(A=mlco2model.result1, B=1000000)
multiplication_3 = Multiplication(A=mlco2model.result2, B=1000000)
multiplication_4 = Multiplication(A=mlco2model.result4, B=1000000)
multiplication_5 = Multiplication(A=mlco2model.result3, B=1000000)
subtraction_2 = Subtraction(A=multiplication_3, B="100000")
subtraction_3 = Subtraction(A=multiplication_4, B="500000")
result = Panel(subtraction_2)
result_2 = Panel(multiplication_5)
result_3 = Panel(subtraction_3)
result_4 = Panel(multiplication_2)
addition_3 = Addition(A=result_4, B=result, C=result_2, D=result_3)
result_5 = Panel(addition_3)

a1_a3_embodied = Panel(subtraction_2)
c3_c4_disposal = Panel(multiplication_5)
b6_operation = Panel(multiplication_2)
d_benefits = Panel(subtraction_3)

a1_a3_embodied_2 = Panel(subtraction_2)
c3_c4_disposal_2 = Panel(multiplication_5)
total_co2_kg_co2e_a1_a3_b6_c3_c4_d_2 = Panel(addition_3)
b6_operation_2 = Panel(multiplication_2)
d_benefits_2 = Panel(subtraction_3)

boolean_7 = Boolean(boolean_3)
pick_n_choose = PickNChoose(Pattern=boolean_7, Stream0=" ", Stream1=d_benefits_2)
pick_n_choose_2 = PickNChoose(Pattern=boolean_7, Stream0=" ", Stream1=c3_c4_disposal_2)
pick_n_choose_3 = PickNChoose(Pattern=boolean_7, Stream0=" ", Stream1=a1_a3_embodied_2)
pick_n_choose_4 = PickNChoose(Pattern=boolean_7, Stream0=" ", Stream1=b6_operation_2)
pick_n_choose_5 = PickNChoose(Pattern=boolean_7, Stream0=" ", Stream1=total_co2_kg_co2e_a1_a3_b6_c3_c4_d_2)

addition_4 = Addition(A=a1_a3_embodied_2, B=c3_c4_disposal_2, C=d_benefits_2)
multiplication_6 = Multiplication(A=d_benefits_2, B=-1)
merge_4 = Merge(Data1=b6_operation_2, Data2=a1_a3_embodied_2, Data3=c3_c4_disposal_2, Data4=multiplication_6)

format = Format(Format="Total Carbon Footprint: {0} kg CO2e", Culture=127, Data0=pick_n_choose_5)
setlabel = SetLabelContents(LabelToModify=label_4, NewLabelContents=format)

format_2 = Format(Format="B6 Operational Carbon Footprint: {0} kg CO2e", Culture=127, Data0=pick_n_choose_4)
setlabel_2 = SetLabelContents(LabelToModify=label_6, NewLabelContents=format_2)

format_3 = Format(Format="C3-C4 Disposal Carbon Footprint: {0} kg CO2e", Culture=127, Data0=pick_n_choose_2)
setlabel_3 = SetLabelContents(LabelToModify=label_5, NewLabelContents=format_3)

format_4 = Format(Format="A1-A3 Material Carbon Footprint: {0} kg CO2e", Culture=127, Data0=pick_n_choose_2)
setlabel_4 = SetLabelContents(LabelToModify=label_7, NewLabelContents=format_4)

format_5 = Format(Format="Embodied Carbon Footprint: {0} kg CO2e", Culture=127, Data0=pick_n_choose_3)
setlabel_5 = SetLabelContents(LabelToModify=label_8, NewLabelContents=format_5)

format_6 = Format(Format="D Benefits: {0} kg CO2e", Culture=127, Data0=pick_n_choose)
setlabel_6 = SetLabelContents(LabelToModify=label_9, NewLabelContents=format_6)

create_multi_chart = CreateMultiChart(Data=merge_4, Names=merge_2, SubTitle="Carbon Footprint", ClusterTitle=" ", ChartType=Slider(1, range=0..10))
chart_appearance = ChartAppearance(ChartToModify=create_multi_chart, Colors=gradient, Legend=Toggle(True))

number = Number(read_areas.groundfloor_2)
number_2 = Number(read_areas.levels)
number_slider_3 = Slider(30, range=0..100)
multiplication_7 = Multiplication(A=number, B=number_2)
floor_area = Number(multiplication_7)
addition_5 = Addition(A=subtraction_2, B=multiplication_5)
division_2 = Division(A=addition_5, B=floor_area)
division_3 = Division(A=multiplication_2, B=floor_area)
division_4 = Division(A=division_2, B=number_slider_3)
division_5 = Division(A=division_3, B=number_slider_3)
operational_carbon_b6_per_m2 = Panel(division_5)
embodied_carbon_a1_a3_c3_c4_per_m2 = Panel(division_4)

operational_carbon_b6_per_m2_2 = Panel(division_5)
embodied_carbon_a1_a3_c3_c4_per_m2_2 = Panel(division_4)
addition_6 = Addition(A=operational_carbon_b6_per_m2_2, B=embodied_carbon_a1_a3_c3_c4_per_m2_2)
round100 = Round100(A=embodied_carbon_a1_a3_c3_c4_per_m2_2)
round100_2 = Round100(A=operational_carbon_b6_per_m2_2)
round100_3 = Round100(A=addition_6)

boolean_8 = Boolean(boolean_4)
pick_n_choose_6 = PickNChoose(Pattern=boolean_8, Stream0=" ", Stream1=round100)
pick_n_choose_7 = PickNChoose(Pattern=boolean_8, Stream0=" ", Stream1=round100_2)
pick_n_choose_8 = PickNChoose(Pattern=boolean_8, Stream0=" ")

operational_carbon_b6_per_m2_3 = Panel(division_5)
embodied_carbon_a1_a3_c3_c4_per_m2_3 = Panel(division_4)
addition_7 = Addition(A=operational_carbon_b6_per_m2_3, B=embodied_carbon_a1_a3_c3_c4_per_m2_3)
round100_4 = Round100(A=embodied_carbon_a1_a3_c3_c4_per_m2_3)
round100_5 = Round100(A=operational_carbon_b6_per_m2_3)
round100_6 = Round100(A=addition_7)
number_3 = Number(round100_6)
merge_5 = Merge(Data1=round100_2, Data2=round100)

pan_2 = Panel("Embodied Carbon Footprint [A1-A3; C3-C4] per m2: {0} kg CO2e / m2")
format_7 = Format(Format=pan_2, Culture=127, Data0=round100_4)
setlabel_7 = SetLabelContents(LabelToModify=label, NewLabelContents=format_7)

format_8 = Format(Format="Total Carbon Footprint per m2: {0} kg CO2e / m2", Culture=127, Data0=number_3)
setlabel_8 = SetLabelContents(LabelToModify=label_2, NewLabelContents=format_8)

format_9 = Format(Format="Operation Carbon Footprint [B6] per m2: {0} kg CO2e / m2", Culture=127, Data0=round100_5)
setlabel_9 = SetLabelContents(LabelToModify=label_3, NewLabelContents=format_9)

create_multi_chart_2 = CreateMultiChart(Data=merge_5, Names=merge, SubTitle="Carbon Footprint per m2", ClusterTitle=" ", ChartType=Slider(3, range=0..10))
chart_appearance_2 = ChartAppearance(ChartToModify=create_multi_chart_2, Colors=gradient_2, Legend=Toggle(True))
merge_6 = Merge(
    Data1=create_toggle,
    Data3=create_pulldown_menu_2,
    Data4=create_pulldown_menu,
    Data6=create_button,
    Data7=create_separator_3,
    Data8=label_2,
    Data9=label,
    Data10=label_3,
    Data12=flatten(create_multi_chart_2),
    Data15=flatten(create_multi_chart),
    Data16=create_separator,
    Data17=label_4,
    Data18=label_6,
    Data19=label_8,
    Data20=label_7,
    Data21=label_5,
    Data22=label_9,
    Data26=flatten(create_image),
    Data27=create_separator_2)

# ----
# 3. Add the element to the window
addelems = AddElements(Window=launchwin, Elements=flatten(merge_6), DoVLChecking=True)  # -> AddedElements, ElementNames

toggle_3 = FalseStartToggle(False)
number_slider_4 = Slider(500, range=0..1000)
multiplication_8 = Multiplication(A=number_slider_4, B=Slider(0.8, range=0..1))
division_6 = Division(A=number_slider_4, B=2)
multiplication_9 = Multiplication(A=division_6, B=-1)
division_7 = Division(A=multiplication_8, B=2)
multiplication_10 = Multiplication(A=division_7, B=-1)
dom_2 = ConstructDomain(DomainStart=division_6, DomainEnd=multiplication_9)
dom_3 = ConstructDomain(DomainStart=division_7, DomainEnd=multiplication_10)
swatch = ColourSwatch(SwatchColor=RGB(255, 255, 255))
rectangle = Rectangle(Plane=PlaneXY(0, 0, 0), XSize=dom_2, YSize=dom_2, Radius=0)  # -> Rectangle, Length
rectangle_2 = Rectangle(Plane=PlaneXY(0, 0, 0), XSize=dom_3, YSize=dom_3, Radius=0)  # -> Rectangle, Length
srf = Surface(rectangle.Rectangle)
bake = ObjectBake(
    BakeToggle=toggle_3,
    GeometryObjects=srf,
    Layer="Ground",
    ObjectName="GH_Obj",
    ObjectColor=RGB(255, 255, 255),
    LayerColor=RGB(255, 255, 255))
data = Data(rectangle_2.Rectangle)

# ==== cluster ReadAreas
run = ClusterInput()
run_2 = Boolean(run)
read_building_shape = ReadBuildingShape(run=run_2)  # -> walls_2, roof_2, groundfloor_2, window_north_2, window_south_2, window_west_2, window_east_2
geo = Geometry([read_building_shape.walls_2, read_building_shape.roof_2, read_building_shape.groundfloor_2])
debrep = DeconstructBrep(Brep=geo)  # -> Faces, Edges, Vertices
swatch = ColourSwatch(SwatchColor=RGB(186, 186, 186))
geo_2 = Geometry(debrep.Edges)
previewmat = CustomPreviewMaterials(Geometry=read_building_shape.walls_2, DiffuseColor=ColourSwatch(SwatchColor=RGB(255, 255, 255)))
previewmat_2 = CustomPreviewMaterials(Geometry=read_building_shape.roof_2, DiffuseColor=swatch)
previewmat_3 = CustomPreviewMaterials(
    Geometry=[read_building_shape.window_north_2, read_building_shape.window_south_2, read_building_shape.window_west_2, read_building_shape.window_east_2],
    DiffuseColor=ColourSwatch(SwatchColor=RGBA(169, 212, 219, 118)),
    Transparency=Slider(0.4, range=0..1))
preview = CustomPreview(Geometry=geo_2, Material=swatch)
data = Data(read_building_shape.walls_2)
area = Area(Geometry=data)  # -> Area, Centroid
total_area = TotalArea(geometry=read_building_shape.window_north_2)
total_area_2 = TotalArea(geometry=read_building_shape.window_south_2)
total_area_3 = TotalArea(geometry=read_building_shape.window_west_2)
total_area_4 = TotalArea(geometry=read_building_shape.window_east_2)
total_area_5 = TotalArea(geometry=read_building_shape.walls_2)
total_area_6 = TotalArea(geometry=read_building_shape.roof_2)
total_area_7 = TotalArea(geometry=read_building_shape.groundfloor_2)
brep = Brep([read_building_shape.walls_2, read_building_shape.roof_2, read_building_shape.groundfloor_2, read_building_shape.window_north_2, read_building_shape.window_south_2, read_building_shape.window_west_2, read_building_shape.window_east_2])
pdecon = Deconstruct(Point=area.Centroid)  # -> XComponent, YComponent, ZComponent
brep_2 = Brep(flatten(brep))
round = Round(Number=pdecon.ZComponent)  # -> Nearest, Floor, Ceiling
window_north = Data(total_area)
window_south = Data(total_area_2)
window_west = Data(total_area_3)
window_east = Data(total_area_4)
walls = Data(total_area_5)
roof = Data(total_area_6)
groundfloor = Data(total_area_7)
join = BrepJoin(Breps=brep_2)  # -> Breps, Closed
sort = SortList(Keys=round.Nearest)  # -> Keys, ValuesA
dcon = DeleteConsecutive(Set=sort.Keys, Wrap=False)  # -> Set, Count
volume = Volume(Geometry=join.Breps)  # -> Volume, Centroid
lng = ListLength(List=dcon.Set)
window_north_2 = ClusterOutput(window_north)
window_south_2 = ClusterOutput(window_south)
window_west_2 = ClusterOutput(window_west)
walls_2 = ClusterOutput(walls)
roof_2 = ClusterOutput(roof)
groundfloor_2 = ClusterOutput(groundfloor)
window_east_2 = ClusterOutput(window_east)
volume_2 = ClusterOutput(volume.Volume)
levels = ClusterOutput(lng)

# ==== cluster Round100
A = ClusterInput()
multiplication = Multiplication(A=A, B=100)
round = Round(Number=multiplication)  # -> Nearest, Floor, Ceiling
division = Division(A=round.Floor, B=100)
result = ClusterOutput(division)

# ==== cluster ReadBuildingShape: Reads Building Geometry from Rhino file based on Layer Names
run = ClusterInput()
run_2 = Boolean(run)
python = PythonScript(Ls="Window_North", x=run_2)  # -> out, a; inputs Ls: list
# ---------- python: Python ----------
import rhinoscriptsyntax as rs
import scriptcontext as sc
import Rhino


a = None

if x:
    sc.doc = Rhino.RhinoDoc.ActiveDoc
    
    all_objs = []
    for layer in Ls:
        
        objs = rs.ObjectsByLayer(layer)
        if objs:
            #you need to get the geometry from IDs
            objs = [rs.coercegeometry(x) for x in objs]
            #if you want to use rs, then add to the current doc
            objs = [ghdoc.Objects.Add(x) for x in objs]
            all_objs.extend(objs)
            
    a = all_objs
    
    sc.doc = ghdoc
# ---------- end python ----------
python_2 = PythonScript(Ls="Walls", x=run_2)  # -> out, a; inputs Ls: list; same code as python
python_3 = PythonScript(Ls="GroundFloor", x=run_2)  # -> out, a; inputs Ls: list; same code as python
python_4 = PythonScript(Ls="Roofs", x=run_2)  # -> out, a; inputs Ls: list; same code as python
python_5 = PythonScript(Ls="Window_South", x=run_2)  # -> out, a; inputs Ls: list; same code as python
python_6 = PythonScript(Ls="Window_West", x=run_2)  # -> out, a; inputs Ls: list; same code as python
python_7 = PythonScript(Ls="Window_East", x=run_2)  # -> out, a; inputs Ls: list; same code as python
panel = Panel(python.a)
panel_2 = Panel(python_2.a)
panel_3 = Panel(python_3.a)
panel_4 = Panel(python_4.a)
panel_5 = Panel(python_5.a)
panel_6 = Panel(python_6.a)
panel_7 = Panel(python_7.a)
window_north = Data(python.a)
groundfloor = Data(python_3.a)
window_south = Data(python_5.a)
walls = Data(python_2.a)
roof = Data(python_4.a)
window_west = Data(python_6.a)
Z = UnitZ(Factor=1)
window_east = Data(python_7.a)
walls_2 = ClusterOutput(walls)
roof_2 = ClusterOutput(roof)
groundfloor_2 = ClusterOutput(groundfloor)
window_north_2 = ClusterOutput(window_north)
window_south_2 = ClusterOutput(window_south)
window_west_2 = ClusterOutput(window_west)
window_east_2 = ClusterOutput(window_east)

# ==== cluster TotalArea
geometry = ClusterInput()
geometry_2 = Geometry(geometry)
area = Area(Geometry=flatten(geometry_2))  # -> Area, Centroid
ma = MassAddition(Input=area.Area)  # -> Result, PartialResults
total_area = Data(ma.Result)
total_area_2 = ClusterOutput(total_area)
